# Grasshopper definition Structure_Model_Final.gh (Grasshopper 1.0.7)
# plug-ins: Hare, step

number_slider = Slider(10000, range=0..10000)
# 倒角矩形
rectangle = Rectangle(Plane=PlaneXY(0, 0, 0), XSize=number_slider, YSize=number_slider, Radius=Slider(2399, range=0..10000))  # -> Rectangle, Length
explode = Explode(Curve=rectangle.Rectangle, Recursive=True)  # -> Segments, Vertices
dispatch = Dispatch(List=explode.Segments, DispatchPattern=[True, False])  # -> ListA, ListB
list_item = ListItem(List=explode.Segments, Index=Slider(3, range=0..10), Wrap=True)
curve = Curve(dispatch.ListA)
curve_2 = Curve(dispatch.ListB)
end_points = EndPoints(Curve=curve_2)  # -> Start, End
curve_middle = CurveMiddle(Curve=curve_2)
point = Point(end_points.Start)
point_2 = Point(end_points.End)

c1_h = Slider(38000, range=0..100000)
# 几何参数
col_l = Slider(83000, range=0..100000)
c1_r = Slider(6750, range=0..10000)
hea_l = Slider(8000, range=0..10000)
hea_r = Slider(12500, range=0..100000)
bn_l1 = Slider(4250, range=0..10000)
hea_h = Slider(3000, range=0..10000)
tr_h = Slider(3000, range=0..10000)

p_w = Slider(6500, range=0..10000)

s_n = Slider(72, range=0..100)
s_h6 = Slider(3000, range=0..10000)
s_h5 = Slider(2600, range=0..10000)
s_h3 = Slider(19200, range=0..100000)
s_h4 = Slider(26400, range=0..100000)
s_h2 = Slider(2400, range=0..10000)
s_n1 = Slider(6, range=0..10)
s_r2 = Slider(4672, range=0..10000)
s_h1 = Slider(12000, range=0..100000)

s_n2 = Slider(3, range=0..10)
subtraction = Subtraction(A=c1_h, B=hea_h)

# ----
# S_C4_H_D
panel = Panel("""0
8300
2400
2400
2400
2000
2000
2000""")

# ----
# S_C4_H_M
panel_2 = Panel("""2600
2600""")

# ---- group: S_BR_N1
panel_3 = Panel("""2400
2400
2400
2400
2400
2000
2000""")

# ----
s_bn_l1 = Slider(2970, range=0..10000)

bn_l2 = Slider(6030, range=0..10000)
bn_h1 = Slider(6120, range=0..10000)
bn_h2 = Slider(12000, range=0..100000)
tn_l1 = Slider(870, range=0..1000)
tn_l2 = Slider(3060, range=0..10000)
bn_l3 = Slider(4000, range=0..10000)
n_r = Slider(1600, range=0..10000)

tr_w = Slider(3200, range=0..10000)

s_c4_r_d = Slider(2247, range=0..10000)
s_c4_r_m = Slider(6000, range=0..10000)

c4_h_d = Slider(24500, range=0..100000)
c4_h_m = Slider(8000, range=0..10000)
c4_h_u = Slider(5500, range=0..10000)
c4_r_d = Slider(3500, range=0..10000)
c4_r_u = Slider(6000, range=0..10000)

p_h = Slider(3000, range=0..10000)
p_r = Slider(600, range=0..1000)
br_w = Slider(3000, range=0..10000)
p_l3 = Slider(1200, range=0..10000)
p_l1 = Slider(1500, range=0..10000)
p_l2 = Slider(1200, range=0..10000)

s_p_l1 = Slider(4800, range=0..10000)
s_p_l2 = Slider(12000, range=0..100000)
s_p_n1 = Slider(5, range=0..10)
s_p_l3 = Slider(1500, range=0..10000)

unit_x = UnitX(Factor=c1_r)

# ---- group: S_P_N2
panel_4 = Panel("""2400
2400
2400""")

# ----
subtraction_2 = Subtraction(A=c4_h_d, B=p_h)
negative = Negative(Value=unit_x)
unit_z = UnitZ(Factor=c1_h)
unit_z_2 = UnitZ(Factor=c4_h_u)
unit_z_3 = UnitZ(Factor=c4_h_u)
division = Division(A=tr_w, B="2")
unit_y = UnitY(Factor=division)
negative_2 = Negative(Value=unit_y)

# ---- group: 支撑梁 / 是否拷贝至犀牛
boolean_toggle = BooleanToggle(False)

# ---- group: 支撑梁 / 是否导出至Excel
button = Button()

# ---- group: 支撑梁 / 材料名称
panel_5 = Panel("H355")

# ----
number_slider_2 = Slider(2, range=0..10)

# ---- group: 外围竖向
panel_6 = Panel("D:\Study\SEASAM\sjy_struct\Ideal_Model\hea1_waiweishuxiang.xlsx")
截面名称 = ValueList({"B3000_3200", "BSRAbulb200x10x28x8x8x3", "BSRAbulb200x12x28x8x8x3", "BSRAbulb320x13x46x14x14x4", "BSRAbulb340x14x49x15x15x4", "BSRAbulb370x14x54x16x16x4", "BSRAbulb400x14x58x18x18x4", "BSRAbulb400x16x58x18x18x4", "BSRAbulb430x15x62x20x20x4", "BSRAbulb430x17x62x20x20x4"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}, selected="T15_600_27_200")
panel_7 = Panel("""Set
Location_start
Location_mid
Location_end
Z_vector
Material_name
Section_name
Timestamp
Beam_type
Is_offset""")
截面是否偏移 = ValueList({"yes", "no"}, selected="yes")
梁类型 = ValueList({"straight", "curve"}, selected="straight")

# ---- group: 内测竖向
panel_8 = Panel("D:\Study\SEASAM\sjy_struct\Ideal_Model\hea1_neiceshuxiang.xlsx")
截面名称_2 = ValueList({"B3000_3200", "BSRAbulb200x10x28x8x8x3", "BSRAbulb200x12x28x8x8x3", "BSRAbulb320x13x46x14x14x4", "BSRAbulb340x14x49x15x15x4", "BSRAbulb370x14x54x16x16x4", "BSRAbulb400x14x58x18x18x4", "BSRAbulb400x16x58x18x18x4", "BSRAbulb430x15x62x20x20x4", "BSRAbulb430x17x62x20x20x4"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}, selected="P325")
panel_9 = Panel("""Set
Location_start
Location_mid
Location_end
Z_vector
Material_name
Section_name
Timestamp
Beam_type
Is_offset""")
截面是否偏移_2 = ValueList({"yes", "no"}, selected="no")
梁类型_2 = ValueList({"straight", "curve"}, selected="straight")

# ---- group: 纵向
panel_10 = Panel("D:\Study\SEASAM\sjy_struct\Ideal_Model\BR_Zong.xlsx")
截面名称_3 = ValueList({"B3000_3200", "BSRAbulb200x10x28x8x8x3", "BSRAbulb200x12x28x8x8x3", "BSRAbulb320x13x46x14x14x4", "BSRAbulb340x14x49x15x15x4", "BSRAbulb370x14x54x16x16x4", "BSRAbulb400x14x58x18x18x4", "BSRAbulb400x16x58x18x18x4", "BSRAbulb430x15x62x20x20x4", "BSRAbulb430x17x62x20x20x4"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}, selected="BSRAbulb430x20x62x20x20x4")
截面是否偏移_3 = ValueList({"yes", "no"}, selected="yes")
梁类型_3 = ValueList({"straight", "curve"}, selected="straight")

# ---- group: 侧边竖向 / 是否拷贝至犀牛
boolean_toggle_2 = BooleanToggle(False)

# ---- group: 外围竖向 / 是否拷贝至犀牛
boolean_toggle_3 = BooleanToggle(False)

# ---- group: 内测竖向 / 是否拷贝至犀牛
boolean_toggle_4 = BooleanToggle(False)

# ---- group: 侧边竖向 / 是否导出至Excel
button_2 = Button()

# ---- group: 外围竖向 / 是否导出至Excel
button_3 = Button()

# ---- group: 内测竖向 / 是否导出至Excel
button_4 = Button()

# ---- group: 底层T / 是否拷贝至犀牛
boolean_toggle_5 = BooleanToggle(False)

# ---- group: 侧边竖向 / 材料名称
panel_11 = Panel("H355")

# ---- group: 顶层T / 是否拷贝至犀牛
boolean_toggle_6 = BooleanToggle(False)

# ---- group: 中间层水平
panel_12 = Panel("D:\Study\SEASAM\sjy_struct\Ideal_Model\BN_Z_sp.xlsx")
截面名称_4 = ValueList({"B3000_3200", "BSRAbulb200x10x28x8x8x3", "BSRAbulb200x12x28x8x8x3", "BSRAbulb320x13x46x14x14x4", "BSRAbulb340x14x49x15x15x4", "BSRAbulb370x14x54x16x16x4", "BSRAbulb400x14x58x18x18x4", "BSRAbulb400x16x58x18x18x4", "BSRAbulb430x15x62x20x20x4", "BSRAbulb430x17x62x20x20x4"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}, selected="BSRAbulb430x20x62x20x20x4")
截面是否偏移_4 = ValueList({"yes", "no"}, selected="yes")
梁类型_4 = ValueList({"straight", "curve"}, selected="straight")

# ---- group: 底层骨材 / 是否拷贝至犀牛
boolean_toggle_7 = BooleanToggle(False)

# ---- group: 外围竖向 / 材料名称
panel_13 = Panel("H355")

# ---- group: 内测竖向 / 材料名称
panel_14 = Panel("H355")

# ---- group: 底层T / 是否导出至Excel
button_5 = Button()

# ---- group: 竖向框次T
panel_15 = Panel("D:\Study\SEASAM\sjy_struct\Ideal_Model\BN_SCT.xlsx")
截面名称_5 = ValueList({"B3000_3200", "BSRAbulb200x10x28x8x8x3", "BSRAbulb200x12x28x8x8x3", "BSRAbulb320x13x46x14x14x4", "BSRAbulb340x14x49x15x15x4", "BSRAbulb370x14x54x16x16x4", "BSRAbulb400x14x58x18x18x4", "BSRAbulb400x16x58x18x18x4", "BSRAbulb430x15x62x20x20x4", "BSRAbulb430x17x62x20x20x4"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}, selected="BSRAbulb430x20x62x20x20x4")
截面是否偏移_5 = ValueList({"yes", "no"}, selected="yes")
梁类型_5 = ValueList({"straight", "curve"}, selected="straight")

# ---- group: 顶层T / 是否导出至Excel
button_6 = Button()

# ---- group: 顶层骨材 / 是否拷贝至犀牛
boolean_toggle_8 = BooleanToggle(False)

# ---- group: 框架T
panel_16 = Panel("D:\Study\SEASAM\sjy_struct\Ideal_Model\BN_KuangT.xlsx")
截面名称_6 = ValueList({"B3000_3200", "BSRAbulb200x10x28x8x8x3", "BSRAbulb200x12x28x8x8x3", "BSRAbulb320x13x46x14x14x4", "BSRAbulb340x14x49x15x15x4", "BSRAbulb370x14x54x16x16x4", "BSRAbulb400x14x58x18x18x4", "BSRAbulb400x16x58x18x18x4", "BSRAbulb430x15x62x20x20x4", "BSRAbulb430x17x62x20x20x4"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}, selected="T15_800_20_300")
截面是否偏移_6 = ValueList({"yes", "no"}, selected="yes")
梁类型_6 = ValueList({"straight", "curve"}, selected="straight")

# ---- group: 竖向框T
panel_17 = Panel("D:\Study\SEASAM\sjy_struct\Ideal_Model\BN_ST.xlsx")
截面名称_7 = ValueList({"B3000_3200", "BSRAbulb200x10x28x8x8x3", "BSRAbulb200x12x28x8x8x3", "BSRAbulb320x13x46x14x14x4", "BSRAbulb340x14x49x15x15x4", "BSRAbulb370x14x54x16x16x4", "BSRAbulb400x14x58x18x18x4", "BSRAbulb400x16x58x18x18x4", "BSRAbulb430x15x62x20x20x4", "BSRAbulb430x17x62x20x20x4"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}, selected="T15_800_20_300")
截面是否偏移_7 = ValueList({"yes", "no"}, selected="yes")
梁类型_7 = ValueList({"straight", "curve"}, selected="straight")

# ---- group: 底层骨材 / 是否导出至Excel
button_7 = Button()

# ---- group: 框架T
panel_18 = Panel("D:\Study\SEASAM\sjy_struct\Ideal_Model\BN_KuangT.xlsx")
截面名称_8 = ValueList({"B3000_3200", "BSRAbulb200x10x28x8x8x3", "BSRAbulb200x12x28x8x8x3", "BSRAbulb320x13x46x14x14x4", "BSRAbulb340x14x49x15x15x4", "BSRAbulb370x14x54x16x16x4", "BSRAbulb400x14x58x18x18x4", "BSRAbulb400x16x58x18x18x4", "BSRAbulb430x15x62x20x20x4", "BSRAbulb430x17x62x20x20x4"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}, selected="T15_800_20_300")
截面是否偏移_8 = ValueList({"yes", "no"}, selected="yes")
梁类型_8 = ValueList({"straight", "curve"}, selected="straight")

# ---- group: 底层T / 材料名称
panel_19 = Panel("H355")

# ---- group: 顶层骨材 / 是否导出至Excel
button_8 = Button()

# ---- group: 顶层T / 材料名称
panel_20 = Panel("H355")

# ---- group: 上层次T
panel_21 = Panel("D:\Study\SEASAM\sjy_struct\Ideal_Model\C4_SXT.xlsx")
截面名称_9 = ValueList({"B3000_3200", "BSRAbulb200x10x28x8x8x3", "BSRAbulb200x12x28x8x8x3", "BSRAbulb320x13x46x14x14x4", "BSRAbulb340x14x49x15x15x4", "BSRAbulb370x14x54x16x16x4", "BSRAbulb400x14x58x18x18x4", "BSRAbulb400x16x58x18x18x4", "BSRAbulb430x15x62x20x20x4", "BSRAbulb430x17x62x20x20x4"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}, selected="T15_800_20_300")
截面是否偏移_9 = ValueList({"yes", "no"}, selected="yes")
梁类型_9 = ValueList({"straight", "curve"}, selected="straight")

# ---- group: 竖向次梁
panel_22 = Panel("D:\Study\SEASAM\sjy_struct\Ideal_Model\C4_SXCT.xlsx")
截面名称_10 = ValueList({"B3000_3200", "BSRAbulb200x10x28x8x8x3", "BSRAbulb200x12x28x8x8x3", "BSRAbulb320x13x46x14x14x4", "BSRAbulb340x14x49x15x15x4", "BSRAbulb370x14x54x16x16x4", "BSRAbulb400x14x58x18x18x4", "BSRAbulb400x16x58x18x18x4", "BSRAbulb430x15x62x20x20x4", "BSRAbulb430x17x62x20x20x4"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}, selected="BSRAbulb340x14x49x15x15x4")
截面是否偏移_10 = ValueList({"yes", "no"}, selected="yes")
梁类型_10 = ValueList({"straight", "curve"}, selected="straight")

# ---- group: 底层骨材 / 材料名称
panel_23 = Panel("H355")

# ---- group: 外舱壁加强筋
panel_24 = Panel("D:\Study\SEASAM\sjy_struct\Ideal_Model\C1_wcsx.xlsx")
截面名称_11 = ValueList({"B3000_3200", "BSRAbulb200x10x28x8x8x3", "BSRAbulb200x12x28x8x8x3", "BSRAbulb320x13x46x14x14x4", "BSRAbulb340x14x49x15x15x4", "BSRAbulb370x14x54x16x16x4", "BSRAbulb400x14x58x18x18x4", "BSRAbulb400x16x58x18x18x4", "BSRAbulb430x15x62x20x20x4", "BSRAbulb430x17x62x20x20x4"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}, selected="BSRAbulb340x14x49x15x15x4")
截面是否偏移_11 = ValueList({"yes", "no"}, selected="yes")
梁类型_11 = ValueList({"straight", "curve"}, selected="straight")

# ---- group: 顶层骨材 / 材料名称
panel_25 = Panel("H355")

# ---- group: 底部竖向
panel_26 = Panel("D:\Study\SEASAM\sjy_struct\Ideal_Model\C1_dbsx.xlsx")
截面名称_12 = ValueList({"B3000_3200", "BSRAbulb200x10x28x8x8x3", "BSRAbulb200x12x28x8x8x3", "BSRAbulb320x13x46x14x14x4", "BSRAbulb340x14x49x15x15x4", "BSRAbulb370x14x54x16x16x4", "BSRAbulb400x14x58x18x18x4", "BSRAbulb400x16x58x18x18x4", "BSRAbulb430x15x62x20x20x4", "BSRAbulb430x17x62x20x20x4"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}, selected="T15_800_20_300")
截面是否偏移_12 = ValueList({"yes", "no"}, selected="yes")
梁类型_12 = ValueList({"straight", "curve"}, selected="straight")

# ---- group: 支撑梁 / 是否拷贝至犀牛
boolean_toggle_9 = BooleanToggle(False)

# ---- group: 中间层水平 / 是否拷贝至犀牛
boolean_toggle_10 = BooleanToggle(False)

# ---- group: 前T / 是否拷贝至犀牛
boolean_toggle_11 = BooleanToggle(False)

# ---- group: 中间层竖向 / 是否拷贝至犀牛
boolean_toggle_12 = BooleanToggle(False)

# ---- group: 框架T
panel_27 = Panel("D:\Study\SEASAM\sjy_struct\Ideal_Model\BR_KuangT.xlsx")
截面名称_13 = ValueList({"B3000_3200", "BSRAbulb200x10x28x8x8x3", "BSRAbulb200x12x28x8x8x3", "BSRAbulb320x13x46x14x14x4", "BSRAbulb340x14x49x15x15x4", "BSRAbulb370x14x54x16x16x4", "BSRAbulb400x14x58x18x18x4", "BSRAbulb400x16x58x18x18x4", "BSRAbulb430x15x62x20x20x4", "BSRAbulb430x17x62x20x20x4"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}, selected="T15_700_20_300")
截面是否偏移_13 = ValueList({"yes", "no"}, selected="yes")
梁类型_13 = ValueList({"straight", "curve"}, selected="straight")

# ---- group: 后T / 是否拷贝至犀牛
boolean_toggle_13 = BooleanToggle(False)

# ---- group: 框架T / 是否拷贝至犀牛
boolean_toggle_14 = BooleanToggle(True)

# ---- group: 竖向框次T / 是否拷贝至犀牛
boolean_toggle_15 = BooleanToggle(False)

# ---- group: 支撑梁 / 是否导出至Excel
button_9 = Button()

# ---- group: 框架T / 是否拷贝至犀牛
boolean_toggle_16 = BooleanToggle(False)

# ---- group: 竖向框T / 是否拷贝至犀牛
boolean_toggle_17 = BooleanToggle(False)

# ---- group: 中间层水平 / 是否导出至Excel
button_10 = Button()

# ---- group: 前T / 是否导出至Excel
button_11 = Button()

# ---- group: 底层T / 是否拷贝至犀牛
boolean_toggle_18 = BooleanToggle(False)

# ---- group: 上层T / 是否拷贝至犀牛
boolean_toggle_19 = BooleanToggle(False)

# ---- group: 中间层竖向 / 是否导出至Excel
button_12 = Button()

# ---- group: 后T / 是否导出至Excel
button_13 = Button()

# ---- group: 框架T / 是否导出至Excel
button_14 = Button()

# ---- group: 竖向框次T / 是否导出至Excel
button_15 = Button()

# ---- group: 顶部外横梁 / 是否拷贝至犀牛
boolean_toggle_20 = BooleanToggle(False)

# ---- group: 顶部内横梁 / 是否拷贝至犀牛
boolean_toggle_21 = BooleanToggle(False)

# ---- group: 框架T / 是否导出至Excel
button_16 = Button()

# ---- group: 竖向框T / 是否导出至Excel
button_17 = Button()

# ---- group: 底部内横梁 / 是否拷贝至犀牛
boolean_toggle_22 = BooleanToggle(False)

# ---- group: 底层T / 是否导出至Excel
button_18 = Button()

# ---- group: 上层T / 是否导出至Excel
button_19 = Button()

# ---- group: 支撑梁 / 材料名称
panel_28 = Panel("H355")

# ---- group: 上层次T / 是否拷贝至犀牛
boolean_toggle_23 = BooleanToggle(False)

# ---- group: 竖向次梁 / 是否拷贝至犀牛
boolean_toggle_24 = BooleanToggle(True)

# ---- group: 顶部外横梁 / 是否导出至Excel
button_20 = Button()

# ---- group: 顶部内横梁 / 是否导出至Excel
button_21 = Button()

# ---- group: 外舱壁加强筋 / 是否拷贝至犀牛
boolean_toggle_25 = BooleanToggle(False)

# ---- group: 底部外横梁 / 是否拷贝至犀牛
boolean_toggle_26 = BooleanToggle(False)

# ---- group: 中间层水平 / 材料名称
panel_29 = Panel("H355")

# ---- group: 前T / 材料名称
panel_30 = Panel("H355")

# ---- group: 中间层竖向 / 材料名称
panel_31 = Panel("H355")

# ---- group: 分舱壁竖向加强筋 / 是否拷贝至犀牛
boolean_toggle_27 = BooleanToggle(False)

# ---- group: 竖向次梁 / 是否导出至Excel
button_22 = Button()

# ---- group: 后T / 材料名称
panel_32 = Panel("H355")

# ---- group: 底部内横梁 / 是否导出至Excel
button_23 = Button()

# ---- group: 框架T / 材料名称
panel_33 = Panel("H355")

# ---- group: 竖向框次T / 材料名称
panel_34 = Panel("H355")

# ---- group: 上层次T / 是否导出至Excel
button_24 = Button()

# ---- group: 框架T / 材料名称
panel_35 = Panel("H355")

# ---- group: 竖向框T / 材料名称
panel_36 = Panel("H355")

# ---- group: 外舱壁加强筋 / 是否导出至Excel
button_25 = Button()

# ---- group: 底部外横梁 / 是否导出至Excel
button_26 = Button()

# ---- group: 分舱壁水平加强筋 / 是否拷贝至犀牛
boolean_toggle_28 = BooleanToggle(False)

# ---- group: 环向水平加强筋 / 是否拷贝至犀牛
boolean_toggle_29 = BooleanToggle(False)

# ---- group: 底部竖向 / 是否拷贝至犀牛
boolean_toggle_30 = BooleanToggle(False)

# ---- group: 底层T / 材料名称
panel_37 = Panel("H355")

# ---- group: 上层T / 材料名称
panel_38 = Panel("H355")

# ---- group: 分舱壁竖向加强筋 / 是否导出至Excel
button_27 = Button()

# ---- group: 顶部外横梁 / 材料名称
panel_39 = Panel("H355")

# ---- group: 顶部内横梁 / 材料名称
panel_40 = Panel("H355")

# ---- group: 底部内横梁 / 材料名称
panel_41 = Panel("H355")

# ---- group: 分舱壁水平加强筋 / 是否导出至Excel
button_28 = Button()

# ---- group: 环向水平加强筋 / 是否导出至Excel
button_29 = Button()

# ---- group: 底部竖向 / 是否导出至Excel
button_30 = Button()

# ---- group: 上层次T / 材料名称
panel_42 = Panel("H355")

# ---- group: 竖向次梁 / 材料名称
panel_43 = Panel("H355")

# ---- group: 外舱壁加强筋 / 材料名称
panel_44 = Panel("H355")

# ---- group: 底部外横梁 / 材料名称
panel_45 = Panel("H355")

# ---- group: 纵向 / 是否拷贝至犀牛
boolean_toggle_31 = BooleanToggle(True)

# ---- group: 分舱壁竖向加强筋 / 材料名称
panel_46 = Panel("H355")

# ---- group: 框架T / 是否拷贝至犀牛
boolean_toggle_32 = BooleanToggle(False)

# ---- group: 分舱壁水平加强筋 / 材料名称
panel_47 = Panel("H355")

# ---- group: 环向水平加强筋 / 材料名称
panel_48 = Panel("H355")

# ---- group: 底部竖向 / 材料名称
panel_49 = Panel("H355")

# ---- group: 纵向 / 是否导出至Excel
button_31 = Button()

# ---- group: 框架T / 是否导出至Excel
button_32 = Button()

# ---- group: 纵向 / 材料名称
panel_50 = Panel("H355")

# ---- group: 框架T / 材料名称
panel_51 = Panel("H355")

# ---- group: 侧面次T
panel_52 = Panel("D:\Study\SEASAM\sjy_struct\Ideal_Model\P1_CCT.xlsx")
截面名称_14 = ValueList({"B3000_3200", "BSRAbulb200x10x28x8x8x3", "BSRAbulb200x12x28x8x8x3", "BSRAbulb320x13x46x14x14x4", "BSRAbulb340x14x49x15x15x4", "BSRAbulb370x14x54x16x16x4", "BSRAbulb400x14x58x18x18x4", "BSRAbulb400x16x58x18x18x4", "BSRAbulb430x15x62x20x20x4", "BSRAbulb430x17x62x20x20x4"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}, selected="P1200_C")
截面是否偏移_14 = ValueList({"yes", "no"}, selected="yes")
梁类型_14 = ValueList({"straight", "curve"}, selected="straight")

# ---- group: 竖向次T / 是否拷贝至犀牛
boolean_toggle_33 = BooleanToggle(False)

# ---- group: 竖向圆管 / 是否拷贝至犀牛
boolean_toggle_34 = BooleanToggle(False)

# ---- group: 竖向主T / 是否拷贝至犀牛
boolean_toggle_35 = BooleanToggle(False)

# ---- group: 顶层T / 是否拷贝至犀牛
boolean_toggle_36 = BooleanToggle(False)

# ---- group: 竖向次T / 是否导出至Excel
button_33 = Button()

# ---- group: 底层T / 是否拷贝至犀牛
boolean_toggle_37 = BooleanToggle(False)

# ---- group: 顶层T / 是否拷贝至犀牛
boolean_toggle_38 = BooleanToggle(False)

# ---- group: 竖向圆管 / 是否导出至Excel
button_34 = Button()

# ---- group: 侧面次T / 是否拷贝至犀牛
boolean_toggle_39 = BooleanToggle(False)

# ---- group: 竖向主T / 是否导出至Excel
button_35 = Button()

# ---- group: 顶层T / 是否导出至Excel
button_36 = Button()

# ---- group: 底层次T / 是否拷贝至犀牛
boolean_toggle_40 = BooleanToggle(False)

# ---- group: 底层T / 是否导出至Excel
button_37 = Button()

# ---- group: 顶层T / 是否导出至Excel
button_38 = Button()

# ---- group: 侧面次T / 是否导出至Excel
button_39 = Button()

# ---- group: 竖向次T / 材料名称
panel_53 = Panel("H355")

# ---- group: 底层次T / 是否导出至Excel
button_40 = Button()

# ---- group: 竖向圆管 / 材料名称
panel_54 = Panel("H355")

# ---- group: 竖向主T / 材料名称
panel_55 = Panel("H355")

# ---- group: 顶层T / 材料名称
panel_56 = Panel("H355")

# ---- group: 底层T / 材料名称
panel_57 = Panel("H355")

# ---- group: 顶层T / 材料名称
panel_58 = Panel("H355")

# ---- group: 侧面次T / 材料名称
panel_59 = Panel("H355")

# ---- group: 底层次T / 材料名称
panel_60 = Panel("H355")

# ---- group: C1_circle / 导出犀牛
boolean_toggle_41 = BooleanToggle(False)

# ----
value_list = ValueList({"FB300_20", "HPbulb280x12x40x12x12", "HPbulb300x12x43x13x13", "HPbulb340x12x49x15x15", "HPbulb370x13x54x16x16", "T15_800_20_300", "T15_300_20_150"}, selected="T15_800_20_300")
截面是否偏移_15 = ValueList({"yes", "no"}, selected="yes")
梁类型_15 = ValueList({"straight", "curve"}, selected="curve")
panel_61 = Panel("""Set
Location_start
Location_mid
Location_end
Z_vector
Material_name
Section_name
Timestamp
Beam_type
Is_offset""")

# ---- group: C1_circle / 导出EXCEL
button_41 = Button()

# ---- group: 导出犀牛
boolean_toggle_42 = BooleanToggle(False)

# ---- group: 导出EXCEL
button_42 = Button()

# ---- group: 底层次T
panel_62 = Panel("D:\Study\SEASAM\sjy_struct\Ideal_Model\P1_FS.xlsx")
截面名称_15 = ValueList({"B3000_3200", "BSRAbulb200x10x28x8x8x3", "BSRAbulb200x12x28x8x8x3", "BSRAbulb320x13x46x14x14x4", "BSRAbulb340x14x49x15x15x4", "BSRAbulb370x14x54x16x16x4", "BSRAbulb400x14x58x18x18x4", "BSRAbulb400x16x58x18x18x4", "BSRAbulb430x15x62x20x20x4", "BSRAbulb430x17x62x20x20x4"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}, selected="T15_700_20_300")
截面是否偏移_16 = ValueList({"yes", "no"}, selected="yes")
梁类型_16 = ValueList({"straight", "curve"}, selected="straight")

# ---- group: C1_circle
panel_63 = Panel("D:\Study\SEASAM\sjy_struct\Ideal_Model\P1_F4.xlsx")
截面是否偏移_17 = ValueList({"yes", "no"}, selected="yes")
梁类型_17 = ValueList({"straight", "curve"}, selected="curve")
panel_64 = Panel("H355")
panel_65 = Panel("""Set
Location_start
Location_mid
Location_end
Z_vector
Material_name
Section_name
Timestamp
Beam_type
Is_offset""")

# ---- group: 底层次T / 是否拷贝至犀牛
boolean_toggle_43 = BooleanToggle(False)

# ---- group: C1_circle / 导出犀牛
boolean_toggle_44 = BooleanToggle(False)

# ---- group: C1_circle / 导出EXCEL
button_43 = Button()

# ---- group: 底层次T / 是否导出至Excel
button_44 = Button()

# ---- group: 底层次T / 材料名称
panel_66 = Panel("H355")

# ----
number_slider_3 = Slider(0, range=0..100)
number_slider_4 = Slider(0, range=0..100)
number_slider_5 = Slider(0, range=0..100)
number_slider_6 = Slider(0, range=0..100)
number_slider_7 = Slider(0, range=0..100)
number_slider_8 = Slider(0, range=0..100)
number_slider_9 = Slider(0, range=0..100)
number_slider_10 = Slider(0, range=0..100)
number_slider_11 = Slider(0, range=0..100)
number_slider_12 = Slider(0, range=0..100)
number_slider_13 = Slider(0, range=0..100)

# ----
# 壳单元
addition = Addition(A=subtraction, B=hea_h)
subtraction_3 = Subtraction(A=addition, B=s_h4)
construct_point = ConstructPoint(XCoordinate=0, YCoordinate=0, ZCoordinate=0)
unit_x_2 = UnitX(Factor=1)
subtraction_4 = Subtraction(A=subtraction_3, B=tr_h)
unit_z_4 = UnitZ(Factor=subtraction)
line_sdl = LineSDL(Start=construct_point, Direction=unit_x_2, Length=col_l)
rotate = Rotate(Geometry=line_sdl, Angle=1.047197551, Plane=PlaneXY(0, 0, 0))  # -> Geometry, Transform
end_points_2 = EndPoints(Curve=line_sdl)  # -> Start, End
end_points_3 = EndPoints(Curve=rotate.Geometry)  # -> Start, End
line = Line(StartPoint=end_points_3.End, EndPoint=end_points_2.End)
merge = Merge(Data1=line_sdl, Data2=rotate.Geometry, Data3=line)
join_curves = JoinCurves(Curves=merge, Preserve=False)
area = Area(Geometry=join_curves)  # -> Area, Centroid
vector_2pt = Vector2Pt(PointA=area.Centroid, PointB=construct_point, Unitize=False)  # -> Vector, Length
move = Move(Geometry=join_curves, Motion=vector_2pt.Vector)  # -> Geometry, Transform
rotate_2 = Rotate(Geometry=move.Geometry, Angle=-0.5235987756, Plane=PlaneXY(0, 0, 0))  # -> Geometry, Transform
explode_2 = Explode(Curve=rotate_2.Geometry, Recursive=True)  # -> Segments, Vertices
list_item_2 = ListItem(List=explode_2.Vertices, Index=2, Wrap=True)
list_item_3 = ListItem(List=explode_2.Segments, Index=1, Wrap=True)
negative_3 = Negative(Value=hea_l)
unit_x_3 = UnitX(Factor=negative_3)
division_2 = Division(A=p_w, B="2")
unit_y_2 = UnitY(Factor=hea_r)
negative_4 = Negative(Value=division_2)
offset_curve = OffsetCurve(Curve=list_item_3, Distance=division_2, Plane=PlaneXY(0, 0, 0), Corners=1)
negative_5 = Negative(Value=unit_y_2)
offset_curve_2 = OffsetCurve(Curve=list_item_3, Distance=negative_4, Plane=PlaneXY(0, 0, 0), Corners=1)
xz_plane = XZPlane(Origin=Point(0, 0, 0))
mirror = Mirror(Geometry=offset_curve, Plane=xz_plane)  # -> Geometry, Transform
addition_2 = Addition(A=c1_r, B=bn_l1)
unit_x_4 = UnitX(Factor=addition_2)
unit_y_3 = UnitY(Factor=hea_r)
negative_6 = Negative(Value=unit_y_3)
number_slider_14 = Slider(18, range=0..100)
pi = Pi(Factor=1)
number_slider_15 = Slider(14, range=0..100)
division_3 = Division(A=pi, B=number_slider_14)
xz_plane_2 = XZPlane(Origin=Point(0, 0, 0))
xz_plane_3 = XZPlane(Origin=Point(0, 0, 0))
division_4 = Division(A=number_slider_15, B="4")
round = Round(Number=division_4)  # -> Nearest, Floor, Ceiling
number_slider_16 = Slider(13, range=0..100)
number_slider_17 = Slider(14, range=0..100)
number_slider_18 = Slider(16, range=0..100)
number_slider_19 = Slider(11, range=0..100)
number_slider_20 = Slider(12, range=0..100)
xz_plane_4 = XZPlane(Origin=Point(0, 0, 0))
line_2 = Line(list_item_3)
unit_z_5 = UnitZ(Factor=hea_h)
panel_67 = Panel("""-2
-3
-4""")
negative_7 = Negative(Value=Slider(1, range=0..10))
panel_68 = Panel("""-6
-7""")
number_slider_21 = Slider(1, range=0..10)
negative_8 = Negative(Value=Slider(2, range=0..10))
panel_69 = Panel("""24
25
26
28
29
30
31""")
xz_plane_5 = XZPlane(Origin=Point(0, 0, 0))
panel_70 = Panel("""0
4
7
10
14""")
xz_plane_6 = XZPlane(Origin=Point(0, 0, 0))
xz_plane_7 = XZPlane(Origin=Point(0, 0, 0))
xz_plane_8 = XZPlane(Origin=Point(0, 0, 0))
xz_plane_9 = XZPlane(Origin=Point(0, 0, 0))

# ---- group: 原点
point_3 = Point(construct_point)

# ---- group: 底圆
circle = Circle(Plane=point_3, Radius=c4_r_d)

# ----
# C1中心点
point_4 = Point(list_item_2)

move_2 = Move(Geometry=point_4, Motion=unit_z)  # -> Geometry, Transform

# ---- group: 连接浮箱中点
curve_middle_2 = CurveMiddle(Curve=list_item_3)

# ----
point_5 = Point(point_4)
polygon = Polygon(Plane=point_5, Radius=s_r2, Segments=s_n1, FilletRadius=0)  # -> Polygon, Length
multiplication = Multiplication(A=s_n1, B=s_n2)
pi_2 = Pi(Factor=1)
pi_3 = Pi(Factor=1)
division_5 = Division(A=pi_2, B=s_n1)
division_6 = Division(A=pi_3, B=multiplication)
series = Series(Start=Slider(1, range=0..1), Step=s_n2, Count=s_n1)
division_7 = Division(A=hea_h, B="2")
multiplication_2 = Multiplication(A=s_n1, B=s_n2)
pi_4 = Pi(Factor=1)
unit_z_6 = UnitZ(Factor=division_7)
division_8 = Division(A=pi_4, B=multiplication_2)
move_3 = Move(Geometry=point_5, Motion=unit_z_6)  # -> Geometry, Transform
unit_z_7 = UnitZ(Factor=hea_h)
panel_71 = Panel("""1
4""")
subtraction_5 = Subtraction(A=s_h1, B=hea_h)
unit_z_8 = UnitZ(Factor=subtraction_5)
addition_3 = Addition(A=hea_h, B=s_h2)
unit_z_9 = UnitZ(Factor=s_h1)
series_2 = Series(Start=addition_3, Step=s_h2, Count=Slider(3, range=0..10))
subtraction_6 = Subtraction(A=s_h4, B=hea_h)
unit_z_10 = UnitZ(Factor=series_2)
panel_72 = Panel(series_2)
unit_z_11 = UnitZ(Factor=subtraction_6)
subtraction_7 = Subtraction(A=s_h3, B=s_h1)
addition_4 = Addition(A=s_h1, B=s_h2)
unit_z_12 = UnitZ(Factor=subtraction_7)
subtraction_8 = Subtraction(A=s_h4, B=s_h3)
series_3 = Series(Start=addition_4, Step=s_h2, Count="2")
unit_z_13 = UnitZ(Factor=series_3)
unit_z_14 = UnitZ(Factor=subtraction_8)
addition_5 = Addition(A=s_h3, B=s_h2)
addition_6 = Addition(A=s_h4, B=s_h5)
series_4 = Series(Start=addition_5, Step=s_h2, Count="2")
series_5 = Series(Start=addition_6, Step=s_h6, Count="2")
unit_z_15 = UnitZ(Factor=series_4)
unit_z_16 = UnitZ(Factor=series_5)
unit_z_17 = UnitZ(Factor=subtraction_4)
unit_z_18 = UnitZ(Factor=tr_h)
unit_z_19 = UnitZ(Factor=1)

# ---- group: 底部内圈多边形
rotate_3 = Rotate(Geometry=polygon.Polygon, Angle=division_5, Plane=point_4)  # -> Geometry, Transform

explode_3 = Explode(Curve=rotate_3.Geometry, Recursive=True)  # -> Segments, Vertices

# ----
vector_2pt_2 = Vector2Pt(PointA=curve_middle_2, PointB=construct_point, Unitize=True)  # -> Vector, Length
line_3 = Line(StartPoint=curve_middle_2, EndPoint=construct_point)
length = Length(Curve=line_3)
mass_addition = MassAddition(Input=panel_3)  # -> Result, PartialResults
plane_normal = PlaneNormal(Origin=curve_middle_2, ZAxis=vector_2pt_2.Vector)
multiplication_3 = Multiplication(A=mass_addition.PartialResults, B=vector_2pt_2.Vector)
rectangle_2 = Rectangle(Plane=plane_normal, XSize=br_w, YSize=p_h, Radius=0)  # -> Rectangle, Length
deconstruct_brep = DeconstructBrep(Brep=rectangle_2.Rectangle)  # -> Faces, Edges, Vertices
list_item_4 = ListItem(List=deconstruct_brep.Edges, Index=Slider(2, range=0..10), Wrap=True)
curve_middle_3 = CurveMiddle(Curve=list_item_4)
line_4 = Line(StartPoint=curve_middle_3, EndPoint=curve_middle_2)
division_9 = Division(A=p_w, B="2")
move_4 = Move(Geometry=rectangle_2.Rectangle, Motion=line_4)  # -> Geometry, Transform
multiplication_4 = Multiplication(A=vector_2pt_2.Vector, B=division_9)
subtraction_9 = Subtraction(A=length, B=division_9)
multiplication_5 = Multiplication(A=vector_2pt_2.Vector, B=subtraction_9)
move_5 = Move(Geometry=move_4.Geometry, Motion=multiplication_4)  # -> Geometry, Transform
move_6 = Move(Geometry=move_5.Geometry, Motion=multiplication_3)  # -> Geometry, Transform
extrude = Extrude(Base=move_5.Geometry, Direction=multiplication_5)

# ---- group: 框架梁
curve_3 = Curve(move_6.Geometry)

# ----
explode_4 = Explode(Curve=curve_3, Recursive=True)  # -> simplify(Segments), Vertices
curve_middle_4 = CurveMiddle(Curve=explode_4.Segments)
polyline = PolyLine(Vertices=curve_middle_4, Closed=True)
line_5 = Line(flatten(explode_4.Segments))
surface = Surface(polyline)
area_2 = Area(Geometry=surface)  # -> Area, Centroid
vector_2pt_3 = Vector2Pt(PointA=area_2.Centroid, PointB=curve_middle_4, Unitize=False)  # -> flatten(Vector), Length

mass_addition_2 = MassAddition(Input=panel)  # -> Result, PartialResults
mass_addition_3 = MassAddition(Input=panel_2)  # -> Result, PartialResults
division_10 = Division(A=mass_addition_3.PartialResults, B=c4_h_m)
unit_z_20 = UnitZ(Factor=hea_h)
subtraction_10 = Subtraction(A=c4_r_u, B=c4_r_d)
unit_z_21 = UnitZ(Factor=mass_addition_2.PartialResults)
subtraction_11 = Subtraction(A=c4_h_u, B=tr_h)
multiplication_6 = Multiplication(A=division_10, B=subtraction_10)
move_7 = Move(Geometry=circle, Motion=unit_z_20)  # -> Geometry, Transform
unit_z_22 = UnitZ(Factor=subtraction_11)
addition_7 = Addition(A=multiplication_6, B=c4_r_d)
unit_z_23 = UnitZ(Factor=mass_addition_3.PartialResults)
pi_5 = Pi(Factor=1)
pi_6 = Pi(Factor=1)
division_11 = Division(A=pi_5, B="3")
division_12 = Division(A=pi_6, B="3")
move_8 = Move(Geometry=move_7.Geometry, Motion=unit_z_21)  # -> Geometry, Transform
multiplication_7 = Multiplication(A="3", B="6")

yz_plane = YZPlane(Origin=point_4)
rectangle_3 = Rectangle(Plane=yz_plane, XSize=tr_w, YSize=tr_h, Radius=0)  # -> Rectangle, Length
addition_8 = Addition(A=hea_h, B=subtraction)
unit_z_24 = UnitZ(Factor=addition_8)
division_13 = Division(A=tr_w, B="2")
move_9 = Move(Geometry=rectangle_3.Rectangle, Motion=unit_z_24)  # -> Geometry, Transform
unit_y_4 = UnitY(Factor=division_13)
unit_z_25 = UnitZ(Factor=tr_h)
negative_9 = Negative(Value=unit_z_25)
negative_10 = Negative(Value=unit_y_4)
move_10 = Move(Geometry=move_9.Geometry, Motion=negative_9)  # -> Geometry, Transform
move_11 = Move(Geometry=move_10.Geometry, Motion=negative_10)  # -> Geometry, Transform
addition_9 = Addition(A=c1_r, B=Slider(5000, range=0..10000))
line_6 = Line(StartPoint=construct_point, EndPoint=point_4)
unit_x_5 = UnitX(Factor=addition_9)
surface_2 = Surface(move_11.Geometry)
curve_middle_5 = CurveMiddle(Curve=line_6)
extrude_2 = Extrude(Base=surface_2, Direction=unit_x_5)
yz_plane_2 = YZPlane(Origin=curve_middle_5)
mirror_2 = Mirror(Geometry=extrude_2, Plane=yz_plane_2)  # -> Geometry, Transform

# ----
# 下倒角
# 下倒角
unit_z_26 = UnitZ(Factor=s_h2)
unit_x_6 = UnitX(Factor=s_bn_l1)
line_7 = Line(StartPoint=construct_point, EndPoint=point_4)
unit_x_7 = UnitX(Factor=s_bn_l1)
unit_x_8 = UnitX(Factor=c4_r_u)
unit_z_27 = UnitZ(Factor=1)
unit_z_28 = UnitZ(Factor=1)
unit_z_29 = UnitZ(Factor=hea_h)
negative_11 = Negative(Value=unit_x_8)
unit_x_9 = UnitX(Factor=tn_l2)
subtraction_12 = Subtraction(A=bn_h2, B=hea_h)
unit_x_10 = UnitX(Factor=bn_l1)
negative_12 = Negative(Value=unit_x_9)
unit_z_30 = UnitZ(Factor=c4_h_u)
subtraction_13 = Subtraction(A=bn_h1, B=hea_h)
unit_z_31 = UnitZ(Factor=1)
unit_x_11 = UnitX(Factor=bn_l2)
unit_z_32 = UnitZ(Factor=1)
division_14 = Division(A=s_bn_l1, B="2")
unit_x_12 = UnitX(Factor=division_14)
negative_13 = Negative(Value=unit_x_12)
unit_z_33 = UnitZ(Factor=subtraction)
unit_y_5 = UnitY(Factor=tr_w)
number_slider_22 = Slider(5, range=0..10)
panel_73 = Panel("""1
2""")
multiplication_8 = Multiplication(A=s_h2, B="2")
multiplication_9 = Multiplication(A=s_h2, B="3")
unit_z_34 = UnitZ(Factor=multiplication_8)
unit_z_35 = UnitZ(Factor=multiplication_9)
unit_z_36 = UnitZ(Factor=tr_h)
negative_14 = Negative(Value=unit_z_36)

end_points_4 = EndPoints(Curve=list_item_3)  # -> Start, End
unit_z_37 = UnitZ(Factor=p_h)
negative_15 = Negative(Value=s_p_l3)
addition_10 = Addition(A=p_l1, B=p_l2)
division_15 = Division(A=br_w, B="2")
addition_11 = Addition(A=division_15, B=p_l3)
addition_12 = Addition(A=addition_11, B=p_l2)
panel_74 = Panel("""0
-1
-2""")
addition_13 = Addition(A=division_15, B=p_l3)
addition_14 = Addition(A=p_l2, B=p_l3)
division_16 = Division(A=s_p_l2, B=s_p_n1)
series_6 = Series(Start=division_16, Step=division_16, Count=s_p_n1)
negative_16 = Negative(Value=s_p_l3)
mass_addition_4 = MassAddition(Input=panel_4)  # -> Result, PartialResults
negative_17 = Negative(Value=s_p_l3)
subtraction_14 = Subtraction(A=s_p_n1, B="1")

# ---- group: 方向向量
vector_2pt_4 = Vector2Pt(PointA=end_points_4.End, PointB=end_points_4.Start, Unitize=True)  # -> Vector, Length

# ----
point_6 = Point(construct_point)
addition_15 = Addition(A=hea_h, B=subtraction_2)
circle_2 = Circle(Plane=point_6, Radius=c4_r_u)
addition_16 = Addition(A=addition_15, B=c4_h_m)
unit_z_38 = UnitZ(Factor=tr_h)
unit_z_39 = UnitZ(Factor=addition_15)
surface_3 = Surface(circle)
divide_curve = DivideCurve(Curve=circle, Count="3", Kinks=False)  # -> Points, Tangents, Parameters
unit_z_40 = UnitZ(Factor=addition_16)
pi_7 = Pi(Factor=1)
pi_8 = Pi(Factor=1)
move_12 = Move(Geometry=circle, Motion=unit_z_39)  # -> Geometry, Transform
unit_z_41 = UnitZ(Factor=c4_h_u)
division_17 = Division(A=pi_7, B="3")
division_18 = Division(A=pi_8, B="3")
rotate_4 = Rotate(Geometry=divide_curve.Points, Angle=division_18, Plane=point_3)  # -> Geometry, Transform
area_3 = Area(Geometry=move_12.Geometry)  # -> Area, Centroid
line_8 = Line(StartPoint=point_3, EndPoint=rotate_4.Geometry)
move_13 = Move(Geometry=line_8, Motion=unit_z_39)  # -> Geometry, Transform

# ---- group: 上底圆
move_14 = Move(Geometry=circle_2, Motion=unit_z_40)  # -> Geometry, Transform

# ---- group: 上小圆中心
point_7 = Point(area_3.Centroid)

# ---- group: 下分舱壁
extrude_3 = Extrude(Base=line_8, Direction=unit_z_39)

# ---- group: 3000分舱板
move_15 = Move(Geometry=surface_3, Motion=unit_z_38)  # -> Geometry, Transform

# ---- group: 下侧壁
extrude_4 = Extrude(Base=surface_3, Direction=unit_z_39)

# ---- group: 壳模型
trim_solid = TrimSolid(Shape=extrude, Cutters=extrude_4)

# ----
deconstruct_brep_2 = DeconstructBrep(Brep=trim_solid)  # -> Faces, Edges, Vertices
curve_middle_6 = CurveMiddle(Curve=deconstruct_brep_2.Edges)
list_item_5 = ListItem(List=curve_middle_6, Index=Slider(2, range=0..10), Wrap=True)
list_item_6 = ListItem(List=curve_middle_6, Index=Slider(9, range=0..10), Wrap=True)
list_item_7 = ListItem(List=curve_middle_6, Index=Slider(1, range=0..10), Wrap=True)
list_item_8 = ListItem(List=curve_middle_6, Index=Slider(8, range=0..10), Wrap=True)
list_item_9 = ListItem(List=curve_middle_6, Index=Slider(3, range=0..10), Wrap=True)
list_item_10 = ListItem(List=curve_middle_6, Index=Slider(10, range=0..10), Wrap=True)
list_item_11 = ListItem(List=curve_middle_6, Index=Slider(4, range=0..10), Wrap=True)
list_item_12 = ListItem(List=curve_middle_6, Index=Slider(11, range=0..100), Wrap=True)
# BR1
line_9 = Line(StartPoint=list_item_5, EndPoint=list_item_6)
line_10 = Line(StartPoint=list_item_7, EndPoint=list_item_8)
line_11 = Line(StartPoint=list_item_9, EndPoint=list_item_10)
line_12 = Line(StartPoint=list_item_11, EndPoint=list_item_12)

# ---- group: 纵向梁
merge_2 = Merge(Data1=line_9, Data2=line_10, Data3=line_11, Data4=line_12)

# ---- group: 壳模型
brep = Brep(trim_solid)

# ----
curve_middle_7 = CurveMiddle(Curve=merge_2)
polyline_2 = PolyLine(Vertices=curve_middle_7, Closed=True)
to_abaqus = To_Abaqus(Geometry=brep, Filenames="BR1", Path="D:\Study\SEASAM\sjy_struct\Ideal_Model", Bool=Toggle(False))
surface_4 = Surface(polyline_2)
area_4 = Area(Geometry=surface_4)  # -> Area, Centroid
vector_2pt_5 = Vector2Pt(PointA=area_4.Centroid, PointB=curve_middle_7, Unitize=False)  # -> Vector, Length

number_slider_23 = Slider(31, range=0..100)
number_slider_24 = Slider(32, range=0..100)
cluster = Cluster_5(
    file_path=panel_10,
    run=button_31,
    line=merge_2,
    curve=merge_2,
    relay=merge_2,
    bake=boolean_toggle_31,
    d1="BR1",
    d2=number_slider_23,
    list_a=panel_50,
    seed=number_slider_23,
    d5=vector_2pt_5.Vector,
    list_a_2=截面名称_3,
    A=number_slider_23,
    A_2=number_slider_23,
    list_a_3=number_slider_23,
    list_a_4=梁类型_3,
    list_a_5=截面是否偏移_3)
cluster_2 = Cluster_5(
    file_path=panel_27,
    run=button_32,
    line=line_5,
    curve=line_5,
    relay=line_5,
    bake=boolean_toggle_32,
    d1="BR1",
    d2=number_slider_24,
    list_a=panel_51,
    seed=number_slider_24,
    d5=vector_2pt_3.Vector,
    list_a_2=截面名称_13,
    A=number_slider_24,
    A_2=number_slider_24,
    list_a_3=number_slider_24,
    list_a_4=梁类型_13,
    list_a_5=截面是否偏移_13)

divide_curve_2 = DivideCurve(Curve=move_14.Geometry, Count="3", Kinks=False)  # -> Points, Tangents, Parameters
divide_curve_3 = DivideCurve(Curve=circle, Count="3", Kinks=False)  # -> Points, Tangents, Parameters
multiplication_10 = Multiplication(A="3", B="2")
circle_3 = Circle(Plane=point_7, Radius=addition_7)
end_points_5 = EndPoints(Curve=move_13.Geometry)  # -> Start, End
polygon_2 = Polygon(Plane=point_6, Radius=s_c4_r_d, Segments=multiplication_10, FilletRadius=0)  # -> Polygon, Length
point_8 = Point(rotate_4.Geometry)
move_16 = Move(Geometry=circle_3, Motion=unit_z_23)  # -> Geometry, Transform
rotate_5 = Rotate(Geometry=point_8, Angle=division_11, Plane=PlaneXY(0, 0, 0))  # -> Geometry, Transform
line_13 = Line(StartPoint=point_3, EndPoint=divide_curve_3.Points)
rotate_6 = Rotate(Geometry=end_points_5.End, Angle=division_12, Plane=PlaneXY(0, 0, 0))  # -> Geometry, Transform
explode_5 = Explode(Curve=polygon_2.Polygon, Recursive=True)  # -> Segments, Vertices
list_item_13 = ListItem(List=move_16.Geometry, Index=1, Wrap=True)
merge_3 = Merge(Data1=circle, Data2=move_12.Geometry, Data3=list_item_13)
divide_curve_4 = DivideCurve(Curve=merge_3, Count=multiplication_7, Kinks=False)  # -> Points, Tangents, Parameters
point_9 = Point(rotate_6.Geometry)
dispatch_2 = Dispatch(List=divide_curve_4.Points, DispatchPattern=[False, True, True])  # -> ListA, ListB
line_14 = Line(StartPoint=rotate_5.Geometry, EndPoint=rotate_6.Geometry)
shift_list = ShiftList(List=point_9, Shift=Slider(2, range=0..10), Wrap=True)
flip_matrix = FlipMatrix(Data=dispatch_2.ListA)
polyline_3 = PolyLine(Vertices=flip_matrix, Closed=False)  # -> flatten(Polyline)

# ---- group: 竖向次梁
explode_6 = Explode(Curve=polyline_3, Recursive=True)  # -> Segments, Vertices

# ---- group: 竖向环筋
merge_4 = Merge(Data1=move_8.Geometry, Data2=move_16.Geometry)

# ----
curve_4 = Curve(merge_4)

# ---- group: 底层T材
merge_5 = Merge(Data1=line_13, Data2=explode_5.Segments)

# ---- group: 顶T材
mirror_3 = Mirror(Geometry=merge_5, Plane=move_3.Geometry)  # -> Geometry, Transform

# ----
flip_matrix_2 = FlipMatrix(Data=explode_6.Segments)
curve_middle_8 = CurveMiddle(Curve=flip_matrix_2)
polyline_4 = PolyLine(Vertices=curve_middle_8, Closed=True)
line_15 = Line(flatten(flip_matrix_2))

divide_curve_5 = DivideCurve(Curve=move_14.Geometry, Count="3", Kinks=False)  # -> Points, Tangents, Parameters
rotate_7 = Rotate(Geometry=divide_curve_5.Points, Angle=division_17, Plane=point_3)  # -> Geometry, Transform
area_5 = Area(Geometry=move_14.Geometry)  # -> Area, Centroid
merge_6 = Merge(Data1=move_12.Geometry, Data2=move_14.Geometry)
surface_5 = Surface(move_14.Geometry)

# ---- group: 上圆心
point_10 = Point(area_5.Centroid)

# ----
move_17 = Move(Geometry=point_10, Motion=unit_z_2)  # -> Geometry, Transform

# ---- group: 上部下底点
move_18 = Move(Geometry=point_10, Motion=negative_11)  # -> Geometry, Transform

# ----
line_16 = Line(StartPoint=move_2.Geometry, EndPoint=move_17.Geometry)

line_17 = Line(StartPoint=point_10, EndPoint=rotate_7.Geometry)
entwine = Entwine(Branch00=line_17, Branch01=move_13.Geometry, FlattenInputs=True)
flip_matrix_3 = FlipMatrix(Data=entwine)

# ---- group: 下圆心
point_11 = Point(point_10)

# ---- group: 上圆心
move_19 = Move(Geometry=point_11, Motion=unit_z_30)  # -> Geometry, Transform

# ----
extrude_5 = Extrude(Base=surface_2, Direction=line_16)

# ---- group: 上分舱壁
extrude_6 = Extrude(Base=line_17, Direction=unit_z_41)

# ---- group: 上侧壁
extrude_7 = Extrude(Base=surface_5, Direction=unit_z_41)

# ----
deconstruct_brep_3 = DeconstructBrep(Brep=extrude_7)  # -> Faces, Edges, Vertices
list_item_14 = ListItem(List=deconstruct_brep_3.Faces, Index=Slider(2, range=0..10), Wrap=True)

# ---- group: 上分舱板
move_20 = Move(Geometry=surface_5, Motion=unit_z_22)  # -> Geometry, Transform

# ---- group: 中分舱壁
loft = Loft(Curves=flip_matrix_3, Options={Adjust=False, Closed=False, LoftEnds=0, LoftSimp=0, LoftType=0, Rebuild=10, Refit=0.01})  # -> flatten(Loft)

# ---- group: 变截面侧壁
loft_2 = Loft(Curves=merge_6, Options={Adjust=False, Closed=False, LoftEnds=0, LoftSimp=0, LoftType=0, Rebuild=10, Refit=0.01})

# ----
polygon_3 = Polygon(Plane=point_10, Radius=s_c4_r_m, Segments=multiplication_10, FilletRadius=0)  # -> Polygon, Length
line_18 = Line(StartPoint=point_10, EndPoint=divide_curve_2.Points)
end_points_6 = EndPoints(Curve=line_18)  # -> Start, End
point_12 = Point(end_points_6.End)
move_21 = Move(Geometry=point_12, Motion=unit_z_41)  # -> Geometry, Transform
line_19 = Line(StartPoint=point_12, EndPoint=move_21.Geometry)
line_20 = Line(StartPoint=shift_list, EndPoint=point_12)

explode_7 = Explode(Curve=polygon_3.Polygon, Recursive=True)  # -> Segments, Vertices

merge_7 = Merge(Data1=explode_7.Segments, Data2=line_18)  # -> flatten(Result)
move_22 = Move(Geometry=merge_7, Motion=unit_z_22)  # -> Geometry, Transform

# ---- group: 上两T材
merge_8 = Merge(Data1=merge_7, Data2=move_22.Geometry)

# ---- group: 顶次T
move_23 = Move(Geometry=merge_7, Motion=unit_z_41)  # -> Geometry, Transform

# ---- group: 竖向主T材
merge_9 = Merge(Data1=line_19, Data2=line_20, Data3=line_14)

# ---- group: 所有主要水平顶T材
merge_10 = Merge(Data1=mirror_3.Geometry, Data2=merge_8)  # -> flatten(Result)

# ----
entwine_2 = Entwine(Branch00=line_19, Branch01=line_20, Branch02=line_14, FlattenInputs=True)
curve_middle_9 = CurveMiddle(Curve=entwine_2)
line_21 = Line(flatten(entwine_2))
# COL4
polyline_5 = PolyLine(Vertices=curve_middle_9, Closed=True)

move_24 = Move(Geometry=move_18.Geometry, Motion=negative_12)  # -> Geometry, Transform
line_sdl_2 = LineSDL(Start=move_18.Geometry, Direction=negative_11, Length=tn_l1)
end_points_7 = EndPoints(Curve=line_sdl_2)  # -> Start, End
point_13 = Point(end_points_7.End)
line_sdl_3 = LineSDL(Start=move_24.Geometry, Direction=unit_z_32, Length=c4_h_u)
line_22 = Line(StartPoint=point_11, EndPoint=move_19.Geometry)
line_23 = Line(StartPoint=point_11, EndPoint=point_13)
end_points_8 = EndPoints(Curve=line_sdl_3)  # -> Start, End
line_24 = Line(StartPoint=move_19.Geometry, EndPoint=end_points_8.End)

multiplication_11 = Multiplication(A=vector_2pt_4.Vector, B=addition_10)
multiplication_12 = Multiplication(A=vector_2pt_4.Vector, B=p_l1)
multiplication_13 = Multiplication(A=vector_2pt_4.Vector, B=addition_12)
negative_18 = Negative(Value=multiplication_13)
move_25 = Move(Geometry=curve_middle_2, Motion=negative_18)  # -> Geometry, Transform
multiplication_14 = Multiplication(A=vector_2pt_4.Vector, B=addition_13)
multiplication_15 = Multiplication(A=vector_2pt_4.Vector, B=addition_14)
multiplication_16 = Multiplication(A=vector_2pt_4.Vector, B=p_l3)
multiplication_17 = Multiplication(A=vector_2pt_4.Vector, B=s_p_l1)
multiplication_18 = Multiplication(A=vector_2pt_4.Vector, B=s_p_l2)
negative_19 = Negative(Value=multiplication_17)
negative_20 = Negative(Value=multiplication_18)
multiplication_19 = Multiplication(A=vector_2pt_4.Vector, B=s_p_l1)
negative_21 = Negative(Value=multiplication_19)
multiplication_20 = Multiplication(A=vector_2pt_4.Vector, B=series_6)
negative_22 = Negative(Value=multiplication_20)
multiplication_21 = Multiplication(A=vector_2pt_4.Vector, B=mass_addition_4.PartialResults)
negative_23 = Negative(Value=multiplication_21)

explode_8 = Explode(Curve=rotate_3.Geometry, Recursive=True)  # -> Segments, Vertices
scale = Scale(Geometry=explode_3.Segments, Center=point_5, Factor="1/3")  # -> Geometry, Transform
scale_2 = Scale(Geometry=explode_3.Segments, Center=point_5, Factor="2/3")  # -> Geometry, Transform
end_points_9 = EndPoints(Curve=explode_8.Segments)  # -> Start, End
point_14 = Point(end_points_9.End)
vector_2pt_6 = Vector2Pt(PointA=point_5, PointB=point_14, Unitize=False)  # -> Vector, Length
line_25 = Line(scale.Geometry)
line_26 = Line(scale_2.Geometry)
vector = Vector(vector_2pt_6.Vector)
scale_3 = Scale(Geometry=rotate_3.Geometry, Center=point_5, Factor="1/3")  # -> Geometry, Transform
scale_4 = Scale(Geometry=rotate_3.Geometry, Center=point_5, Factor="2/3")  # -> Geometry, Transform
merge_11 = Merge(Data1=rotate_3.Geometry, Data2=scale_3.Geometry, Data3=scale_4.Geometry)
mirror_4 = Mirror(Geometry=merge_11, Plane=move_3.Geometry)  # -> Geometry, Transform
end_points_10 = EndPoints(Curve=explode_3.Segments)  # -> Start, End
point_15 = Point(end_points_10.End)

# ---- group: 顶部内圈多边形
mirror_5 = Mirror(Geometry=explode_8.Segments, Plane=move_3.Geometry)  # -> Geometry, Transform

# ---- group: 底部细分梁
merge_12 = Merge(Data1=line_25, Data2=line_26)

# ---- group: 顶部细分梁
mirror_6 = Mirror(Geometry=merge_12, Plane=move_3.Geometry)  # -> Geometry, Transform

# ----
move_26 = Move(Geometry=point_4, Motion=unit_x_3)  # -> Geometry, Transform
circle_4 = Circle(Plane=point_4, Radius=hea_r)
circle_5 = Circle(Plane=point_4, Radius=c1_r)
divide_curve_6 = DivideCurve(Curve=circle_4, Count=s_n1, Kinks=False)  # -> Points, Tangents, Parameters
move_27 = Move(Geometry=move_26.Geometry, Motion=unit_y_2)  # -> Geometry, Transform
move_28 = Move(Geometry=move_26.Geometry, Motion=negative_5)  # -> Geometry, Transform
line_27 = Line(StartPoint=point_4, EndPoint=move_26.Geometry)
rotate_8 = Rotate(Geometry=divide_curve_6.Points, Angle=division_5, Plane=point_4)  # -> Geometry, Transform
curve_curve = CurveCurve(CurveA=offset_curve_2, CurveB=circle_5)  # -> Points, ParamsA, ParamsB
curve_curve_2 = CurveCurve(CurveA=line_27, CurveB=circle_5)  # -> Points, ParamsA, ParamsB
surface_6 = Surface(circle_4)
line_28 = Line(StartPoint=curve_curve_2.Points, EndPoint=move_26.Geometry)
curve_curve_3 = CurveCurve(CurveA=circle_4, CurveB=offset_curve_2)  # -> Points, ParamsA, ParamsB
move_29 = Move(Geometry=point_4, Motion=unit_x_4)  # -> Geometry, Transform
line_29 = Line(StartPoint=point_4, EndPoint=move_29.Geometry)
point_16 = Point(curve_curve_3.Points)
line_30 = Line(StartPoint=curve_curve.Points, EndPoint=point_16)
curve_closest_point = CurveClosestPoint(Point=point_16, Curve=offset_curve)  # -> Point, Parameter, Distance
move_30 = Move(Geometry=move_29.Geometry, Motion=unit_y_3)  # -> Geometry, Transform
move_31 = Move(Geometry=move_29.Geometry, Motion=negative_6)  # -> Geometry, Transform
line_31 = Line(StartPoint=move_30.Geometry, EndPoint=move_31.Geometry)
curve_curve_4 = CurveCurve(CurveA=line_31, CurveB=offset_curve)  # -> Points, ParamsA, ParamsB
divide_curve_7 = DivideCurve(Curve=circle_5, Count=number_slider_14, Kinks=False)  # -> Points, Tangents, Parameters
divide_curve_8 = DivideCurve(Curve=circle_4, Count=number_slider_14, Kinks=False)  # -> Points, Tangents, Parameters
merge_13 = Merge(Data1=point_16, Data2=curve_curve_4.Points, Data3=curve_closest_point.Point)
mirror_7 = Mirror(Geometry=merge_13, Plane=xz_plane_3)  # -> Geometry, Transform
list_item_15 = ListItem(List=mirror_7.Geometry, Index=1, Wrap=True)
line_32 = Line(StartPoint=curve_curve_4.Points, EndPoint=list_item_15)
length_2 = Length(Curve=line_32)
division_19 = Division(A=length_2, B="2")
negative_24 = Negative(Value=division_19)
offset_curve_3 = OffsetCurve(Curve=line_29, Distance=division_19, Plane=PlaneXY(0, 0, 0), Corners=1)
offset_curve_4 = OffsetCurve(Curve=line_29, Distance=negative_24, Plane=PlaneXY(0, 0, 0), Corners=1)
merge_14 = Merge(Data1=offset_curve_3, Data2=offset_curve_4)
curve_curve_5 = CurveCurve(CurveA=merge_14, CurveB=circle_5)  # -> flatten(Points), ParamsA, ParamsB
list_item_16 = ListItem(List=curve_curve_5.Points, Index=0, Wrap=True)
line_33 = Line(StartPoint=list_item_16, EndPoint=curve_curve_4.Points)
merge_15 = Merge(Data1=line_30, Data2=line_33)
mirror_8 = Mirror(Geometry=merge_15, Plane=xz_plane_2)  # -> Geometry, Transform
list_item_17 = ListItem(List=mirror_7.Geometry, Index=0, Wrap=True)
list_item_18 = ListItem(List=mirror_7.Geometry, Index=2, Wrap=True)
line_34 = Line(StartPoint=point_16, EndPoint=curve_closest_point.Point)
merge_16 = Merge(
    Data1=point_16,
    Data2=curve_closest_point.Point,
    Data3=curve_curve_4.Points,
    Data4=list_item_15,
    Data5=list_item_18,
    Data6=list_item_17)
length_3 = Length(Curve=line_34)
polyline_6 = PolyLine(Vertices=merge_16, Closed=False)
division_20 = Division(A=length_3, B=Slider(4, range=0..10))
negative_25 = Negative(Value=division_20)
line_35 = Line(line_30)
line_36 = Line(line_33)
offset_curve_5 = OffsetCurve(Curve=line_2, Distance=division_20, Plane=PlaneXY(0, 0, 0), Corners=1)
offset_curve_6 = OffsetCurve(Curve=line_2, Distance=negative_25, Plane=PlaneXY(0, 0, 0), Corners=1)
merge_17 = Merge(Data1=circle_5, Data2=line_34)
curve_curve_6 = CurveCurve(CurveA=flatten(merge_17), CurveB=offset_curve_6)  # -> flatten(Points), ParamsA, ParamsB
shatter = Shatter(Curve=circle_5, Parameters=divide_curve_7.Parameters)
list_item_19 = ListItem(List=curve_curve_6.Points, Index=0, Wrap=True)
list_item_20 = ListItem(List=curve_curve_6.Points, Index=1, Wrap=True)
divide_curve_9 = DivideCurve(Curve=circle_4, Count=Slider(36, range=0..100), Kinks=False)  # -> Points, Tangents, Parameters
list_item_21 = ListItem(List=divide_curve_7.Points, Index=Slider(10, range=0..10), Wrap=True)
line_37 = Line(StartPoint=list_item_19, EndPoint=list_item_20)
list_item_22 = ListItem(List=divide_curve_9.Points, Index=panel_69, Wrap=True)
line_38 = Line(StartPoint=curve_curve_4.Points, EndPoint=list_item_15)
divide_curve_10 = DivideCurve(Curve=line_35, Count=Slider(4, range=0..10), Kinks=False)  # -> Points, Tangents, Parameters
curve_middle_10 = CurveMiddle(Curve=line_36)
curve_middle_11 = CurveMiddle(Curve=line_38)
mirror_9 = Mirror(Geometry=curve_middle_10, Plane=xz_plane_6)  # -> Geometry, Transform
line_39 = Line(StartPoint=point_4, EndPoint=curve_middle_11)
list_item_23 = ListItem(List=divide_curve_10.Points, Index=Slider(1, range=0..1), Wrap=True)
list_item_24 = ListItem(List=divide_curve_10.Points, Index=Slider(3, range=0..10), Wrap=True)
line_40 = Line(StartPoint=curve_middle_10, EndPoint=mirror_9.Geometry)
curve_curve_7 = CurveCurve(CurveA=line_39, CurveB=circle_5)  # -> Points, ParamsA, ParamsB

# ---- group: 左侧边界线
line_41 = Line(StartPoint=move_27.Geometry, EndPoint=move_28.Geometry)

# ---- group: 底部线条
line_42 = Line(StartPoint=curve_curve_4.Points, EndPoint=list_item_15)

# ---- group: 外圈等分点
point_17 = Point(rotate_8.Geometry)

rotate_9 = Rotate(Geometry=divide_curve_8.Points, Angle=division_3, Plane=point_4)  # -> Geometry, Transform

# ---- group: 内圈等分点
rotate_10 = Rotate(Geometry=divide_curve_7.Points, Angle=division_3, Plane=point_4)  # -> Geometry, Transform

# ---- group: 内圈等分段
rotate_11 = Rotate(Geometry=shatter, Angle=division_3, Plane=point_4)  # -> Geometry, Transform

# ---- group: 底撑中间
line_43 = Line(StartPoint=curve_curve_7.Points, EndPoint=curve_middle_11)

# ----
curve_5 = Curve(circle_5)
surface_7 = Surface(curve_5)
divide_curve_11 = DivideCurve(Curve=curve_5, Count=s_n1, Kinks=False)  # -> Points, Tangents, Parameters
divide_curve_12 = DivideCurve(Curve=curve_5, Count=multiplication, Kinks=False)  # -> Points, Tangents, Parameters
rotate_12 = Rotate(Geometry=divide_curve_11.Points, Angle=division_5, Plane=point_4)  # -> Geometry, Transform
rotate_13 = Rotate(Geometry=divide_curve_12.Points, Angle=division_6, Plane=point_4)  # -> Geometry, Transform
line_44 = Line(StartPoint=point_4, EndPoint=rotate_12.Geometry)  # -> flatten(Line)
cull_index = CullIndex(List=rotate_13.Geometry, Indices=series, Wrap=True)
line_45 = Line(StartPoint=point_5, EndPoint=cull_index)
curve_curve_8 = CurveCurve(CurveA=line_45, CurveB=rotate_3.Geometry)  # -> flatten(Points), flatten(ParamsA), ParamsB
end_points_11 = EndPoints(Curve=mirror_5.Geometry)  # -> Start, End
list_item_25 = ListItem(List=line_44, Index=panel_71, Wrap=True)
cull_index_2 = CullIndex(List=line_44, Indices=panel_71, Wrap=True)
move_32 = Move(Geometry=list_item_25, Motion=unit_z_7)  # -> flatten(Geometry), Transform
move_33 = Move(Geometry=curve_5, Motion=unit_z_7)  # -> flatten(Geometry), Transform
divide_curve_13 = DivideCurve(Curve=move_33.Geometry, Count=s_n, Kinks=False)  # -> Points, Tangents, Parameters
move_34 = Move(Geometry=move_32.Geometry, Motion=unit_z_11)  # -> Geometry, Transform
merge_18 = Merge(Data1=merge_12)

# ---- group: 内舱壁线条
merge_19 = Merge(Data2=line_44)  # -> flatten(Result)

# ---- group: 底部径向
line_46 = Line(StartPoint=curve_curve_8.Points, EndPoint=cull_index)

# ---- group: 内侧竖向
line_47 = Line(StartPoint=end_points_9.End, EndPoint=end_points_11.End)

# ---- group: 顶部径向
mirror_10 = Mirror(Geometry=line_46, Plane=move_3.Geometry)  # -> Geometry, Transform

# ---- group: 外舱壁
extrude_8 = Extrude(Base=surface_7, Direction=unit_z_7)

# ---- group: 分舱板
extrude_9 = Extrude(Base=merge_19, Direction=unit_z_7)

# ---- group: 内圈等分点
point_18 = Point(rotate_12.Geometry)

# ----
move_35 = Move(Geometry=graft(curve_5), Motion=unit_z_10)  # -> flatten(Geometry), Transform
move_36 = Move(Geometry=graft(list_item_25), Motion=unit_z_10)  # -> flatten(Geometry), Transform
move_37 = Move(Geometry=graft(cull_index_2), Motion=unit_z_10)  # -> flatten(Geometry), Transform

# ---- group: 主T型
move_38 = Move(Geometry=cull_index_2, Motion=unit_z_9)  # -> Geometry, Transform

# ---- group: 水平分舱版
move_39 = Move(Geometry=surface_7, Motion=unit_z_9)  # -> Geometry, Transform

# ---- group: 竖向分舱版
extrude_10 = Extrude(Base=move_32.Geometry, Direction=unit_z_11)

# ---- group: C1_out
extrude_11 = Extrude(Base=move_33.Geometry, Direction=unit_z_4)

# ----
move_40 = Move(Geometry=graft(list_item_25), Motion=unit_z_13)  # -> flatten(Geometry), Transform
move_41 = Move(Geometry=graft(cull_index_2), Motion=unit_z_13)  # -> flatten(Geometry), Transform
move_42 = Move(Geometry=curve_5, Motion=unit_z_13)  # -> Geometry, Transform

# ---- group: 外壁加强筋
line_sdl_4 = LineSDL(Start=divide_curve_13.Points, Direction=unit_z_4, Length=subtraction)

# ----
move_43 = Move(Geometry=graft(list_item_25), Motion=unit_z_15)  # -> flatten(Geometry), Transform
move_44 = Move(Geometry=graft(cull_index_2), Motion=unit_z_15)  # -> flatten(Geometry), Transform
move_45 = Move(Geometry=curve_5, Motion=unit_z_15)  # -> Geometry, Transform

move_46 = Move(Geometry=graft(list_item_25), Motion=unit_z_16)  # -> flatten(Geometry), Transform
move_47 = Move(Geometry=graft(cull_index_2), Motion=unit_z_16)  # -> flatten(Geometry), Transform
move_48 = Move(Geometry=curve_5, Motion=unit_z_16)  # -> Geometry, Transform

brep_2 = Brep(extrude_8)
deconstruct_brep_4 = DeconstructBrep(Brep=brep_2)  # -> Faces, Edges, Vertices
list_item_26 = ListItem(List=deconstruct_brep_4.Faces, Index=number_slider_2, Wrap=True)
brep_3 = Brep(extrude_11)
# COL1
cull_index_3 = CullIndex(List=deconstruct_brep_4.Faces, Indices=number_slider_2, Wrap=True)

# ----
# 顶部内横梁
curve_6 = Curve(merge_18)

# ----
# 外舱壁壁竖向加强筋
curve_7 = Curve(line_sdl_4)

end_points_12 = EndPoints(Curve=curve_7)  # -> Start, End
polyline_7 = PolyLine(Vertices=end_points_12.Start, Closed=True)

line_48 = Line(StartPoint=point_16, EndPoint=curve_closest_point.Point)
vector_2pt_7 = Vector2Pt(PointA=point_16, PointB=curve_closest_point.Point, Unitize=False)  # -> Vector, Length
extrude_12 = Extrude(Base=line_48, Direction=unit_z_37)
vector_2 = Vector(vector_2pt_7.Vector)

# ---- group: 中心点
area_6 = Area(Geometry=extrude_12)  # -> Area, Centroid

# ----
curve_curve_9 = CurveCurve(CurveA=line_7, CurveB=circle_5)  # -> Points, ParamsA, ParamsB
length_4 = Length(Curve=line_42)
unit_y_6 = UnitY(Factor=length_4)
unit_y_7 = UnitY(Factor=length_4)
division_21 = Division(A=length_4, B="2")
unit_y_8 = UnitY(Factor=division_21)
negative_26 = Negative(Value=unit_y_8)
surface_8 = Surface(circle_5)
unit_y_9 = UnitY(Factor=length_4)
extrude_13 = Extrude(Base=surface_8, Direction=unit_z_33)
negative_27 = Negative(Value=negative_26)

# ---- group: 底部中心点
move_49 = Move(Geometry=curve_curve_9.Points, Motion=unit_z_29)  # -> Geometry, Transform

# ----
move_50 = Move(Geometry=move_49.Geometry, Motion=unit_z_26)  # -> Geometry, Transform
move_51 = Move(Geometry=move_49.Geometry, Motion=unit_x_6)  # -> Geometry, Transform
move_52 = Move(Geometry=move_50.Geometry, Motion=unit_x_7)  # -> Geometry, Transform
line_sdl_5 = LineSDL(Start=move_51.Geometry, Direction=unit_z_27, Length=subtraction_12)
move_53 = Move(Geometry=move_49.Geometry, Motion=unit_x_10)  # -> Geometry, Transform
move_54 = Move(Geometry=line_sdl_5, Motion=negative_26)  # -> Geometry, Transform
line_sdl_6 = LineSDL(Start=move_49.Geometry, Direction=unit_z_29, Length=subtraction_12)
end_points_13 = EndPoints(Curve=line_sdl_6)  # -> Start, End
extrude_14 = Extrude(Base=move_54.Geometry, Direction=unit_y_6)
line_49 = Line(StartPoint=move_53.Geometry, EndPoint=move_49.Geometry)
deconstruct_brep_5 = DeconstructBrep(Brep=extrude_14)  # -> Faces, Edges, Vertices
scale_5 = Scale(Geometry=line_49, Center=move_53.Geometry, Factor="2")  # -> Geometry, Transform
end_points_14 = EndPoints(Curve=scale_5.Geometry)  # -> Start, End

move_55 = Move(Geometry=move_50.Geometry, Motion=negative)  # -> Geometry, Transform

# ---- group: 下端竖向线
line_sdl_7 = LineSDL(Start=move_53.Geometry, Direction=unit_z_31, Length=subtraction_13)

# ---- group: 下端上部线
line_sdl_8 = LineSDL(Start=end_points_13.End, Direction=unit_x_11, Length=bn_l2)

# ---- group: 垂直次梁
move_56 = Move(Geometry=deconstruct_brep_5.Edges, Motion=negative_13)  # -> Geometry, Transform

# ---- group: 中间层水平
merge_20 = Merge(Data1=line_sdl_8, Data2=line_49)

# ---- group: 垂直主T梁
curve_8 = Curve(deconstruct_brep_5.Edges)

# ---- group: 垂直次梁
curve_9 = Curve(move_56.Geometry)

# ----
end_points_15 = EndPoints(Curve=line_sdl_8)  # -> Start, End
end_points_16 = EndPoints(Curve=line_49)  # -> Start, End
point_19 = Point(end_points_15.Start)
point_20 = Point(end_points_16.End)
vector_2pt_8 = Vector2Pt(PointA=point_20, PointB=point_19, Unitize=False)  # -> Vector, Length
vector_2pt_9 = Vector2Pt(PointA=point_19, PointB=point_20, Unitize=False)  # -> Vector, Length
merge_21 = Merge(Data1=vector_2pt_8.Vector, Data2=vector_2pt_9.Vector)
join_curves_2 = JoinCurves(Curves=curve_9, Preserve=False)
join_curves_3 = JoinCurves(Curves=curve_8, Preserve=False)
area_7 = Area(Geometry=join_curves_2)  # -> Area, Centroid
area_8 = Area(Geometry=join_curves_3)  # -> Area, Centroid
curve_middle_12 = CurveMiddle(Curve=curve_9)
curve_middle_13 = CurveMiddle(Curve=curve_8)
vector_2pt_10 = Vector2Pt(PointA=area_7.Centroid, PointB=curve_middle_12, Unitize=False)  # -> Vector, Length
vector_2pt_11 = Vector2Pt(PointA=area_8.Centroid, PointB=curve_middle_13, Unitize=False)  # -> Vector, Length

plane_normal_2 = PlaneNormal(Origin=area_6.Centroid, ZAxis=vector_2pt_4.Vector)
rectangle_4 = Rectangle(Plane=plane_normal_2, XSize=p_w, YSize=p_h, Radius=0)  # -> Rectangle, Length
rectangle_5 = Rectangle(Plane=plane_normal_2, XSize=p_w, YSize=p_h, Radius=p_r)  # -> Rectangle, Length
area_9 = Area(Geometry=rectangle_4.Rectangle)  # -> Area, Centroid
line_50 = Line(StartPoint=area_9.Centroid, EndPoint=area_6.Centroid)
move_57 = Move(Geometry=rectangle_5.Rectangle, Motion=line_50)  # -> Geometry, Transform
plane_normal_3 = PlaneNormal(Origin=area_6.Centroid, ZAxis=vector_2)
xy_plane = XYPlane(Origin=area_6.Centroid)

# ---- group: 底浮箱边框
move_58 = Move(Geometry=rectangle_4.Rectangle, Motion=line_50)  # -> Geometry, Transform

# ---- group: 带倒角边框
move_59 = Move(Geometry=move_57.Geometry, Motion=multiplication_11)  # -> Geometry, Transform

# ---- group: 初始矩形段
extrude_15 = Extrude(Base=move_58.Geometry, Direction=multiplication_12)

# ---- group: 左侧端部简化曲梁
curve_10 = Curve(move_59.Geometry)

# ----
explode_9 = Explode(Curve=move_58.Geometry, Recursive=True)  # -> Segments, Vertices
explode_10 = Explode(Curve=move_59.Geometry, Recursive=True)  # -> Segments, Vertices
list_item_27 = ListItem(List=explode_9.Segments, Index=0, Wrap=True)
deconstruct_brep_6 = DeconstructBrep(Brep=extrude_15)  # -> Faces, Edges, Vertices
list_item_28 = ListItem(List=deconstruct_brep_6.Vertices, Index=Slider(2, range=0..10), Wrap=True)
list_item_29 = ListItem(List=explode_10.Segments, Index=Slider(5, range=0..10), Wrap=True)
list_item_30 = ListItem(List=deconstruct_brep_6.Edges, Index=Slider(3, range=0..10), Wrap=True)
list_item_31 = ListItem(List=explode_10.Segments, Index=Slider(6, range=0..10), Wrap=True)
list_item_32 = ListItem(List=deconstruct_brep_6.Edges, Index=Slider(4, range=0..10), Wrap=True)
list_item_33 = ListItem(List=explode_10.Segments, Index=Slider(4, range=0..10), Wrap=True)
list_item_34 = ListItem(List=explode_10.Segments, Index=Slider(0, range=0..10), Wrap=True)
merge_22 = Merge(Data1=list_item_30, Data2=list_item_31)
curve_middle_14 = CurveMiddle(Curve=list_item_34)
merge_23 = Merge(Data1=list_item_32, Data2=list_item_33)
extrude_point = ExtrudePoint(Base=list_item_29, Point=list_item_28)
loft_3 = Loft(Curves=merge_22, Options={Adjust=False, Closed=False, LoftEnds=0, LoftSimp=0, LoftType=0, Rebuild=10, Refit=0.01})
loft_4 = Loft(Curves=merge_23, Options={Adjust=False, Closed=False, LoftEnds=0, LoftSimp=0, LoftType=0, Rebuild=10, Refit=0.01})
line_51 = Line(StartPoint=curve_middle_14, EndPoint=move_25.Geometry)
curve_middle_15 = CurveMiddle(Curve=line_51)
mirror_11 = Mirror(Geometry=loft_3, Plane=plane_normal_3)  # -> Geometry, Transform
move_60 = Move(Geometry=move_58.Geometry, Motion=multiplication_12)  # -> Geometry, Transform
list_item_35 = ListItem(List=explode_9.Segments, Index=Slider(3, range=0..10), Wrap=True)
list_item_36 = ListItem(List=explode_9.Segments, Index=Slider(1, range=0..10), Wrap=True)
merge_24 = Merge(Data1=list_item_36, Data2=list_item_35)
curve_middle_16 = CurveMiddle(Curve=merge_24)

# ---- group: 左右镜像
mirror_12 = Mirror(Geometry=extrude_point, Plane=plane_normal_3)  # -> Geometry, Transform

# ---- group: 倒角段径向平面
plane_normal_4 = PlaneNormal(Origin=curve_middle_15, ZAxis=vector_2pt_4.Vector)

# ---- group: 倒角段
extrude_16 = Extrude(Base=move_59.Geometry, Direction=line_51)

# ---- group: 底部中点
curve_middle_17 = CurveMiddle(Curve=list_item_27)

# ----
end_points_17 = EndPoints(Curve=line_sdl_7)  # -> Start, End
end_points_18 = EndPoints(Curve=line_sdl_8)  # -> Start, End
point_21 = Point(end_points_18.End)
scale_6 = Scale(Geometry=line_sdl_8, Center=point_21, Factor="2")  # -> Geometry, Transform
point_22 = Point(end_points_17.End)
curve_closest_point_2 = CurveClosestPoint(Point=point_22, Curve=line_sdl_8)  # -> Point, Parameter, Distance
merge_25 = Merge(Data1=move_55.Geometry, Data2=move_52.Geometry, Data3=point_22, Data4=curve_closest_point_2.Point)
line_52 = Line(StartPoint=point_22, EndPoint=curve_closest_point_2.Point)
polyline_8 = PolyLine(Vertices=merge_25, Closed=False)
move_61 = Move(Geometry=polyline_8, Motion=negative_26)  # -> Geometry, Transform
end_points_19 = EndPoints(Curve=scale_6.Geometry)  # -> Start, End
line_53 = Line(StartPoint=point_22, EndPoint=point_13)
line_54 = Line(StartPoint=end_points_19.Start, EndPoint=end_points_14.End)
curve_closest_point_3 = CurveClosestPoint(Point=point_21, Curve=line_53)  # -> Point, Parameter, Distance
curve_closest_point_4 = CurveClosestPoint(Point=curve_closest_point_3.Point, Curve=line_53)  # -> Point, Parameter, Distance
shatter_2 = Shatter(Curve=line_53, Parameters=curve_closest_point_4.Parameter)
vector_2pt_12 = Vector2Pt(PointA=point_22, PointB=point_13, Unitize=True)  # -> Vector, Length
multiplication_22 = Multiplication(A=vector_2pt_12.Vector, B=bn_l3)
negative_28 = Negative(Value=multiplication_22)
vector_2pt_13 = Vector2Pt(PointA=point_22, PointB=point_13, Unitize=True)  # -> Vector, Length
multiplication_23 = Multiplication(A=vector_2pt_13.Vector, B=bn_l3)

# ---- group: 内部隔板
extrude_17 = Extrude(Base=move_61.Geometry, Direction=unit_y_7)

# ---- group: 下端封口线
line_55 = Line(StartPoint=curve_closest_point_3.Point, EndPoint=point_21)

# ---- group: 下端斜线
list_item_37 = ListItem(List=shatter_2, Index=0, Wrap=True)

# ---- group: 中间层垂直
merge_26 = Merge(Data1=line_55, Data2=list_item_37, Data3=line_sdl_7, Data4=line_52)  # -> flatten(Result)

# ----
surface_9 = Surface(move_33.Geometry)
extrude_18 = Extrude(Base=surface_9, Direction=unit_z_4)
trim_solid_2 = TrimSolid(Shape=extrude_2, Cutters=extrude_18)
deconstruct_brep_7 = DeconstructBrep(Brep=trim_solid_2)  # -> Faces, Edges, Vertices
list_item_38 = ListItem(List=deconstruct_brep_7.Faces, Index=Slider(1, range=0..10), Wrap=True)
area_10 = Area(Geometry=list_item_38)  # -> Area, Centroid

list_item_39 = ListItem(List=line_46, Index=Slider(0, range=0..10), Wrap=True)
curve_middle_18 = CurveMiddle(Curve=list_item_39)
line_56 = Line(StartPoint=curve_middle_18, EndPoint=point_5)
polygon_4 = Polygon(Plane=point_5, Radius=line_56, Segments=multiplication_2, FilletRadius=0)  # -> Polygon, Length
explode_11 = Explode(Curve=polygon_4.Polygon, Recursive=True)  # -> Segments, Vertices
end_points_20 = EndPoints(Curve=line_46)  # -> Start, End
point_23 = Point(end_points_20.End)
vector_2pt_14 = Vector2Pt(PointA=point_5, PointB=point_23, Unitize=False)  # -> Vector, Length
end_points_21 = EndPoints(Curve=mirror_10.Geometry)  # -> Start, End
vector_3 = Vector(vector_2pt_14.Vector)
merge_27 = Merge(Data1=mirror_5.Geometry, Data2=mirror_10.Geometry)  # -> flatten(Result)
merge_28 = Merge(Data1=explode_3.Segments, Data2=line_46)  # -> flatten(Result)
entwine_3 = Entwine(Branch00=mirror_6.Geometry, Branch01=mirror_10.Geometry, Branch02=mirror_5.Geometry, FlattenInputs=True)
move_62 = Move(Geometry=entwine_3, Motion=unit_z_8)  # -> Geometry, Transform
explode_tree = ExplodeTree(Data=move_62.Geometry)  # -> Branch0, Branch1, Branch2
curve_plane = CurvePlane(Curve=mirror_4.Geometry, Plane=extrude_10)  # -> flatten(Points), ParamsC, ParamsP
end_points_22 = EndPoints(Curve=line_46)  # -> Start, End
point_24 = Point(end_points_22.End)
merge_29 = Merge(Data1=point_24, Data2=point_15)  # -> flatten(Result)
merge_30 = Merge(Data1=move_35.Geometry, Data2=move_42.Geometry, Data3=move_45.Geometry, Data4=move_48.Geometry)  # -> flatten(Result)
merge_31 = Merge(Data1=move_36.Geometry, Data2=move_40.Geometry, Data3=move_43.Geometry, Data4=move_46.Geometry)
merge_32 = Merge(Data1=move_37.Geometry, Data2=move_41.Geometry, Data3=move_44.Geometry, Data4=move_47.Geometry)
line_sdl_9 = LineSDL(Start=merge_29, Direction=unit_z_19, Length=hea_h)

# ---- group: 底部环向
rotate_14 = Rotate(Geometry=explode_11.Segments, Angle=division_8, Plane=point_5)  # -> Geometry, Transform

# ---- group: 顶部环向
mirror_13 = Mirror(Geometry=rotate_14.Geometry, Plane=move_3.Geometry)  # -> Geometry, Transform

# ---- group: 外测竖向
line_57 = Line(StartPoint=end_points_20.End, EndPoint=end_points_21.End)

# ---- group: 外圈多边形
curve_11 = Curve(explode_tree.Branch2)

# ---- group: 径向
curve_12 = Curve(explode_tree.Branch1)

# ---- group: 内圈多边形
curve_13 = Curve(explode_tree.Branch0)

# ----
entwine_4 = Entwine(
    Branch00=curve_13,
    Branch01=curve_11,
    Branch02=curve_12,
    Branch03=move_38.Geometry,
    Branch04=move_39.Geometry,
    FlattenInputs=True)
move_63 = Move(Geometry=entwine_4, Motion=unit_z_12)  # -> Geometry, Transform
explode_tree_2 = ExplodeTree(Data=move_63.Geometry)  # -> Branch0, Branch1, Branch2, Branch3, Branch4
move_64 = Move(Geometry=move_63.Geometry, Motion=unit_z_14)  # -> Geometry, Transform
curve_14 = Curve(explode_tree_2.Branch0)
curve_15 = Curve(explode_tree_2.Branch1)
curve_16 = Curve(explode_tree_2.Branch2)
curve_17 = Curve(explode_tree_2.Branch3)
surface_10 = Surface(explode_tree_2.Branch4)
explode_tree_3 = ExplodeTree(Data=move_64.Geometry)  # -> Branch0, Branch1, Branch2, Branch3, Branch4
entwine_5 = Entwine(
    Branch00=explode_tree_3.Branch1,
    Branch01=explode_tree_3.Branch2,
    Branch02=explode_tree_3.Branch3,
    Branch03=explode_tree_3.Branch4,
    Branch04=move_34.Geometry,
    FlattenInputs=True)
move_65 = Move(Geometry=entwine_5, Motion=unit_z_17)  # -> Geometry, Transform
explode_tree_4 = ExplodeTree(Data=move_65.Geometry)  # -> Branch0, Branch1, Branch2, Branch3, Branch4
surface_11 = Surface(explode_tree_4.Branch3)
curve_18 = Curve(explode_tree_4.Branch4)
curve_19 = Curve(explode_tree_4.Branch1)
curve_20 = Curve(explode_tree_4.Branch0)
curve_21 = Curve(explode_tree_4.Branch2)
entwine_6 = Entwine(Branch00=curve_20, Branch01=curve_21, Branch02=surface_11, Branch03=curve_18, FlattenInputs=True)
move_66 = Move(Geometry=entwine_6, Motion=unit_z_18)  # -> Geometry, Transform
explode_tree_5 = ExplodeTree(Data=move_66.Geometry)  # -> Branch0, Branch1, Branch2, Branch3
merge_33 = Merge(Data1=mirror_5.Geometry, Data2=mirror_10.Geometry, Data3=mirror_13.Geometry)  # -> flatten(Result)
surface_12 = Surface(explode_tree_5.Branch2)
merge_34 = Merge(Data1=mirror_6.Geometry, Data2=curve_13, Data3=curve_14, Data4=explode_tree_3.Branch0)  # -> flatten(Result)
merge_35 = Merge(
    Data1=list_item_26,
    Data2=extrude_9,
    Data3=move_39.Geometry,
    Data4=extrude_10,
    Data5=surface_10,
    Data6=explode_tree_3.Branch4,
    Data7=surface_11)  # -> flatten(Result)
merge_36 = Merge(
    Data1=merge_33,
    Data2=curve_11,
    Data3=curve_12,
    Data4=move_38.Geometry,
    Data5=curve_15,
    Data6=curve_16,
    Data7=curve_17,
    Data8=explode_tree_3.Branch1,
    Data9=explode_tree_3.Branch2,
    Data10=explode_tree_3.Branch3,
    Data11=curve_19,
    Data12=curve_20,
    Data13=curve_21,
    Data14=curve_18,
    Data15=explode_tree_5.Branch0,
    Data16=explode_tree_5.Branch1,
    Data17=explode_tree_5.Branch3)  # -> flatten(Result)

# ---- group: 分割板加强筋
line_sdl_10 = LineSDL(Start=curve_plane.Points, Direction=unit_z_11, Length=subtraction_6)

# ----
brep_4 = Brep(surface_12)
merge_37 = Merge(Data1=cull_index_3, Data2=brep_4, Data3=brep_3)  # -> flatten(Result)
merge_38 = Merge(Data1=explode_3.Segments, Data2=line_46, Data3=rotate_14.Geometry)  # -> flatten(Result)
brep_join = BrepJoin(Breps=merge_37)  # -> Breps, Closed

# ----
# 底部竖向钢筋
line_58 = Line(line_sdl_9)

# ----
# 底部内横梁
curve_22 = Curve(merge_34)

# ----
# 顶部外横梁
curve_23 = Curve(merge_38)

# ----
# 环向筋
curve_24 = Curve(merge_30)

# ----
# 分舱壁竖向加强筋
curve_25 = Curve(line_sdl_10)

# ----
# 分舱壁水平加强筋
curve_26 = Curve(merge_31)

# ----
# 环向水平筋
curve_27 = Curve(merge_32)

# ----
# 底部外横梁
curve_28 = Curve(merge_36)

# ---- group: C1_OUT
brep_5 = Brep(brep_join.Breps)

# ----
trim_solid_3 = TrimSolid(Shape=extrude_5, Cutters=brep_5)
trim_solid_4 = TrimSolid(Shape=extrude_17, Cutters=brep_5)

# ----
# 壳模型
brep_6 = Brep(merge_35)

# ---- group: BN内部隔板
brep_7 = Brep(trim_solid_4)

# ----
to_abaqus_2 = To_Abaqus(Geometry=brep_5, Filenames="C1_out", Path="D:\Study\SEASAM\sjy_struct\Ideal_Model", Bool=Toggle(False))
to_abaqus_3 = To_Abaqus(Geometry=brep_6, Filenames="C1_in", Path="D:\Study\SEASAM\sjy_struct\Ideal_Model", Bool=Toggle(False))
to_abaqus_4 = To_Abaqus(Geometry=brep_7, Filenames="BN_in", Path="D:\Study\SEASAM\sjy_struct\Ideal_Model", Bool=Toggle(False))
end_points_23 = EndPoints(Curve=line_58)  # -> Start, End

# ---- group: 分舱壁竖向加强筋
unit_x_13 = UnitX(Factor=1)
negative_29 = Negative(Value=unit_x_13)
panel_75 = Panel("D:\Study\SEASAM\sjy_struct\Ideal_Model\C1_fcsx.xlsx")
截面名称_16 = ValueList({"B3000_3200", "BSRAbulb200x10x28x8x8x3", "BSRAbulb200x12x28x8x8x3", "BSRAbulb320x13x46x14x14x4", "BSRAbulb340x14x49x15x15x4", "BSRAbulb370x14x54x16x16x4", "BSRAbulb400x14x58x18x18x4", "BSRAbulb400x16x58x18x18x4", "BSRAbulb430x15x62x20x20x4", "BSRAbulb430x17x62x20x20x4"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}, selected="BSRAbulb370x14x54x16x16x4")
longest_list = LongestList(ListListA=negative_29, ListListB=curve_25, PaddingMode=2)  # -> ListListA, ListListB
截面是否偏移_18 = ValueList({"yes", "no"}, selected="yes")
梁类型_18 = ValueList({"straight", "curve"}, selected="straight")

# ---- group: 分舱壁水平加强筋
unit_x_14 = UnitX(Factor=1)
negative_30 = Negative(Value=unit_x_14)
panel_76 = Panel("D:\Study\SEASAM\sjy_struct\Ideal_Model\C1_fcsp.xlsx")
截面名称_17 = ValueList({"B3000_3200", "BSRAbulb200x10x28x8x8x3", "BSRAbulb200x12x28x8x8x3", "BSRAbulb320x13x46x14x14x4", "BSRAbulb340x14x49x15x15x4", "BSRAbulb370x14x54x16x16x4", "BSRAbulb400x14x58x18x18x4", "BSRAbulb400x16x58x18x18x4", "BSRAbulb430x15x62x20x20x4", "BSRAbulb430x17x62x20x20x4"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}, selected="T15_800_20_300")
longest_list_2 = LongestList(ListListA=negative_30, ListListB=curve_26, PaddingMode=2)  # -> ListListA, ListListB
截面是否偏移_19 = ValueList({"yes", "no"}, selected="yes")
梁类型_19 = ValueList({"straight", "curve"}, selected="straight")

# ---- group: 环向水平加强筋
unit_x_15 = UnitX(Factor=1)
negative_31 = Negative(Value=unit_x_15)
panel_77 = Panel("D:\Study\SEASAM\sjy_struct\Ideal_Model\C1_hxsp.xlsx")
截面名称_18 = ValueList({"B3000_3200", "BSRAbulb200x10x28x8x8x3", "BSRAbulb200x12x28x8x8x3", "BSRAbulb320x13x46x14x14x4", "BSRAbulb340x14x49x15x15x4", "BSRAbulb370x14x54x16x16x4", "BSRAbulb400x14x58x18x18x4", "BSRAbulb400x16x58x18x18x4", "BSRAbulb430x15x62x20x20x4", "BSRAbulb430x17x62x20x20x4"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}, selected="H600_15_300_20")
longest_list_3 = LongestList(ListListA=negative_31, ListListB=curve_27, PaddingMode=2)  # -> ListListA, ListListB
截面是否偏移_20 = ValueList({"yes", "no"}, selected="no")
梁类型_20 = ValueList({"straight", "curve"}, selected="straight")

# ----
move_67 = Move(Geometry=line_53, Motion=line_55)  # -> Geometry, Transform
curve_curve_10 = CurveCurve(CurveA=line_sdl_3, CurveB=move_67.Geometry)  # -> Points, ParamsA, ParamsB
curve_closest_point_5 = CurveClosestPoint(Point=curve_curve_10.Points, Curve=line_sdl_3)  # -> Point, Parameter, Distance
shatter_3 = Shatter(Curve=line_sdl_3, Parameters=curve_closest_point_5.Parameter)
line_59 = Line(StartPoint=curve_curve_10.Points, EndPoint=point_13)
merge_39 = Merge(Data1=line_55, Data2=scale_6.Geometry, Data3=list_item_37, Data4=scale_5.Geometry, Data5=line_54, Data6=line_sdl_7)  # -> flatten(Result)
list_item_40 = ListItem(List=shatter_3, Index=1, Wrap=True)
join_curves_4 = JoinCurves(Curves=merge_39, Preserve=False)
end_points_24 = EndPoints(Curve=list_item_40)  # -> Start, End
merge_40 = Merge(Data1=list_item_40, Data2=line_59, Data3=line_24, Data4=line_23, Data5=line_22)  # -> flatten(Result)
surface_13 = Surface(join_curves_4)
join_curves_5 = JoinCurves(Curves=merge_40, Preserve=False)
move_68 = Move(Geometry=surface_13, Motion=negative_26)  # -> Geometry, Transform
surface_14 = Surface(join_curves_5)
move_69 = Move(Geometry=surface_14, Motion=negative_2)  # -> Geometry, Transform
extrude_19 = Extrude(Base=move_68.Geometry, Direction=unit_y_9)
trim_solid_5 = TrimSolid(Shape=extrude_19, Cutters=extrude_13)
deconstruct_brep_8 = DeconstructBrep(Brep=trim_solid_5)  # -> Faces, Edges, Vertices
list_item_41 = ListItem(List=deconstruct_brep_8.Faces, Index=number_slider_22, Wrap=True)
deconstruct_brep_9 = DeconstructBrep(Brep=list_item_41)  # -> Faces, Edges, Vertices
cull_index_4 = CullIndex(List=deconstruct_brep_8.Faces, Indices=number_slider_22, Wrap=True)
list_item_42 = ListItem(List=deconstruct_brep_9.Edges, Index=panel_73, Wrap=True)
cull_index_5 = CullIndex(List=deconstruct_brep_9.Edges, Indices=panel_73, Wrap=True)
move_70 = Move(Geometry=cull_index_5, Motion=unit_z_34)  # -> Geometry, Transform
list_item_43 = ListItem(List=move_70.Geometry, Index=0, Wrap=True)
curve_middle_19 = CurveMiddle(Curve=list_item_43)
line_60 = Line(StartPoint=point_22, EndPoint=curve_middle_19)
move_71 = Move(Geometry=list_item_37, Motion=line_60)  # -> Geometry, Transform
curve_curve_11 = CurveCurve(CurveA=move_71.Geometry, CurveB=line_55)  # -> Points, ParamsA, ParamsB
curve_closest_point_6 = CurveClosestPoint(Point=curve_curve_11.Points, Curve=move_71.Geometry)  # -> Point, Parameter, Distance
shatter_4 = Shatter(Curve=move_71.Geometry, Parameters=curve_closest_point_6.Parameter)
list_item_44 = ListItem(List=shatter_4, Index=0, Wrap=True)
curve_middle_20 = CurveMiddle(Curve=list_item_44)
curve_closest_point_7 = CurveClosestPoint(Point=curve_middle_20, Curve=list_item_37)  # -> Point, Parameter, Distance
line_61 = Line(StartPoint=curve_middle_20, EndPoint=curve_closest_point_7.Point)
merge_41 = Merge(Data1=list_item_44, Data2=line_61)
move_72 = Move(Geometry=cull_index_5, Motion=unit_z_35)  # -> Geometry, Transform
line_62 = Line(StartPoint=end_points_24.End, EndPoint=end_points_24.Start)
list_item_45 = ListItem(List=deconstruct_brep_8.Faces, Index=0, Wrap=True)
move_73 = Move(Geometry=list_item_45, Motion=multiplication_23)  # -> Geometry, Transform
area_11 = Area(Geometry=move_73.Geometry)  # -> Area, Centroid
plane_normal_5 = PlaneNormal(Origin=area_11.Centroid, ZAxis=vector_2pt_13.Vector)
circle_6 = Circle(Plane=plane_normal_5, Radius=n_r)

yz_plane_3 = YZPlane(Origin=curve_curve_10.Points)
brep_trim_by_plane = BrepTrimByPlane(Brep=mirror_2.Geometry, Plane=yz_plane_3)
deconstruct_brep_10 = DeconstructBrep(Brep=brep_trim_by_plane)  # -> Faces, Edges, Vertices
list_item_46 = ListItem(List=deconstruct_brep_10.Faces, Index=0, Wrap=True)
area_12 = Area(Geometry=list_item_46)  # -> Area, Centroid

# ---- group: 上层中间分舱板
move_74 = Move(Geometry=list_item_14, Motion=line_62)  # -> Geometry, Transform

# ----
merge_42 = Merge(
    Data1=extrude_4,
    Data2=move_15.Geometry,
    Data3=loft_2,
    Data4=extrude_7,
    Data5=extrude_3,
    Data6=extrude_6,
    Data7=loft,
    Data8=move_20.Geometry,
    Data9=move_74.Geometry)  # -> flatten(Result)

# ----
# 壳模型
brep_8 = Brep(merge_42)

# ---- group: TR_壳模型
# TR1
merge_43 = Merge(Data1=brep_trim_by_plane, Data2=trim_solid_2)  # -> flatten(Result)

# ---- group: 上撑杆
line_63 = Line(StartPoint=area_12.Centroid, EndPoint=area_10.Centroid)

# ----
to_abaqus_5 = To_Abaqus(Geometry=brep_8, Filenames="C4", Path="D:\Study\SEASAM\sjy_struct\Ideal_Model", Bool=Toggle(False))
to_abaqus_6 = To_Abaqus(Geometry=merge_43, Filenames="TR1", Path="D:\Study\SEASAM\sjy_struct\Ideal_Model", Bool=Toggle(False))

# ---- group: 内部隔板
extrude_20 = Extrude(Base=move_69.Geometry, Direction=unit_y_5)

# ----
deconstruct_brep_11 = DeconstructBrep(Brep=list_item_45)  # -> Faces, Edges, Vertices
surface_15 = Surface(circle_6)
divide_curve_14 = DivideCurve(Curve=circle_6, Count="4", Kinks=False)  # -> Points, Tangents, Parameters
area_13 = Area(Geometry=surface_15)  # -> Area, Centroid
evaluate_surface = EvaluateSurface(Surface=surface_15, Point=area_13.Centroid)  # -> Point, Normal, UDirection, VDirection, Frame
rotate_15 = Rotate(Geometry=divide_curve_14.Points, Angle=0.7853981634, Plane=surface_15)  # -> Geometry, Transform
line_64 = Line(StartPoint=area_13.Centroid, EndPoint=rotate_15.Geometry)  # -> flatten(Line)
list_item_47 = ListItem(List=deconstruct_brep_11.Edges, Index=Slider(2, range=0..10), Wrap=True)
list_item_48 = ListItem(List=deconstruct_brep_11.Edges, Index=Slider(3, range=0..10), Wrap=True)
list_item_49 = ListItem(List=deconstruct_brep_11.Edges, Index=Slider(4, range=0..10), Wrap=True)
list_item_50 = ListItem(List=deconstruct_brep_11.Edges, Index=Slider(1, range=0..10), Wrap=True)
multiplication_24 = Multiplication(A=evaluate_surface.Normal, B="500")
extrude_21 = Extrude(Base=line_64, Direction=multiplication_24)
split_with_breps = SplitWithBreps(Curve=circle_6, Brep=extrude_21)  # -> Curve, Points
list_item_51 = ListItem(List=split_with_breps.Curve, Index=Slider(3, range=0..10), Wrap=True)
list_item_52 = ListItem(List=split_with_breps.Curve, Index=Slider(0, range=0..10), Wrap=True)
list_item_53 = ListItem(List=split_with_breps.Curve, Index=Slider(1, range=0..10), Wrap=True)
list_item_54 = ListItem(List=split_with_breps.Curve, Index=Slider(2, range=0..10), Wrap=True)
merge_44 = Merge(Data1=list_item_51, Data2=list_item_47)  # -> flatten(Result)
merge_45 = Merge(Data1=list_item_52, Data2=list_item_48)  # -> flatten(Result)
merge_46 = Merge(Data1=list_item_53, Data2=list_item_49)  # -> flatten(Result)
merge_47 = Merge(Data1=list_item_54, Data2=list_item_50)  # -> flatten(Result)
loft_5 = Loft(Curves=merge_44, Options={Adjust=False, Closed=False, LoftEnds=0, LoftSimp=0, LoftType=0, Rebuild=10, Refit=0.01})
loft_6 = Loft(Curves=merge_45, Options={Adjust=False, Closed=False, LoftEnds=0, LoftSimp=0, LoftType=0, Rebuild=10, Refit=0.01})
loft_7 = Loft(Curves=merge_46, Options={Adjust=False, Closed=False, LoftEnds=0, LoftSimp=0, LoftType=0, Rebuild=10, Refit=0.01})
loft_8 = Loft(Curves=merge_47, Options={Adjust=False, Closed=False, LoftEnds=0, LoftSimp=0, LoftType=0, Rebuild=10, Refit=0.01})
merge_48 = Merge(Data1=loft_5, Data2=loft_6, Data3=loft_7, Data4=loft_8, Data5=surface_15)  # -> flatten(Result)

# ---- group: 端部主梁
move_75 = Move(Geometry=merge_41, Motion=negative_26)  # -> Geometry, Transform
move_76 = Move(Geometry=merge_41, Motion=negative_27)  # -> Geometry, Transform

# ---- group: 下部倒角段
brep_9 = Brep(merge_48)

# ---- group: BN_壳模型
surface_16 = Surface(cull_index_4)

# ---- group: 环形T梁
# BN/TN
merge_49 = Merge(Data1=move_70.Geometry, Data2=move_72.Geometry)

# ----
brep_join_2 = BrepJoin(Breps=surface_16)  # -> Breps, Closed
list_item_55 = ListItem(List=move_70.Geometry, Index=Slider(2, range=0..10), Wrap=True)
to_abaqus_7 = To_Abaqus(Geometry=brep_join_2.Breps, Filenames="BN_out", Path="D:\Study\SEASAM\sjy_struct\Ideal_Model", Bool=Toggle(False))
list_item_56 = ListItem(List=move_70.Geometry, Index=Slider(1, range=0..10), Wrap=True)
to_abaqus_8 = To_Abaqus(Geometry=brep_9, Filenames="BN_F", Path="D:\Study\SEASAM\sjy_struct\Ideal_Model", Bool=Toggle(False))
list_item_57 = ListItem(List=move_72.Geometry, Index=Slider(2, range=0..10), Wrap=True)
list_item_58 = ListItem(List=move_72.Geometry, Index=Slider(1, range=0..10), Wrap=True)
curve_middle_21 = CurveMiddle(Curve=list_item_55)
curve_middle_22 = CurveMiddle(Curve=list_item_56)
curve_middle_23 = CurveMiddle(Curve=move_70.Geometry)
curve_middle_24 = CurveMiddle(Curve=list_item_57)
curve_middle_25 = CurveMiddle(Curve=list_item_58)
curve_middle_26 = CurveMiddle(Curve=move_72.Geometry)
line_65 = Line(StartPoint=curve_middle_21, EndPoint=curve_middle_22)
line_66 = Line(StartPoint=curve_middle_24, EndPoint=curve_middle_25)
curve_middle_27 = CurveMiddle(Curve=line_65)
curve_middle_28 = CurveMiddle(Curve=line_66)
vector_2pt_15 = Vector2Pt(PointA=curve_middle_27, PointB=curve_middle_23, Unitize=False)  # -> Vector, Length
vector_2pt_16 = Vector2Pt(PointA=curve_middle_28, PointB=curve_middle_26, Unitize=False)  # -> Vector, Length
merge_50 = Merge(Data1=vector_2pt_15.Vector, Data2=vector_2pt_16.Vector)

merge_51 = Merge(Data1=circle_5, Data2=line_41)
line_67 = Line(StartPoint=rotate_8.Geometry, EndPoint=rotate_12.Geometry)
surface_split = SurfaceSplit(Surface=surface_6, Curves=merge_51)
list_item_59 = ListItem(List=line_67, Index=panel_71, Wrap=True)
area_14 = Area(Geometry=surface_split)  # -> Area, Centroid
sort_list = SortList(Keys=area_14.Area, ValuesValuesA=surface_split)  # -> Keys, ValuesValuesA
list_length = ListLength(List=point_18)
list_item_60 = ListItem(List=sort_list.ValuesValuesA, Index="2", Wrap=True)
division_22 = Division(A=list_length, B="3")
deconstruct_brep_12 = DeconstructBrep(Brep=list_item_60)  # -> Faces, Edges, Vertices
round_2 = Round(Number=division_22)  # -> Nearest, Floor, Ceiling
list_item_61 = ListItem(List=deconstruct_brep_12.Edges, Index=Slider(2, range=0..10), Wrap=True)
list_item_62 = ListItem(List=point_18, Index=round_2.Nearest, Wrap=True)
list_item_63 = ListItem(List=rotate_9.Geometry, Index=number_slider_19, Wrap=True)
list_item_64 = ListItem(List=rotate_10.Geometry, Index=number_slider_19, Wrap=True)
list_item_65 = ListItem(List=rotate_9.Geometry, Index=number_slider_20, Wrap=True)
list_item_66 = ListItem(List=rotate_10.Geometry, Index=number_slider_20, Wrap=True)
list_item_67 = ListItem(List=rotate_9.Geometry, Index=number_slider_16, Wrap=True)
list_item_68 = ListItem(List=rotate_10.Geometry, Index=number_slider_16, Wrap=True)
list_item_69 = ListItem(List=rotate_9.Geometry, Index=number_slider_17, Wrap=True)
list_item_70 = ListItem(List=rotate_10.Geometry, Index=number_slider_17, Wrap=True)
list_item_71 = ListItem(List=rotate_9.Geometry, Index=number_slider_18, Wrap=True)
list_item_72 = ListItem(List=rotate_10.Geometry, Index=number_slider_18, Wrap=True)
line_68 = Line(StartPoint=list_item_63, EndPoint=list_item_64)
line_69 = Line(StartPoint=list_item_71, EndPoint=list_item_72)
curve_curve_12 = CurveCurve(CurveA=line_69, CurveB=line_34)  # -> flatten(Points), ParamsA, ParamsB
curve_curve_13 = CurveCurve(CurveA=line_68, CurveB=line_41)  # -> flatten(Points), ParamsA, ParamsB
surface_split_2 = SurfaceSplit(Surface=list_item_60, Curves=polyline_6)
area_15 = Area(Geometry=surface_split_2)  # -> Area, Centroid
line_70 = Line(StartPoint=list_item_65, EndPoint=list_item_66)
line_71 = Line(StartPoint=list_item_67, EndPoint=list_item_68)
line_72 = Line(StartPoint=list_item_64, EndPoint=curve_curve_13.Points)
sort_list_2 = SortList(Keys=area_15.Area, ValuesValuesA=surface_split_2)  # -> Keys, ValuesValuesA
line_73 = Line(StartPoint=list_item_69, EndPoint=list_item_70)
divide_curve_15 = DivideCurve(Curve=line_72, Count=Slider(4, range=0..10), Kinks=False)  # -> Points, Tangents, Parameters
list_item_73 = ListItem(List=sort_list_2.ValuesValuesA, Index="3", Wrap=True)
merge_52 = Merge(
    Data1=flatten(line_72),
    Data2=flatten(line_70),
    Data3=flatten(line_71),
    Data4=flatten(line_73),
    Data5=flatten(line_35),
    Data7=flatten(line_36))  # -> flatten(Result)
extrude_22 = Extrude(Base=list_item_73, Direction=unit_z_5)
list_item_74 = ListItem(List=divide_curve_15.Points, Index=Slider(1, range=0..10), Wrap=True)
list_item_75 = ListItem(List=divide_curve_15.Points, Index=Slider(2, range=0..10), Wrap=True)
list_item_76 = ListItem(List=divide_curve_15.Points, Index=Slider(3, range=0..10), Wrap=True)
curve_middle_29 = CurveMiddle(Curve=merge_52)
deconstruct_brep_13 = DeconstructBrep(Brep=extrude_22)  # -> Faces, Edges, Vertices
line_74 = Line(StartPoint=point_4, EndPoint=list_item_74)
line_75 = Line(StartPoint=point_4, EndPoint=list_item_75)
line_76 = Line(StartPoint=point_4, EndPoint=list_item_76)
shift_list_2 = ShiftList(List=curve_middle_29, Shift=Slider(1, range=0..10), Wrap=Toggle(False))
list_item_77 = ListItem(List=rotate_10.Geometry, Index=Slider(9, range=0..10), Wrap=True)
merge_53 = Merge(Data1=list_item_76, Data2=list_item_75, Data3=list_item_74)
shift_list_3 = ShiftList(List=curve_middle_29, Shift=negative_7, Wrap=Toggle(False))
length_5 = Length(Curve=line_74)
length_6 = Length(Curve=line_76)
length_7 = Length(Curve=line_75)
merge_54 = Merge(Data1=list_item_21, Data2=list_item_77)
list_item_78 = ListItem(List=deconstruct_brep_13.Faces, Index=number_slider_21, Wrap=True)
cull_index_6 = CullIndex(List=deconstruct_brep_13.Faces, Indices=number_slider_21, Wrap=True)
list_item_79 = ListItem(List=rotate_11.Geometry, Index=Slider(10, range=0..100), Wrap=True)
division_23 = Division(A=length_6, B=length_7)
division_24 = Division(A=length_5, B=length_7)
curve_middle_30 = CurveMiddle(Curve=list_item_79)
brep_join_3 = BrepJoin(Breps=cull_index_6)  # -> Breps, Closed

# ---- group: 左侧边界点
divide_curve_16 = DivideCurve(Curve=list_item_61, Count=number_slider_15, Kinks=False)  # -> Points, Tangents, Parameters

# ---- group: 环向中间
line_77 = Line(StartPoint=shift_list_3, EndPoint=shift_list_2)

# ----
list_item_80 = ListItem(List=cull_index_6, Index=Slider(3, range=0..10), Wrap=True)

# ---- group: 浮箱连接中间
line_78 = Line(StartPoint=list_item_72, EndPoint=curve_curve_12.Points)

# ----
to_abaqus_9 = To_Abaqus(Geometry=cull_index_6, Filenames="Hea1_out_nojoin", Path="D:\Study\SEASAM\sjy_struct\Ideal_Model", Bool=Toggle(False))

# ---- group: 底层径向
merge_55 = Merge(Data1=line_72, Data2=line_70, Data3=line_73, Data4=line_78)

# ---- group: hea1_out
brep_10 = Brep(brep_join_3.Breps)

# ----
to_abaqus_10 = To_Abaqus(Geometry=brep_10, Filenames="Hea1_out", Path="D:\Study\SEASAM\sjy_struct\Ideal_Model", Bool=Toggle(False))

merge_56 = Merge(Data1=mirror_12.Geometry, Data2=extrude_point, Data3=loft_4)
mirror_14 = Mirror(Geometry=mirror_12.Geometry, Plane=xy_plane)  # -> Geometry, Transform
merge_57 = Merge(Data1=mirror_12.Geometry, Data2=mirror_11.Geometry, Data3=mirror_14.Geometry)
deconstruct_brep_14 = DeconstructBrep(Brep=extrude_16)  # -> Faces, Edges, Vertices
mirror_15 = Mirror(Geometry=move_60.Geometry, Plane=plane_normal_4)  # -> Geometry, Transform
fillet = Fillet(Curve=mirror_15.Geometry, Radius=p_r)
explode_12 = Explode(Curve=mirror_15.Geometry, Recursive=True)  # -> Segments, Vertices
explode_13 = Explode(Curve=fillet, Recursive=True)  # -> Segments, Vertices
explode_14 = Explode(Curve=fillet, Recursive=True)  # -> Segments, Vertices
list_item_81 = ListItem(List=explode_14.Vertices, Index=Slider(6, range=0..10), Wrap=True)
list_item_82 = ListItem(List=explode_12.Segments, Index=Slider(5, range=0..10), Wrap=True)
list_item_83 = ListItem(List=explode_14.Segments, Index=Slider(6, range=0..10), Wrap=True)
list_item_84 = ListItem(List=explode_14.Segments, Index=Slider(7, range=0..10), Wrap=True)
list_item_85 = ListItem(List=explode_13.Segments, Index=panel_74, Wrap=True)
list_item_86 = ListItem(List=explode_12.Segments, Index=Slider(6, range=0..10), Wrap=True)
curve_closest_point_8 = CurveClosestPoint(Point=list_item_81, Curve=list_item_86)  # -> Point, Parameter, Distance
shatter_5 = Shatter(Curve=list_item_86, Parameters=curve_closest_point_8.Parameter)
mirror_16 = Mirror(Geometry=merge_57, Plane=plane_normal_4)  # -> Geometry, Transform
move_77 = Move(Geometry=explode_12.Segments, Motion=multiplication_16)  # -> Geometry, Transform
explode_15 = Explode(Curve=move_77.Geometry, Recursive=True)  # -> flatten(Segments), Vertices
line_79 = Line(StartPoint=curve_middle_17, EndPoint=curve_middle_2)
length_8 = Length(Curve=line_79)
line_sdl_11 = LineSDL(Start=curve_middle_16, Direction=vector_2pt_4.Vector, Length=length_8)
offset_curve_7 = OffsetCurve(Curve=line_79, Distance=s_p_l3, Plane=PlaneXY(0, 0, 0), Corners=1)
offset_curve_8 = OffsetCurve(Curve=line_79, Distance=negative_15, Plane=PlaneXY(0, 0, 0), Corners=1)
list_item_87 = ListItem(List=explode_15.Segments, Index=0, Wrap=True)
list_item_88 = ListItem(List=explode_15.Segments, Index=Slider(2, range=0..10), Wrap=True)
curve_middle_31 = CurveMiddle(Curve=list_item_87)
curve_middle_32 = CurveMiddle(Curve=list_item_88)
merge_58 = Merge(Data1=offset_curve_7, Data2=offset_curve_8)
mirror_17 = Mirror(Geometry=line_79, Plane=xy_plane)  # -> Geometry, Transform
line_80 = Line(StartPoint=curve_middle_31, EndPoint=curve_middle_32)
mirror_18 = Mirror(Geometry=merge_58, Plane=xy_plane)  # -> Geometry, Transform

# ---- group: 上下镜像
mirror_19 = Mirror(Geometry=merge_56, Plane=xy_plane)  # -> Geometry, Transform

# ---- group: 全部倒角
merge_59 = Merge(Data1=mirror_19.Geometry, Data2=merge_56, Data3=loft_3, Data4=mirror_11.Geometry)

# ---- group: 曲梁
list_item_89 = ListItem(List=deconstruct_brep_14.Edges, Index=Slider(1, range=0..10), Wrap=True)

# ---- group: 单边长矩形边
list_item_90 = ListItem(List=shatter_5, Index=0, Wrap=True)

# ---- group: 右侧端部曲梁
curve_29 = Curve(list_item_89)

# ----
brep_11 = Brep(merge_59)

# ---- group: 次要T材
merge_60 = Merge(Data1=mirror_18.Geometry, Data2=merge_58, Data3=line_sdl_11)

# ---- group: 水平主T材
merge_61 = Merge(Data1=mirror_17.Geometry, Data2=line_79)

# ---- group: 下水平T
# P1
curve_30 = Curve(line_79)

# ---- group: 上水平T
curve_31 = Curve(mirror_17.Geometry)

# ---- group: 下次T
curve_32 = Curve(merge_58)

# ---- group: 上次T
curve_33 = Curve(mirror_18.Geometry)

# ---- group: 侧面次T
curve_34 = Curve(line_sdl_11)

# ----
explode_16 = Explode(Curve=list_item_89, Recursive=True)  # -> Segments, Vertices
list_item_91 = ListItem(List=explode_16.Segments, Index=Slider(4, range=0..10), Wrap=True)
list_item_92 = ListItem(List=explode_16.Segments, Index=Slider(5, range=0..10), Wrap=True)
list_item_93 = ListItem(List=explode_16.Segments, Index=Slider(6, range=0..10), Wrap=True)
mirror_20 = Mirror(Geometry=list_item_90, Plane=xy_plane)  # -> Geometry, Transform
surface_17 = Surface(list_item_89)
merge_62 = Merge(Data1=list_item_91, Data2=list_item_90)
merge_63 = Merge(Data1=list_item_93, Data2=list_item_84)  # -> flatten(Result)
merge_64 = Merge(Data1=list_item_92, Data2=list_item_83)  # -> flatten(Result)
loft_9 = Loft(Curves=merge_62, Options={Adjust=False, Closed=False, LoftEnds=0, LoftSimp=0, LoftType=0, Rebuild=10, Refit=0.01})
loft_10 = Loft(Curves=merge_63, Options={Adjust=False, Closed=False, LoftEnds=0, LoftSimp=0, LoftType=0, Rebuild=10, Refit=0.01})
loft_11 = Loft(Curves=merge_64, Options={Adjust=False, Closed=False, LoftEnds=0, LoftSimp=0, LoftType=0, Rebuild=10, Refit=0.01})
merge_65 = Merge(Data1=list_item_90, Data2=mirror_20.Geometry)
merge_66 = Merge(Data1=list_item_85, Data2=merge_65, Data3=list_item_82)  # -> flatten(Result)
join_curves_6 = JoinCurves(Curves=merge_66, Preserve=False)
extrude_23 = Extrude(Base=join_curves_6, Direction=multiplication_14)
merge_67 = Merge(Data1=loft_11, Data2=loft_9)  # -> flatten(Result)
move_78 = Move(Geometry=list_item_89, Motion=multiplication_15)  # -> Geometry, Transform

# ---- group: 半倒角分隔板
surface_18 = Surface(join_curves_6)

# ---- group: 倒角分隔板基础位置
move_79 = Move(Geometry=surface_17, Motion=multiplication_15)  # -> Geometry, Transform

# ---- group: 半倒角分隔板
move_80 = Move(Geometry=surface_18, Motion=multiplication_16)  # -> Geometry, Transform

# ---- group: 水平镜像
mirror_21 = Mirror(Geometry=merge_67, Plane=xy_plane)  # -> Geometry, Transform

# ---- group: 倒角分隔板
move_81 = Move(Geometry=move_79.Geometry, Motion=negative_19)  # -> Geometry, Transform

move_82 = Move(Geometry=move_81.Geometry, Motion=negative_20)  # -> Geometry, Transform

# ---- group: 曲梁基础位置
move_83 = Move(Geometry=move_78.Geometry, Motion=negative_21)  # -> Geometry, Transform

# ---- group: 分隔板
merge_68 = Merge(Data1=move_80.Geometry, Data2=move_81.Geometry, Data3=move_82.Geometry)  # -> flatten(Result)

# ----
unit_z_42 = UnitZ(Factor=1)
number_slider_25 = Slider(41, range=0..100)

# ---- group: 支撑梁
panel_78 = Panel("D:\Study\SEASAM\sjy_struct\Ideal_Model\TR1_L.xlsx")
截面名称_19 = ValueList({"B3000_3200", "BSRAbulb200x10x28x8x8x3", "BSRAbulb200x12x28x8x8x3", "BSRAbulb320x13x46x14x14x4", "BSRAbulb340x14x49x15x15x4", "BSRAbulb370x14x54x16x16x4", "BSRAbulb400x14x58x18x18x4", "BSRAbulb400x16x58x18x18x4", "BSRAbulb430x15x62x20x20x4", "BSRAbulb430x17x62x20x20x4"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}, selected="B3000_3200")
longest_list_4 = LongestList(ListListA=unit_z_42, ListListB=line_63, PaddingMode=2)  # -> ListListA, ListListB
截面是否偏移_21 = ValueList({"yes", "no"}, selected="no")
梁类型_21 = ValueList({"straight", "curve"}, selected="straight")

# ----
cluster_3 = Cluster_5(
    file_path=panel_78,
    run=button,
    line=line_63,
    curve=line_63,
    relay=line_63,
    bake=boolean_toggle,
    d1="TR1",
    d2=number_slider_25,
    list_a=panel_5,
    seed=number_slider_25,
    d5=longest_list_4.ListListA,
    list_a_2=截面名称_19,
    A=number_slider_25,
    A_2=number_slider_25,
    list_a_3=number_slider_25,
    list_a_4=梁类型_21,
    list_a_5=截面是否偏移_21)

list_item_94 = ListItem(List=divide_curve_16.Points, Index=round.Nearest, Wrap=True)
line_81 = Line(StartPoint=list_item_62, EndPoint=list_item_94)
mirror_22 = Mirror(Geometry=line_81, Plane=xz_plane_4)  # -> Geometry, Transform
list_item_95 = ListItem(List=line_77, Index=-1, Wrap=True)
merge_69 = Merge(Data1=merge_15, Data2=mirror_8.Geometry, Data3=list_item_59, Data4=line_28, Data5=mirror_22.Geometry, Data6=line_81)  # -> flatten(Result)
merge_70 = Merge(Data1=line_34, Data2=list_item_95)
point_25 = Point(divide_curve_16.Points)
curve_curve_14 = CurveCurve(CurveA=flatten(merge_70), CurveB=offset_curve_5)  # -> flatten(Points), ParamsA, ParamsB
list_item_96 = ListItem(List=point_25, Index=panel_67, Wrap=True)
list_item_97 = ListItem(List=curve_curve_14.Points, Index=0, Wrap=True)
merge_71 = Merge(Data1=line_72, Data2=line_70, Data3=line_73, Data4=line_78, Data5=line_77)
list_item_98 = ListItem(List=curve_curve_14.Points, Index=1, Wrap=True)
list_item_99 = ListItem(List=point_25, Index=panel_68, Wrap=True)
line_82 = Line(StartPoint=list_item_97, EndPoint=list_item_98)
shift_list_4 = ShiftList(List=line_77, Shift=negative_8, Wrap=Toggle(False))
merge_72 = Merge(Data1=list_item_20, Data2=list_item_98)
extrude_24 = Extrude(Base=merge_69, Direction=unit_z_5)
merge_73 = Merge(Data1=list_item_22, Data2=curve_curve_13.Points, Data3=curve_curve_12.Points, Data4=merge_72)  # -> flatten(Result)
mirror_23 = Mirror(Geometry=merge_73, Plane=xz_plane_5)  # -> Geometry, Transform
cull_index_7 = CullIndex(List=divide_curve_16.Points, Indices=panel_70, Wrap=True)
end_points_25 = EndPoints(Curve=line_77)  # -> Start, End
merge_74 = Merge(Data1=merge_73, Data2=mirror_23.Geometry, Data3=curve_middle_11)  # -> flatten(Result)
curve_curve_15 = CurveCurve(CurveA=flatten(list_item_95), CurveB=line_78)  # -> flatten(Points), ParamsA, ParamsB
point_26 = Point(end_points_25.Start)
merge_75 = Merge(Data1=curve_curve_15.Points, Data2=point_26)  # -> flatten(Result)
mirror_24 = Mirror(Geometry=merge_75, Plane=xz_plane_7)  # -> Geometry, Transform
merge_76 = Merge(Data1=merge_75, Data2=mirror_24.Geometry)
line_sdl_12 = LineSDL(Start=cull_index_7, Direction=unit_z_19, Length=hea_h)
line_sdl_13 = LineSDL(Start=merge_74, Direction=unit_z_19, Length=hea_h)
line_sdl_14 = LineSDL(Start=merge_76, Direction=unit_z_19, Length=hea_h)
brep_12 = Brep(extrude_24)

# ---- group: 边缘三根
line_83 = Line(StartPoint=list_item_96, EndPoint=merge_53)

# ---- group: 边缘两根
line_84 = Line(StartPoint=merge_54, EndPoint=list_item_99)

# ---- group: 浮箱连接外侧
merge_77 = Merge(Data1=line_37, Data2=line_82)

# ---- group: 环向外层
scale_7 = Scale(Geometry=shift_list_4, Center=point_4, Factor=division_23)  # -> Geometry, Transform

# ---- group: 环向内测
scale_8 = Scale(Geometry=shift_list_4, Center=point_4, Factor=division_24)  # -> Geometry, Transform

# ----
# 内测竖向
line_85 = Line(line_sdl_14)

# ----
# 侧边竖向
line_86 = Line(line_sdl_12)

# ----
# 外围竖向
line_87 = Line(line_sdl_13)

end_points_26 = EndPoints(Curve=line_85)  # -> Start, End
end_points_27 = EndPoints(Curve=line_87)  # -> Start, End
# Hea_1
to_abaqus_11 = To_Abaqus(Geometry=brep_12, Filenames="Hea1_in", Path="D:\Study\SEASAM\sjy_struct\Ideal_Model", Bool=Toggle(False))
point_27 = Point(end_points_26.Start)
point_28 = Point(end_points_27.Start)
format = Format(Format="{0:F2}", Culture=127, Data0=point_28)
vector_2pt_17 = Vector2Pt(PointA=point_4, PointB=point_27, Unitize=False)  # -> Vector, Length
vector_2pt_18 = Vector2Pt(PointA=point_4, PointB=point_28, Unitize=False)  # -> Vector, Length
panel_79 = Panel(point_28)

# ---- group: 侧边竖向
unit_x_16 = UnitX(Factor=1)
negative_32 = Negative(Value=unit_x_16)
panel_80 = Panel("D:\Study\SEASAM\sjy_struct\Ideal_Model\hea1_cebianshuxiang.xlsx")
截面名称_20 = ValueList({"B3000_3200", "BSRAbulb200x10x28x8x8x3", "BSRAbulb200x12x28x8x8x3", "BSRAbulb320x13x46x14x14x4", "BSRAbulb340x14x49x15x15x4", "BSRAbulb370x14x54x16x16x4", "BSRAbulb400x14x58x18x18x4", "BSRAbulb400x16x58x18x18x4", "BSRAbulb430x15x62x20x20x4", "BSRAbulb430x17x62x20x20x4"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}, selected="BSRAbulb430x20x62x20x20x4")
longest_list_5 = LongestList(ListListA=negative_32, ListListB=line_86, PaddingMode=2)  # -> ListListA, ListListB
panel_81 = Panel("""Set
Location_start
Location_mid
Location_end
Z_vector
Material_name
Section_name
Timestamp
Beam_type
Is_offset""")
截面是否偏移_22 = ValueList({"yes", "no"}, selected="yes")
梁类型_22 = ValueList({"straight", "curve"}, selected="straight")

# ----
trim_solid_6 = TrimSolid(Shape=extrude_20, Cutters=extrude_7)
brep_13 = Brep(trim_solid_6)
deconstruct_brep_15 = DeconstructBrep(Brep=brep_13)  # -> Faces, Edges, Vertices
list_item_100 = ListItem(List=deconstruct_brep_15.Faces, Index=0, Wrap=True)
list_item_101 = ListItem(List=deconstruct_brep_15.Faces, Index=Slider(4, range=0..10), Wrap=True)
move_84 = Move(Geometry=list_item_101, Motion=line_62)  # -> Geometry, Transform
move_85 = Move(Geometry=list_item_101, Motion=negative_14)  # -> Geometry, Transform
move_86 = Move(Geometry=list_item_100, Motion=negative_28)  # -> Geometry, Transform
area_16 = Area(Geometry=move_86.Geometry)  # -> Area, Centroid
plane_normal_6 = PlaneNormal(Origin=area_16.Centroid, ZAxis=vector_2pt_12.Vector)
circle_7 = Circle(Plane=plane_normal_6, Radius=n_r)

merge_78 = Merge(Data1=circle_7, Data2=circle_6)  # -> flatten(Result)

# ---- group: 斜撑杆
line_88 = Line(StartPoint=area_11.Centroid, EndPoint=area_16.Centroid)

# ---- group: TN内部隔板
merge_79 = Merge(Data1=move_85.Geometry, Data2=move_84.Geometry)  # -> flatten(Result)

# ---- group: TN_壳模型
brep_14 = Brep(brep_13)

# ----
merge_80 = Merge(Data1=extrude_7, Data2=brep_14)  # -> flatten(Result)
solid_union = SolidUnion(Breps=merge_80)
trim_solid_7 = TrimSolid(Shape=trim_solid_3, Cutters=solid_union)

# ---- group: 支撑圆管
loft_12 = Loft(Curves=merge_78, Options={Adjust=False, Closed=False, LoftEnds=0, LoftSimp=0, LoftType=0, Rebuild=10, Refit=0.01})

# ----
to_abaqus_12 = To_Abaqus(Geometry=brep_14, Filenames="TN_out", Path="D:\Study\SEASAM\sjy_struct\Ideal_Model", Bool=Toggle(False))
to_abaqus_13 = To_Abaqus(Geometry=merge_79, Filenames="TN_in", Path="D:\Study\SEASAM\sjy_struct\Ideal_Model", Bool=Toggle(False))

merge_81 = Merge(Data1=mirror_21.Geometry, Data2=merge_67, Data3=loft_10, Data4=mirror_16.Geometry)  # -> flatten(Result)
explode_17 = Explode(Curve=move_81.Geometry, Recursive=True)  # -> Segments, Vertices
list_item_102 = ListItem(List=explode_17.Segments, Index=0, Wrap=True)
list_item_103 = ListItem(List=explode_17.Segments, Index=Slider(4, range=0..10), Wrap=True)
curve_middle_33 = CurveMiddle(Curve=list_item_102)
curve_middle_34 = CurveMiddle(Curve=list_item_103)
plane_normal_7 = PlaneNormal(Origin=curve_middle_34, ZAxis=vector_2pt_4.Vector)
move_87 = Move(Geometry=move_83.Geometry, Motion=negative_22)  # -> Geometry, Transform
offset_curve_9 = OffsetCurve(Curve=line_80, Distance=s_p_l3, Plane=plane_normal_7, Corners=1)
offset_curve_10 = OffsetCurve(Curve=line_80, Distance=negative_17, Plane=plane_normal_7, Corners=1)
split_list = SplitList(List=move_87.Geometry, Index=subtraction_14)  # -> ListA, ListB
merge_82 = Merge(Data1=offset_curve_9, Data2=offset_curve_10)
curve_35 = Curve(split_list.ListB)

# ---- group: 中心竖向
line_89 = Line(StartPoint=curve_middle_33, EndPoint=curve_middle_34)

# ---- group: 左侧曲梁
move_88 = Move(Geometry=curve_35, Motion=negative_23)  # -> Geometry, Transform

# ---- group: 右侧曲梁
curve_36 = Curve(split_list.ListA)

# ---- group: 曲梁
merge_83 = Merge(
    Data1=simplify(graft(curve_10)),
    Data2=simplify(graft(move_88.Geometry)),
    Data3=simplify(graft(curve_36)),
    Data4=simplify(graft(curve_29)))

# ---- group: 外壳模型
merge_84 = Merge(Data1=extrude_15, Data2=merge_59, Data3=extrude_16, Data4=merge_81, Data5=extrude_23)  # -> flatten(Result)

# ---- group: 所有壳单元
merge_85 = Merge(Data1=merge_84, Data2=merge_68)

# ----
offset_curve_11 = OffsetCurve(Curve=line_89, Distance=s_p_l3, Plane=plane_normal_7, Corners=1)
offset_curve_12 = OffsetCurve(Curve=line_89, Distance=negative_16, Plane=plane_normal_7, Corners=1)
merge_86 = Merge(Data1=offset_curve_11, Data2=offset_curve_12)
move_89 = Move(Geometry=line_89, Motion=negative_20)  # -> Geometry, Transform
move_90 = Move(Geometry=merge_86, Motion=negative_20)  # -> Geometry, Transform
explode_18 = Explode(Curve=merge_83, Recursive=True)  # -> Segments, Vertices
list_item_104 = ListItem(List=explode_18.Segments, Index=0, Wrap=True)
list_item_105 = ListItem(List=explode_18.Segments, Index=Slider(4, range=0..10), Wrap=True)
curve_middle_35 = CurveMiddle(Curve=list_item_105)  # -> flatten(Midpoint)
curve_middle_36 = CurveMiddle(Curve=list_item_104)  # -> flatten(Midpoint)
brep_join_4 = BrepJoin(Breps=merge_85)  # -> Breps, Closed

# ---- group: 竖向中心
merge_87 = Merge(Data1=line_89, Data2=move_89.Geometry, Data3=line_80)  # -> flatten(Result)

# ---- group: 竖向边缘
merge_88 = Merge(Data1=merge_86, Data2=move_90.Geometry, Data3=merge_82)

# ---- group: 竖向圆管
line_90 = Line(StartPoint=curve_middle_36, EndPoint=curve_middle_35)

# ----
to_abaqus_14 = To_Abaqus(Geometry=brep_join_4.Breps, Filenames="P1", Path="D:\Study\SEASAM\sjy_struct\Ideal_Model", Bool=Toggle(False))

# ---- group: 竖向次T
panel_82 = Panel("D:\Study\SEASAM\sjy_struct\Ideal_Model\P1_SX_CT.xlsx")
截面名称_21 = ValueList({"B3000_3200", "BSRAbulb200x10x28x8x8x3", "BSRAbulb200x12x28x8x8x3", "BSRAbulb320x13x46x14x14x4", "BSRAbulb340x14x49x15x15x4", "BSRAbulb370x14x54x16x16x4", "BSRAbulb400x14x58x18x18x4", "BSRAbulb400x16x58x18x18x4", "BSRAbulb430x15x62x20x20x4", "BSRAbulb430x17x62x20x20x4"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}, selected="BSRAbulb430x20x62x20x20x4")
longest_list_6 = LongestList(ListListA=vector_2pt_4.Vector, ListListB=merge_88, PaddingMode=2)  # -> ListListA, ListListB
截面是否偏移_23 = ValueList({"yes", "no"}, selected="yes")
梁类型_23 = ValueList({"straight", "curve"}, selected="straight")

# ---- group: 竖向主T
panel_83 = Panel("D:\Study\SEASAM\sjy_struct\Ideal_Model\P1_SX_T.xlsx")
截面名称_22 = ValueList({"B3000_3200", "BSRAbulb200x10x28x8x8x3", "BSRAbulb200x12x28x8x8x3", "BSRAbulb320x13x46x14x14x4", "BSRAbulb340x14x49x15x15x4", "BSRAbulb370x14x54x16x16x4", "BSRAbulb400x14x58x18x18x4", "BSRAbulb400x16x58x18x18x4", "BSRAbulb430x15x62x20x20x4", "BSRAbulb430x17x62x20x20x4"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}, selected="T15_700_20_300")
longest_list_7 = LongestList(ListListA=vector_2pt_4.Vector, ListListB=merge_87, PaddingMode=2)  # -> ListListA, ListListB
截面是否偏移_24 = ValueList({"yes", "no"}, selected="yes")
梁类型_24 = ValueList({"straight", "curve"}, selected="straight")

# ---- group: 曲梁
curve_37 = Curve(simplify(flatten(merge_83)))

# ----
list_item_106 = ListItem(List=line_83, Index=-1, Wrap=True)
list_item_107 = ListItem(List=line_83, Index=1, Wrap=True)
list_item_108 = ListItem(List=line_83, Index=0, Wrap=True)
curve_middle_37 = CurveMiddle(Curve=list_item_106)
list_item_109 = ListItem(List=scale_8.Geometry, Index=-1, Wrap=True)
list_item_110 = ListItem(List=scale_7.Geometry, Index=-1, Wrap=True)
end_points_28 = EndPoints(Curve=list_item_109)  # -> Start, End
end_points_29 = EndPoints(Curve=list_item_110)  # -> Start, End

# ---- group: 底层边缘
line_91 = Line(StartPoint=curve_middle_30, EndPoint=curve_middle_37)

# ---- group: 环向内层
line_92 = Line(StartPoint=end_points_28.End, EndPoint=list_item_23)

# ---- group: 环向外层
line_93 = Line(StartPoint=end_points_29.End, EndPoint=list_item_24)

# ---- group: 底层半T
merge_89 = Merge(Data1=list_item_108, Data2=scale_7.Geometry, Data3=line_93, Data4=line_77, Data5=merge_55)  # -> flatten(Result)

# ---- group: 底层半次梁
merge_90 = Merge(
    Data1=list_item_106,
    Data2=list_item_107,
    Data3=line_91,
    Data4=line_92,
    Data5=merge_77,
    Data6=scale_8.Geometry,
    Data7=line_84)  # -> flatten(Result)

# ----
mirror_25 = Mirror(Geometry=merge_89, Plane=xz_plane_8)  # -> Geometry, Transform
mirror_26 = Mirror(Geometry=merge_90, Plane=xz_plane_9)  # -> Geometry, Transform

# ----
# 底层T型材
merge_91 = Merge(Data1=merge_89, Data2=mirror_25.Geometry, Data3=line_40)  # -> flatten(Result)

# ----
# 顶层T材
mirror_27 = Mirror(Geometry=merge_91, Plane=move_3.Geometry)  # -> Geometry, Transform

# ----
# 底层骨材
merge_92 = Merge(Data1=merge_90, Data2=mirror_26.Geometry, Data3=line_43)  # -> flatten(Result)

# ----
# 顶层骨材
mirror_28 = Mirror(Geometry=merge_92, Plane=move_3.Geometry)  # -> Geometry, Transform

deconstruct_brep_16 = DeconstructBrep(Brep=list_item_100)  # -> Faces, Edges, Vertices
surface_19 = Surface(circle_7)
divide_curve_17 = DivideCurve(Curve=circle_7, Count="4", Kinks=False)  # -> Points, Tangents, Parameters
area_17 = Area(Geometry=surface_19)  # -> Area, Centroid
evaluate_surface_2 = EvaluateSurface(Surface=surface_19, Point=area_17.Centroid)  # -> Point, Normal, UDirection, VDirection, Frame
rotate_16 = Rotate(Geometry=divide_curve_17.Points, Angle=0.7853981634, Plane=surface_19)  # -> Geometry, Transform
line_94 = Line(StartPoint=area_17.Centroid, EndPoint=rotate_16.Geometry)  # -> flatten(Line)
list_item_111 = ListItem(List=deconstruct_brep_16.Edges, Index=Slider(0, range=0..10), Wrap=True)
list_item_112 = ListItem(List=deconstruct_brep_16.Edges, Index=Slider(1, range=0..10), Wrap=True)
list_item_113 = ListItem(List=deconstruct_brep_16.Edges, Index=Slider(3, range=0..10), Wrap=True)
list_item_114 = ListItem(List=deconstruct_brep_16.Edges, Index=Slider(2, range=0..10), Wrap=True)
multiplication_25 = Multiplication(A=evaluate_surface_2.Normal, B="500")
extrude_25 = Extrude(Base=line_94, Direction=multiplication_25)
split_with_breps_2 = SplitWithBreps(Curve=circle_7, Brep=extrude_25)  # -> Curve, Points
list_item_115 = ListItem(List=split_with_breps_2.Curve, Index=Slider(3, range=0..10), Wrap=True)
list_item_116 = ListItem(List=split_with_breps_2.Curve, Index=Slider(0, range=0..10), Wrap=True)
list_item_117 = ListItem(List=split_with_breps_2.Curve, Index=Slider(1, range=0..10), Wrap=True)
list_item_118 = ListItem(List=split_with_breps_2.Curve, Index=Slider(2, range=0..10), Wrap=True)

flip_curve = FlipCurve(Curve=list_item_111)  # -> Curve, Flag
flip_curve_2 = FlipCurve(Curve=list_item_113)  # -> Curve, Flag
flip_curve_3 = FlipCurve(Curve=list_item_114)  # -> Curve, Flag
flip_curve_4 = FlipCurve(Curve=list_item_112)  # -> Curve, Flag

merge_93 = Merge(Data1=list_item_116, Data2=flip_curve_2.Curve)  # -> flatten(Result)
merge_94 = Merge(Data1=list_item_117, Data2=flip_curve_3.Curve)  # -> flatten(Result)
merge_95 = Merge(Data1=list_item_115, Data2=flip_curve.Curve)  # -> flatten(Result)
merge_96 = Merge(Data1=list_item_118, Data2=flip_curve_4.Curve)  # -> flatten(Result)
loft_13 = Loft(Curves=merge_93, Options={Adjust=False, Closed=False, LoftEnds=0, LoftSimp=0, LoftType=0, Rebuild=10, Refit=0.01})
loft_14 = Loft(Curves=merge_94, Options={Adjust=False, Closed=False, LoftEnds=0, LoftSimp=0, LoftType=0, Rebuild=10, Refit=0.01})
loft_15 = Loft(Curves=merge_96, Options={Adjust=False, Closed=False, LoftEnds=0, LoftSimp=0, LoftType=0, Rebuild=10, Refit=0.01})
loft_16 = Loft(Curves=merge_95, Options={Adjust=False, Closed=False, LoftEnds=0, LoftSimp=0, LoftType=0, Rebuild=10, Refit=0.01})
merge_97 = Merge(Data1=loft_16, Data2=loft_13, Data3=loft_14, Data4=loft_15, Data5=surface_19)  # -> flatten(Result)

# ---- group: 上部倒角段
brep_15 = Brep(merge_97)

# ---- group: 结构外壳模型
merge_98 = Merge(
    Data1=brep_10,
    Data2=brep_12,
    Data3=brep_5,
    Data4=brep_6,
    Data5=brep_8,
    Data6=brep_join_4.Breps,
    Data7=brep,
    Data8=brep_join_2.Breps,
    Data9=brep_7,
    Data10=brep_9,
    Data11=brep_14,
    Data12=merge_79,
    Data13=brep_15,
    Data14=merge_43)  # -> flatten(Result)

# ----
brep_join_5 = BrepJoin(Breps=merge_98)  # -> Breps, Closed
to_abaqus_15 = To_Abaqus(Geometry=brep_join_5.Breps, Filenames="ALL", Path="D:\Study\SEASAM\sjy_struct\Ideal_Model", Bool=Toggle(False))

# ---- group: 几何模型全部
merge_99 = Merge(
    Data1=brep_10,
    Data2=brep_12,
    Data3=brep_5,
    Data4=brep_6,
    Data5=brep_8,
    Data6=brep_join_4.Breps,
    Data7=brep,
    Data8=brep_join_2.Breps,
    Data9=brep_7,
    Data10=brep_9,
    Data11=brep_14,
    Data12=merge_79,
    Data13=trim_solid_7,
    Data14=loft_12,
    Data15=brep_15)  # -> flatten(Result)

# ----
to_abaqus_16 = To_Abaqus(Geometry=brep_15, Filenames="TN_F", Path="D:\Study\SEASAM\sjy_struct\Ideal_Model", Bool=Toggle(False))

unit_z_43 = UnitZ(Factor=1)
unit_z_44 = UnitZ(Factor=1)
unit_z_45 = UnitZ(Factor=1)
unit_z_46 = UnitZ(Factor=1)
number_slider_26 = Slider(2, range=0..100)
number_slider_27 = Slider(3, range=0..100)
number_slider_28 = Slider(5, range=0..100)
number_slider_29 = Slider(1, range=0..100)
number_slider_30 = Slider(4, range=0..100)
number_slider_31 = Slider(7, range=0..100)
number_slider_32 = Slider(0, range=0..100)
cluster_4 = Cluster_2(
    file_path=panel_6,
    run=button_3,
    column_names=panel_7,
    line=line_87,
    curve=line_87,
    relay=line_87,
    bake=boolean_toggle_3,
    user_keys=panel_7,
    d1="Hea1_in",
    d2=number_slider_29,
    list_a=panel_13,
    seed=number_slider_29,
    d5=vector_2pt_18.Vector,
    list_a_2=截面名称,
    A=number_slider_29,
    A_2=number_slider_29,
    list_a_3=number_slider_29,
    list_a_4=梁类型,
    list_a_5=截面是否偏移)
cluster_5 = Cluster_3(
    file_path=panel_80,
    run=button_2,
    column_names=panel_81,
    line=line_86,
    curve=line_86,
    relay=line_86,
    bake=boolean_toggle_2,
    user_keys=panel_81,
    d1="Hea1_in",
    d2=number_slider_32,
    list_a=panel_11,
    seed=number_slider_32,
    d5=longest_list_5.ListListA,
    list_a_2=截面名称_20,
    A=number_slider_32,
    A_2=number_slider_32,
    list_a_3=number_slider_32,
    list_a_4=梁类型_22,
    list_a_5=截面是否偏移_22)
cluster_6 = Cluster_2(
    file_path=panel_8,
    run=button_4,
    column_names=panel_9,
    line=line_85,
    curve=line_85,
    relay=line_85,
    bake=boolean_toggle_4,
    user_keys=panel_9,
    d1="Hea1_in",
    d2=number_slider_26,
    list_a=panel_14,
    seed=number_slider_26,
    d5=vector_2pt_17.Vector,
    list_a_2=截面名称_2,
    A=number_slider_26,
    A_2=number_slider_26,
    list_a_3=number_slider_26,
    list_a_4=梁类型_2,
    list_a_5=截面是否偏移_2)

# ---- group: 底层T
negative_33 = Negative(Value=unit_z_43)
panel_84 = Panel("D:\Study\SEASAM\sjy_struct\Ideal_Model\hea1_dicengT.xlsx")
截面名称_23 = ValueList({"B3000_3200", "BSRAbulb200x10x28x8x8x3", "BSRAbulb200x12x28x8x8x3", "BSRAbulb320x13x46x14x14x4", "BSRAbulb340x14x49x15x15x4", "BSRAbulb370x14x54x16x16x4", "BSRAbulb400x14x58x18x18x4", "BSRAbulb400x16x58x18x18x4", "BSRAbulb430x15x62x20x20x4", "BSRAbulb430x17x62x20x20x4"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}, selected="T15_700_20_300")
longest_list_8 = LongestList(ListListA=negative_33, ListListB=merge_91, PaddingMode=2)  # -> ListListA, ListListB
panel_85 = Panel("""Set
Location_start
Location_mid
Location_end
Z_vector
Material_name
Section_name
Timestamp
Beam_type
Is_offset""")
截面是否偏移_25 = ValueList({"yes", "no"}, selected="yes")
梁类型_25 = ValueList({"straight", "curve"}, selected="straight")

# ---- group: 顶层T
negative_34 = Negative(Value=unit_z_44)
panel_86 = Panel("D:\Study\SEASAM\sjy_struct\Ideal_Model\hea1_dingcengT.xlsx")
截面名称_24 = ValueList({"B3000_3200", "BSRAbulb200x10x28x8x8x3", "BSRAbulb200x12x28x8x8x3", "BSRAbulb320x13x46x14x14x4", "BSRAbulb340x14x49x15x15x4", "BSRAbulb370x14x54x16x16x4", "BSRAbulb400x14x58x18x18x4", "BSRAbulb400x16x58x18x18x4", "BSRAbulb430x15x62x20x20x4", "BSRAbulb430x17x62x20x20x4"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}, selected="T15_700_20_300")
longest_list_9 = LongestList(ListListA=unit_z_44, ListListB=mirror_27.Geometry, PaddingMode=2)  # -> ListListA, ListListB
panel_87 = Panel("""Set
Location_start
Location_mid
Location_end
Z_vector
Material_name
Section_name
Timestamp
Beam_type
Is_offset""")
截面是否偏移_26 = ValueList({"yes", "no"}, selected="yes")
梁类型_26 = ValueList({"straight", "curve"}, selected="straight")

# ---- group: 底层骨材
negative_35 = Negative(Value=unit_z_45)
panel_88 = Panel("D:\Study\SEASAM\sjy_struct\Ideal_Model\hea1_dicengGu.xlsx")
截面名称_25 = ValueList({"B3000_3200", "BSRAbulb200x10x28x8x8x3", "BSRAbulb200x12x28x8x8x3", "BSRAbulb320x13x46x14x14x4", "BSRAbulb340x14x49x15x15x4", "BSRAbulb370x14x54x16x16x4", "BSRAbulb400x14x58x18x18x4", "BSRAbulb400x16x58x18x18x4", "BSRAbulb430x15x62x20x20x4", "BSRAbulb430x17x62x20x20x4"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}, selected="BSRAbulb430x20x62x20x20x4")
longest_list_10 = LongestList(ListListA=negative_35, ListListB=merge_92, PaddingMode=2)  # -> ListListA, ListListB
panel_89 = Panel("""Set
Location_start
Location_mid
Location_end
Z_vector
Material_name
Section_name
Timestamp
Beam_type
Is_offset""")
截面是否偏移_27 = ValueList({"yes", "no"}, selected="yes")
梁类型_27 = ValueList({"straight", "curve"}, selected="straight")

# ---- group: 顶层骨材
negative_36 = Negative(Value=unit_z_46)
panel_90 = Panel("D:\Study\SEASAM\sjy_struct\Ideal_Model\hea1_dingcengGu.xlsx")
截面名称_26 = ValueList({"B3000_3200", "BSRAbulb200x10x28x8x8x3", "BSRAbulb200x12x28x8x8x3", "BSRAbulb320x13x46x14x14x4", "BSRAbulb340x14x49x15x15x4", "BSRAbulb370x14x54x16x16x4", "BSRAbulb400x14x58x18x18x4", "BSRAbulb400x16x58x18x18x4", "BSRAbulb430x15x62x20x20x4", "BSRAbulb430x17x62x20x20x4"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}, selected="BSRAbulb430x20x62x20x20x4")
longest_list_11 = LongestList(ListListA=unit_z_46, ListListB=mirror_28.Geometry, PaddingMode=2)  # -> ListListA, ListListB
panel_91 = Panel("""Set
Location_start
Location_mid
Location_end
Z_vector
Material_name
Section_name
Timestamp
Beam_type
Is_offset""")
截面是否偏移_28 = ValueList({"yes", "no"}, selected="yes")
梁类型_28 = ValueList({"straight", "curve"}, selected="straight")

# ----
cluster_7 = Cluster_2(
    file_path=panel_86,
    run=button_6,
    column_names=panel_87,
    line=mirror_27.Geometry,
    curve=mirror_27.Geometry,
    relay=mirror_27.Geometry,
    bake=boolean_toggle_6,
    user_keys=panel_87,
    d1="Hea1_in",
    d2=number_slider_30,
    list_a=panel_20,
    seed=number_slider_30,
    d5=longest_list_9.ListListA,
    list_a_2=截面名称_24,
    A=number_slider_30,
    A_2=number_slider_30,
    list_a_3=number_slider_30,
    list_a_4=梁类型_26,
    list_a_5=截面是否偏移_26)
cluster_8 = Cluster_2(
    file_path=panel_88,
    run=button_7,
    column_names=panel_89,
    line=merge_92,
    curve=merge_92,
    relay=merge_92,
    bake=boolean_toggle_7,
    user_keys=panel_89,
    d1="Hea1_in",
    d2=number_slider_28,
    list_a=panel_23,
    seed=number_slider_28,
    d5=longest_list_10.ListListA,
    list_a_2=截面名称_25,
    A=number_slider_28,
    A_2=number_slider_28,
    list_a_3=number_slider_28,
    list_a_4=梁类型_27,
    list_a_5=截面是否偏移_27)
cluster_9 = Cluster_4(
    file_path=panel_90,
    run=button_8,
    column_names=panel_91,
    line=mirror_28.Geometry,
    curve=mirror_28.Geometry,
    relay=mirror_28.Geometry,
    bake=boolean_toggle_8,
    user_keys=panel_91,
    d1="Hea1_in",
    d2=number_slider_31,
    list_a=panel_25,
    seed=number_slider_31,
    d5=longest_list_11.ListListA,
    list_a_2=截面名称_26,
    A=number_slider_31,
    A_2=number_slider_31,
    list_a_3=number_slider_31,
    list_a_4=梁类型_28,
    list_a_5=截面是否偏移_28)
cluster_10 = Cluster_2(
    file_path=panel_84,
    run=button_5,
    column_names=panel_85,
    line=merge_91,
    curve=merge_91,
    relay=merge_91,
    bake=boolean_toggle_5,
    user_keys=panel_85,
    d1="Hea1_in",
    d2=number_slider_27,
    list_a=panel_19,
    seed=number_slider_27,
    d5=longest_list_8.ListListA,
    list_a_2=截面名称_23,
    A=number_slider_27,
    A_2=number_slider_27,
    list_a_3=number_slider_27,
    list_a_4=梁类型_25,
    list_a_5=截面是否偏移_25)

area_18 = Area(Geometry=polyline_7)  # -> Area, Centroid
point_29 = Point(end_points_23.Start)
line_95 = Line(StartPoint=area_18.Centroid, EndPoint=end_points_12.Start)
vector_2pt_19 = Vector2Pt(PointA=area_18.Centroid, PointB=end_points_12.Start, Unitize=False)  # -> Vector, Length
curve_38 = Curve(curve_7)
vector_2pt_20 = Vector2Pt(PointA=point_4, PointB=point_29, Unitize=False)  # -> Vector, Length
unit_z_47 = UnitZ(Factor=1)
unit_z_48 = UnitZ(Factor=1)
unit_z_49 = UnitZ(Factor=1)
unit_z_50 = UnitZ(Factor=1)
number_slider_33 = Slider(10, range=0..100)
number_slider_34 = Slider(11, range=0..100)
number_slider_35 = Slider(8, range=0..100)
number_slider_36 = Slider(9, range=0..100)
number_slider_37 = Slider(15, range=0..100)
number_slider_38 = Slider(16, range=0..100)
number_slider_39 = Slider(13, range=0..100)
number_slider_40 = Slider(14, range=0..100)
cluster_11 = Cluster_5(
    file_path=panel_75,
    run=button_27,
    line=curve_25,
    curve=curve_25,
    relay=curve_25,
    bake=boolean_toggle_27,
    d1="C1_in",
    d2=number_slider_35,
    list_a=panel_46,
    seed=number_slider_35,
    d5=longest_list.ListListA,
    list_a_2=截面名称_16,
    A=number_slider_35,
    A_2=number_slider_35,
    list_a_3=number_slider_35,
    list_a_4=梁类型_18,
    list_a_5=截面是否偏移_18)
cluster_12 = Cluster_5(
    file_path=panel_24,
    run=button_25,
    line=curve_7,
    curve=curve_7,
    relay=curve_7,
    bake=boolean_toggle_25,
    d1="C1_in",
    d2=number_slider_36,
    list_a=panel_44,
    seed=number_slider_36,
    d5=vector_2pt_19.Vector,
    list_a_2=截面名称_11,
    A=number_slider_36,
    A_2=number_slider_36,
    list_a_3=number_slider_36,
    list_a_4=梁类型_11,
    list_a_5=截面是否偏移_11)
number_slider_41 = Slider(12, range=0..100)
cluster_13 = Cluster_5(
    file_path=panel_76,
    run=button_28,
    line=curve_26,
    curve=curve_26,
    relay=curve_26,
    bake=boolean_toggle_28,
    d1="C1_in",
    d2=number_slider_40,
    list_a=panel_47,
    seed=number_slider_40,
    d5=longest_list_2.ListListA,
    list_a_2=截面名称_17,
    A=number_slider_40,
    A_2=number_slider_40,
    list_a_3=number_slider_40,
    list_a_4=梁类型_19,
    list_a_5=截面是否偏移_19)
cluster_14 = Cluster_5(
    file_path=panel_77,
    run=button_29,
    line=curve_27,
    curve=curve_27,
    relay=curve_27,
    bake=boolean_toggle_29,
    d1="C1_in",
    d2=number_slider_37,
    list_a=panel_48,
    seed=number_slider_37,
    d5=longest_list_3.ListListA,
    list_a_2=截面名称_18,
    A=number_slider_37,
    A_2=number_slider_37,
    list_a_3=number_slider_37,
    list_a_4=梁类型_20,
    list_a_5=截面是否偏移_20)
cluster_15 = Cluster_5(
    file_path=panel_26,
    run=button_30,
    line=line_58,
    curve=line_58,
    relay=line_58,
    bake=boolean_toggle_30,
    d1="C1_in",
    d2=number_slider_38,
    list_a=panel_49,
    seed=number_slider_38,
    d5=vector_2pt_20.Vector,
    list_a_2=截面名称_12,
    A=number_slider_38,
    A_2=number_slider_38,
    list_a_3=number_slider_38,
    list_a_4=梁类型_12,
    list_a_5=截面是否偏移_12)
divide_curve_18 = DivideCurve(Curve=curve_24, Count="2", Kinks=False)  # -> Points, Tangents, flatten(Parameters)
shatter_6 = Shatter(Curve=curve_24, Parameters=divide_curve_18.Parameters)
area_19 = Area(Geometry=curve_24)  # -> Area, Centroid
number_slider_42 = Slider(17, range=0..100)

# ---- group: 顶部外横梁
negative_37 = Negative(Value=unit_z_48)
panel_92 = Panel("D:\Study\SEASAM\sjy_struct\Ideal_Model\C1_Twhl.xlsx")
截面名称_27 = ValueList({"B3000_3200", "BSRAbulb200x10x28x8x8x3", "BSRAbulb200x12x28x8x8x3", "BSRAbulb320x13x46x14x14x4", "BSRAbulb340x14x49x15x15x4", "BSRAbulb370x14x54x16x16x4", "BSRAbulb400x14x58x18x18x4", "BSRAbulb400x16x58x18x18x4", "BSRAbulb430x15x62x20x20x4", "BSRAbulb430x17x62x20x20x4"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}, selected="T15_800_20_300")
longest_list_12 = LongestList(ListListA=negative_37, ListListB=curve_23, PaddingMode=2)  # -> ListListA, ListListB
截面是否偏移_29 = ValueList({"yes", "no"}, selected="yes")
梁类型_29 = ValueList({"straight", "curve"}, selected="straight")

# ---- group: 顶部内横梁
negative_38 = Negative(Value=unit_z_47)
panel_93 = Panel("D:\Study\SEASAM\sjy_struct\Ideal_Model\C1_Tnhl.xlsx")
截面名称_28 = ValueList({"B3000_3200", "BSRAbulb200x10x28x8x8x3", "BSRAbulb200x12x28x8x8x3", "BSRAbulb320x13x46x14x14x4", "BSRAbulb340x14x49x15x15x4", "BSRAbulb370x14x54x16x16x4", "BSRAbulb400x14x58x18x18x4", "BSRAbulb400x16x58x18x18x4", "BSRAbulb430x15x62x20x20x4", "BSRAbulb430x17x62x20x20x4"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}, selected="BSRAbulb340x14x49x15x15x4")
longest_list_13 = LongestList(ListListA=negative_38, ListListB=curve_6, PaddingMode=2)  # -> ListListA, ListListB
截面是否偏移_30 = ValueList({"yes", "no"}, selected="yes")
梁类型_30 = ValueList({"straight", "curve"}, selected="straight")

# ---- group: 底部内横梁
negative_39 = Negative()
panel_94 = Panel("D:\Study\SEASAM\sjy_struct\Ideal_Model\C1_dbnhl.xlsx")
截面名称_29 = ValueList({"B3000_3200", "BSRAbulb200x10x28x8x8x3", "BSRAbulb200x12x28x8x8x3", "BSRAbulb320x13x46x14x14x4", "BSRAbulb340x14x49x15x15x4", "BSRAbulb370x14x54x16x16x4", "BSRAbulb400x14x58x18x18x4", "BSRAbulb400x16x58x18x18x4", "BSRAbulb430x15x62x20x20x4", "BSRAbulb430x17x62x20x20x4"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}, selected="BSRAbulb340x14x49x15x15x4")
longest_list_14 = LongestList(ListListA=unit_z_49, ListListB=curve_22, PaddingMode=2)  # -> ListListA, ListListB
截面是否偏移_31 = ValueList({"yes", "no"}, selected="yes")
梁类型_31 = ValueList({"straight", "curve"}, selected="straight")

# ---- group: 底部外横梁
negative_40 = Negative()
panel_95 = Panel("D:\Study\SEASAM\sjy_struct\Ideal_Model\C1_dbwhl.xlsx")
截面名称_30 = ValueList({"B3000_3200", "BSRAbulb200x10x28x8x8x3", "BSRAbulb200x12x28x8x8x3", "BSRAbulb320x13x46x14x14x4", "BSRAbulb340x14x49x15x15x4", "BSRAbulb370x14x54x16x16x4", "BSRAbulb400x14x58x18x18x4", "BSRAbulb400x16x58x18x18x4", "BSRAbulb430x15x62x20x20x4", "BSRAbulb430x17x62x20x20x4"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}, selected="T15_800_20_300")
longest_list_15 = LongestList(ListListA=unit_z_50, ListListB=curve_28, PaddingMode=2)  # -> ListListA, ListListB
截面是否偏移_32 = ValueList({"yes", "no"}, selected="yes")
梁类型_32 = ValueList({"straight", "curve"}, selected="straight")

# ---- group: 下
list_item_119 = ListItem(List=shatter_6, Index=1, Wrap=True)

# ---- group: 上
list_item_120 = ListItem(List=shatter_6, Index=0, Wrap=True)  # -> simplify(Item)

# ----
cluster_16 = Cluster_5(
    file_path=panel_94,
    run=button_23,
    line=curve_22,
    curve=curve_22,
    relay=curve_22,
    bake=boolean_toggle_22,
    d1="C1_in",
    d2=number_slider_34,
    list_a=panel_41,
    seed=number_slider_34,
    d5=longest_list_14.ListListA,
    list_a_2=截面名称_29,
    A=number_slider_34,
    A_2=number_slider_34,
    list_a_3=number_slider_34,
    list_a_4=梁类型_31,
    list_a_5=截面是否偏移_31)
cluster_17 = Cluster_5(
    file_path=panel_95,
    run=button_26,
    line=curve_28,
    curve=curve_28,
    relay=curve_28,
    bake=boolean_toggle_26,
    d1="C1_in",
    d2=number_slider_33,
    list_a=panel_45,
    seed=number_slider_33,
    d5=longest_list_15.ListListA,
    list_a_2=截面名称_30,
    A=number_slider_33,
    A_2=number_slider_33,
    list_a_3=number_slider_33,
    list_a_4=梁类型_32,
    list_a_5=截面是否偏移_32)
cluster_18 = Cluster_5(
    file_path=panel_93,
    run=button_21,
    line=curve_6,
    curve=curve_6,
    relay=curve_6,
    bake=boolean_toggle_21,
    d1="C1_in",
    d2=number_slider_39,
    list_a=panel_40,
    seed=number_slider_39,
    A=number_slider_39,
    d5=longest_list_13.ListListA,
    list_a_2=截面名称_28,
    A_2=number_slider_39,
    list_a_3=number_slider_39,
    list_a_4=梁类型_30,
    list_a_5=截面是否偏移_30)
cluster_19 = Cluster_5(
    file_path=panel_92,
    run=button_20,
    line=curve_23,
    curve=curve_23,
    relay=curve_23,
    bake=boolean_toggle_20,
    d1="C1_in",
    d2=number_slider_41,
    list_a=panel_39,
    seed=number_slider_41,
    d5=longest_list_12.ListListA,
    list_a_2=截面名称_27,
    A=number_slider_41,
    A_2=number_slider_41,
    list_a_3=number_slider_41,
    list_a_4=梁类型_29,
    list_a_5=截面是否偏移_29)
curve_middle_38 = CurveMiddle(Curve=list_item_119)  # -> flatten(Midpoint)
curve_middle_39 = CurveMiddle(Curve=list_item_120)  # -> flatten(Midpoint)
vector_2pt_21 = Vector2Pt(PointA=area_19.Centroid, PointB=curve_middle_38, Unitize=False)  # -> graft(Vector), Length
vector_2pt_22 = Vector2Pt(PointA=area_19.Centroid, PointB=curve_middle_39, Unitize=False)  # -> graft(Vector), Length
cluster_20 = Cluster_7(
    file_path="D:\Study\SEASAM\sjy_struct\Ideal_Model\C1_circle.xlsx",
    run=button_42,
    relay_7=panel_61,
    d1="C1_in",
    bake=boolean_toggle_42,
    d2=number_slider_42,
    list_a_2="H355",
    d5_2=vector_2pt_22.Vector,
    list_a_3=value_list,
    list_a_4=number_slider_42,
    seed=number_slider_42,
    list_a_5=梁类型_15,
    relay=list_item_120,
    A=number_slider_42,
    list_a_6=截面是否偏移_15,
    Panel=number_slider_42,
    A_2=number_slider_42,
    relay_2="C1_in",
    d2_2=number_slider_42,
    relay_3=list_item_119,
    relay_4="H355",
    relay_5=value_list,
    d5=vector_2pt_21.Vector,
    list_a=number_slider_42,
    relay_6=梁类型_15)

area_20 = Area(Geometry=polyline_5)  # -> Area, Centroid
area_21 = Area(Geometry=polyline_4)  # -> Area, Centroid
vector_2pt_23 = Vector2Pt(PointA=area_21.Centroid, PointB=curve_middle_8, Unitize=False)  # -> Vector, Length
vector_2pt_24 = Vector2Pt(PointA=area_20.Centroid, PointB=curve_middle_9, Unitize=False)  # -> Vector, Length
unit_z_51 = UnitZ(Factor=1)
unit_z_52 = UnitZ(Factor=1)
vector_4 = Vector(flatten(vector_2pt_24.Vector))
vector_5 = Vector(flatten(vector_2pt_23.Vector))
number_slider_43 = Slider(19, range=0..100)
number_slider_44 = Slider(18, range=0..100)
number_slider_45 = Slider(21, range=0..100)
number_slider_46 = Slider(20, range=0..100)
cluster_21 = Cluster_5(
    file_path=panel_21,
    run=button_24,
    line=line_21,
    curve=line_21,
    relay=line_21,
    bake=boolean_toggle_23,
    d1="C4",
    d2=number_slider_46,
    list_a=panel_42,
    seed=number_slider_46,
    d5=vector_4,
    list_a_2=截面名称_9,
    A=number_slider_46,
    A_2=number_slider_46,
    list_a_3=number_slider_46,
    list_a_4=梁类型_9,
    list_a_5=截面是否偏移_9)
cluster_22 = Cluster_5(
    file_path=panel_22,
    run=button_22,
    line=line_15,
    curve=line_15,
    relay=line_15,
    bake=boolean_toggle_24,
    d1="C4",
    d2=number_slider_45,
    list_a=panel_43,
    seed=number_slider_45,
    d5=vector_5,
    list_a_2=截面名称_10,
    A=number_slider_45,
    A_2=number_slider_45,
    list_a_3=number_slider_45,
    list_a_4=梁类型_10,
    list_a_5=截面是否偏移_10)
number_slider_47 = Slider(21, range=0..100)

# ---- group: 底层T
negative_41 = Negative(Value=unit_z_51)
panel_96 = Panel("D:\Study\SEASAM\sjy_struct\Ideal_Model\C4_DT.xlsx")
截面名称_31 = ValueList({"B3000_3200", "BSRAbulb200x10x28x8x8x3", "BSRAbulb200x12x28x8x8x3", "BSRAbulb320x13x46x14x14x4", "BSRAbulb340x14x49x15x15x4", "BSRAbulb370x14x54x16x16x4", "BSRAbulb400x14x58x18x18x4", "BSRAbulb400x16x58x18x18x4", "BSRAbulb430x15x62x20x20x4", "BSRAbulb430x17x62x20x20x4"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}, selected="T15_800_20_300")
longest_list_16 = LongestList(ListListA=negative_41, ListListB=merge_5, PaddingMode=2)  # -> ListListA, ListListB
截面是否偏移_33 = ValueList({"yes", "no"}, selected="yes")
梁类型_33 = ValueList({"straight", "curve"}, selected="straight")

# ---- group: 上层T
panel_97 = Panel("D:\Study\SEASAM\sjy_struct\Ideal_Model\C4_TT.xlsx")
截面名称_32 = ValueList({"B3000_3200", "BSRAbulb200x10x28x8x8x3", "BSRAbulb200x12x28x8x8x3", "BSRAbulb320x13x46x14x14x4", "BSRAbulb340x14x49x15x15x4", "BSRAbulb370x14x54x16x16x4", "BSRAbulb400x14x58x18x18x4", "BSRAbulb400x16x58x18x18x4", "BSRAbulb430x15x62x20x20x4", "BSRAbulb430x17x62x20x20x4"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}, selected="T15_800_20_300")
longest_list_17 = LongestList(ListListA=unit_z_52, ListListB=merge_10, PaddingMode=2)  # -> ListListA, ListListB
截面是否偏移_34 = ValueList({"yes", "no"}, selected="yes")
梁类型_34 = ValueList({"straight", "curve"}, selected="straight")

# ----
unit_x_17 = UnitX(Factor=1)
unit_y_10 = UnitY(Factor=1)
unit_y_11 = UnitY(Factor=1)
unit_y_12 = UnitY(Factor=1)
negative_42 = Negative(Value=unit_y_11)
negative_43 = Negative(Value=unit_x_17)
number_slider_48 = Slider(41, range=0..100)
number_slider_49 = Slider(37, range=0..100)
number_slider_50 = Slider(39, range=0..100)
number_slider_51 = Slider(40, range=0..100)
number_slider_52 = Slider(38, range=0..100)
number_slider_53 = Slider(36, range=0..100)
number_slider_54 = Slider(35, range=0..100)
number_slider_55 = Slider(33, range=0..100)
number_slider_56 = Slider(34, range=0..100)
cluster_23 = Cluster_5(
    file_path=panel_12,
    run=button_10,
    line=merge_20,
    curve=merge_20,
    relay=merge_20,
    bake=boolean_toggle_10,
    d1="BN",
    d2=number_slider_52,
    list_a=panel_29,
    seed=number_slider_52,
    d5=merge_21,
    list_a_2=截面名称_4,
    A=number_slider_52,
    A_2=number_slider_52,
    list_a_3=number_slider_52,
    list_a_4=梁类型_4,
    list_a_5=截面是否偏移_4)
cluster_24 = Cluster_5(
    file_path=panel_15,
    run=button_15,
    line=curve_9,
    curve=curve_9,
    relay=curve_9,
    bake=boolean_toggle_15,
    d1="BN",
    d2=number_slider_53,
    list_a=panel_34,
    seed=number_slider_53,
    d5=vector_2pt_10.Vector,
    list_a_2=截面名称_5,
    A=number_slider_53,
    A_2=number_slider_53,
    list_a_3=number_slider_53,
    list_a_4=梁类型_5,
    list_a_5=截面是否偏移_5)
cluster_25 = Cluster_5(
    file_path=panel_17,
    run=button_17,
    line=curve_8,
    curve=curve_8,
    relay=curve_8,
    bake=boolean_toggle_17,
    d1="BN",
    d2=number_slider_54,
    list_a=panel_36,
    seed=number_slider_54,
    d5=vector_2pt_11.Vector,
    list_a_2=截面名称_7,
    A=number_slider_54,
    A_2=number_slider_54,
    list_a_3=number_slider_54,
    list_a_4=梁类型_7,
    list_a_5=截面是否偏移_7)
cluster_26 = Cluster_9(
    file_path=panel_18,
    run=button_14,
    line=merge_49,
    curve=merge_49,
    relay=merge_49,
    bake=boolean_toggle_14,
    d1="BN",
    d2=number_slider_55,
    list_a=panel_33,
    seed=number_slider_55,
    d5=merge_50,
    list_a_2=截面名称_8,
    A=number_slider_55,
    A_2=number_slider_55,
    list_a_3=number_slider_55,
    list_a_4=梁类型_8,
    list_a_5=截面是否偏移_8)
cluster_27 = Cluster_9(
    file_path=panel_16,
    run=button_16,
    line=merge_49,
    curve=merge_49,
    relay=merge_49,
    bake=boolean_toggle_16,
    d1="BN",
    d2=number_slider_56,
    list_a=panel_35,
    seed=number_slider_56,
    d5=merge_50,
    list_a_2=截面名称_6,
    A=number_slider_56,
    A_2=number_slider_56,
    list_a_3=number_slider_56,
    list_a_4=梁类型_6,
    list_a_5=截面是否偏移_6)

# ---- group: 支撑梁
panel_98 = Panel("D:\Study\SEASAM\sjy_struct\Ideal_Model\BN_L.xlsx")
截面名称_33 = ValueList({"B3000_3200", "BSRAbulb200x10x28x8x8x3", "BSRAbulb200x12x28x8x8x3", "BSRAbulb320x13x46x14x14x4", "BSRAbulb340x14x49x15x15x4", "BSRAbulb370x14x54x16x16x4", "BSRAbulb400x14x58x18x18x4", "BSRAbulb400x16x58x18x18x4", "BSRAbulb430x15x62x20x20x4", "BSRAbulb430x17x62x20x20x4"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}, selected="P3200_30")
longest_list_18 = LongestList(ListListA=unit_y_10, ListListB=line_88, PaddingMode=2)  # -> ListListA, ListListB
截面是否偏移_35 = ValueList({"yes", "no"}, selected="no")
梁类型_35 = ValueList({"straight", "curve"}, selected="straight")

# ---- group: 前T
panel_99 = Panel("D:\Study\SEASAM\sjy_struct\Ideal_Model\BN_FT.xlsx")
截面名称_34 = ValueList({"B3000_3200", "BSRAbulb200x10x28x8x8x3", "BSRAbulb200x12x28x8x8x3", "BSRAbulb320x13x46x14x14x4", "BSRAbulb340x14x49x15x15x4", "BSRAbulb370x14x54x16x16x4", "BSRAbulb400x14x58x18x18x4", "BSRAbulb400x16x58x18x18x4", "BSRAbulb430x15x62x20x20x4", "BSRAbulb430x17x62x20x20x4"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}, selected="T15_800_20_300")
longest_list_19 = LongestList(ListListA=negative_42, ListListB=move_75.Geometry, PaddingMode=2)  # -> ListListA, ListListB
截面是否偏移_36 = ValueList({"yes", "no"}, selected="yes")
梁类型_36 = ValueList({"straight", "curve"}, selected="straight")

# ---- group: 中间层竖向
panel_100 = Panel("D:\Study\SEASAM\sjy_struct\Ideal_Model\BN_Z_SX.xlsx")
截面名称_35 = ValueList({"B3000_3200", "BSRAbulb200x10x28x8x8x3", "BSRAbulb200x12x28x8x8x3", "BSRAbulb320x13x46x14x14x4", "BSRAbulb340x14x49x15x15x4", "BSRAbulb370x14x54x16x16x4", "BSRAbulb400x14x58x18x18x4", "BSRAbulb400x16x58x18x18x4", "BSRAbulb430x15x62x20x20x4", "BSRAbulb430x17x62x20x20x4"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}, selected="BSRAbulb430x20x62x20x20x4")
longest_list_20 = LongestList(ListListA=unit_x_17, ListListB=merge_26, PaddingMode=2)  # -> ListListA, ListListB
截面是否偏移_37 = ValueList({"yes", "no"}, selected="yes")
梁类型_37 = ValueList({"straight", "curve"}, selected="straight")

# ---- group: 后T
panel_101 = Panel("D:\Study\SEASAM\sjy_struct\Ideal_Model\BN_BT.xlsx")
截面名称_36 = ValueList({"B3000_3200", "BSRAbulb200x10x28x8x8x3", "BSRAbulb200x12x28x8x8x3", "BSRAbulb320x13x46x14x14x4", "BSRAbulb340x14x49x15x15x4", "BSRAbulb370x14x54x16x16x4", "BSRAbulb400x14x58x18x18x4", "BSRAbulb400x16x58x18x18x4", "BSRAbulb430x15x62x20x20x4", "BSRAbulb430x17x62x20x20x4"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}, selected="T15_800_20_300")
longest_list_21 = LongestList(ListListA=unit_y_12, ListListB=move_76.Geometry, PaddingMode=2)  # -> ListListA, ListListB
截面是否偏移_38 = ValueList({"yes", "no"}, selected="yes")
梁类型_38 = ValueList({"straight", "curve"}, selected="straight")

# ----
cluster_28 = Cluster_5(
    file_path=panel_98,
    run=button_9,
    line=line_88,
    curve=line_88,
    relay=line_88,
    bake=boolean_toggle_9,
    d1="BN",
    d2=number_slider_48,
    list_a=panel_28,
    seed=number_slider_48,
    d5=longest_list_18.ListListA,
    list_a_2=截面名称_33,
    A=number_slider_48,
    A_2=number_slider_48,
    list_a_3=number_slider_48,
    list_a_4=梁类型_35,
    list_a_5=截面是否偏移_35)
cluster_29 = Cluster_5(
    file_path=panel_100,
    run=button_12,
    line=merge_26,
    curve=merge_26,
    relay=merge_26,
    bake=boolean_toggle_12,
    d1="BN",
    d2=number_slider_49,
    list_a=panel_31,
    seed=number_slider_49,
    d5=longest_list_20.ListListA,
    list_a_2=截面名称_35,
    A=number_slider_49,
    A_2=number_slider_49,
    list_a_3=number_slider_49,
    list_a_4=梁类型_37,
    list_a_5=截面是否偏移_37)
cluster_30 = Cluster_5(
    file_path=panel_99,
    run=button_11,
    line=move_75.Geometry,
    curve=move_75.Geometry,
    relay=move_75.Geometry,
    bake=boolean_toggle_11,
    d1="BN",
    d2=number_slider_50,
    list_a=panel_30,
    seed=number_slider_50,
    d5=longest_list_19.ListListA,
    list_a_2=截面名称_34,
    A=number_slider_50,
    A_2=number_slider_50,
    list_a_3=number_slider_50,
    list_a_4=梁类型_36,
    list_a_5=截面是否偏移_36)
cluster_31 = Cluster_5(
    file_path=panel_101,
    run=button_13,
    line=move_76.Geometry,
    curve=move_76.Geometry,
    relay=move_76.Geometry,
    bake=boolean_toggle_13,
    d1="BN",
    d2=number_slider_51,
    list_a=panel_32,
    seed=number_slider_51,
    d5=longest_list_21.ListListA,
    list_a_2=截面名称_36,
    A=number_slider_51,
    A_2=number_slider_51,
    list_a_3=number_slider_51,
    list_a_4=梁类型_38,
    list_a_5=截面是否偏移_38)

curve_middle_40 = CurveMiddle(Curve=simplify(graft(curve_34)))
list_item_121 = ListItem(List=flatten(curve_middle_40), Index=0, Wrap=True)
list_item_122 = ListItem(List=flatten(curve_middle_40), Index=1, Wrap=True)
line_96 = Line(StartPoint=list_item_121, EndPoint=list_item_122)
curve_middle_41 = CurveMiddle(Curve=line_96)
vector_2pt_25 = Vector2Pt(PointA=curve_middle_41, PointB=curve_middle_40, Unitize=False)  # -> Vector, Length
unit_z_53 = UnitZ(Factor=1)
unit_z_54 = UnitZ(Factor=1)
unit_z_55 = UnitZ(Factor=1)
unit_y_13 = UnitY(Factor=1)
unit_z_56 = UnitZ(Factor=1)
number_slider_57 = Slider(28, range=0..100)
number_slider_58 = Slider(29, range=0..100)
number_slider_59 = Slider(22, range=0..100)
number_slider_60 = Slider(26, range=0..100)
number_slider_61 = Slider(24, range=0..100)
number_slider_62 = Slider(25, range=0..100)
number_slider_63 = Slider(23, range=0..100)
number_slider_64 = Slider(27, range=0..100)
cluster_32 = Cluster_5(
    file_path=panel_83,
    run=button_35,
    line=merge_87,
    curve=merge_87,
    relay=merge_87,
    bake=boolean_toggle_35,
    d1="P1",
    d2=number_slider_57,
    list_a=panel_55,
    seed=number_slider_57,
    d5=longest_list_7.ListListA,
    list_a_2=截面名称_22,
    A=number_slider_57,
    A_2=number_slider_57,
    list_a_3=number_slider_57,
    list_a_4=梁类型_24,
    list_a_5=截面是否偏移_24)
cluster_33 = Cluster_5(
    file_path=panel_82,
    run=button_33,
    line=merge_88,
    curve=merge_88,
    relay=merge_88,
    bake=boolean_toggle_33,
    d1="P1",
    d2=number_slider_58,
    list_a=panel_53,
    seed=number_slider_58,
    d5=longest_list_6.ListListA,
    list_a_2=截面名称_21,
    A=number_slider_58,
    A_2=number_slider_58,
    list_a_3=number_slider_58,
    list_a_4=梁类型_23,
    list_a_5=截面是否偏移_23)
cluster_34 = Cluster_5(
    file_path=panel_52,
    run=button_39,
    line=curve_34,
    curve=curve_34,
    relay=curve_34,
    bake=boolean_toggle_39,
    d1="P1",
    d2=number_slider_60,
    list_a=panel_59,
    seed=number_slider_60,
    d5=vector_2pt_25.Vector,
    list_a_2=截面名称_14,
    A=number_slider_60,
    A_2=number_slider_60,
    list_a_3=number_slider_60,
    list_a_4=梁类型_14,
    list_a_5=截面是否偏移_14)
area_22 = Area(Geometry=curve_37)  # -> Area, graft(Centroid)
explode_19 = Explode(Curve=simplify(graft(curve_37)), Recursive=True)  # -> Segments, Vertices
dispatch_3 = Dispatch(List=explode_19.Segments, DispatchPattern=[True, False])  # -> ListA, ListB
curve_39 = Curve(dispatch_3.ListB)
curve_40 = Curve(dispatch_3.ListA)
end_points_30 = EndPoints(Curve=curve_39)  # -> Start, End
curve_middle_42 = CurveMiddle(Curve=curve_39)
vector_2pt_26 = Vector2Pt(PointA=area_22.Centroid, PointB=curve_middle_42, Unitize=False)  # -> flatten(Vector), Length
curve_41 = Curve(flatten(curve_39))
curve_middle_43 = CurveMiddle(Curve=curve_40)
curve_42 = Curve(flatten(curve_40))
vector_2pt_27 = Vector2Pt(PointA=area_22.Centroid, PointB=curve_middle_43, Unitize=False)  # -> flatten(Vector), Length
explode_20 = Explode(Curve=curve_42, Recursive=True)  # -> flatten(Segments), Vertices
line_97 = Line(explode_20.Segments)
截面名称_37 = ValueList({"B3000_3200", "BSRAbulb200x10x28x8x8x3", "BSRAbulb200x12x28x8x8x3", "BSRAbulb320x13x46x14x14x4", "BSRAbulb340x14x49x15x15x4", "BSRAbulb370x14x54x16x16x4", "BSRAbulb400x14x58x18x18x4", "BSRAbulb400x16x58x18x18x4", "BSRAbulb430x15x62x20x20x4", "BSRAbulb430x17x62x20x20x4"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}, selected="T15_700_20_300")
number_slider_65 = Slider(31, range=0..100)
number_slider_66 = Slider(30, range=0..100)
cluster_35 = Cluster_10(
    file_path=panel_62,
    run=button_44,
    line=line_97,
    curve=line_97,
    relay=line_97,
    bake=boolean_toggle_43,
    d1="P1",
    d2=number_slider_65,
    list_a=panel_66,
    seed=number_slider_65,
    d5=vector_2pt_27.Vector,
    list_a_2=截面名称_15,
    A=number_slider_65,
    A_2=number_slider_65,
    list_a_3=number_slider_65,
    list_a_4=梁类型_16,
    list_a_5=截面是否偏移_16)
cluster_36 = Cluster_8(
    file_path=panel_63,
    run=button_43,
    relay_4=panel_65,
    bake=boolean_toggle_44,
    d1="P1",
    d2_2=number_slider_66,
    list_a=panel_64,
    d5=vector_2pt_26.Vector,
    list_a_2=number_slider_66,
    seed=number_slider_66,
    list_a_3=梁类型_17,
    relay_2=curve_41,
    A=number_slider_66,
    list_a_4=截面是否偏移_17,
    A_2=number_slider_66,
    Panel=number_slider_66,
    relay_3="P1",
    d2=number_slider_66,
    relay=截面名称_37)

# ---- group: 顶层T
negative_44 = Negative(Value=unit_z_54)
panel_102 = Panel("D:\Study\SEASAM\sjy_struct\Ideal_Model\P1_TT.xlsx")
截面名称_38 = ValueList({"B3000_3200", "BSRAbulb200x10x28x8x8x3", "BSRAbulb200x12x28x8x8x3", "BSRAbulb320x13x46x14x14x4", "BSRAbulb340x14x49x15x15x4", "BSRAbulb370x14x54x16x16x4", "BSRAbulb400x14x58x18x18x4", "BSRAbulb400x16x58x18x18x4", "BSRAbulb430x15x62x20x20x4", "BSRAbulb430x17x62x20x20x4"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}, selected="T15_700_20_300")
longest_list_22 = LongestList(ListListA=unit_z_54, ListListB=curve_31, PaddingMode=2)  # -> ListListA, ListListB
截面是否偏移_39 = ValueList({"yes", "no"}, selected="yes")
梁类型_39 = ValueList({"straight", "curve"}, selected="straight")

# ---- group: 竖向圆管
panel_103 = Panel("D:\Study\SEASAM\sjy_struct\Ideal_Model\P1_SX_Circle.xlsx")
截面名称_39 = ValueList({"B3000_3200", "BSRAbulb200x10x28x8x8x3", "BSRAbulb200x12x28x8x8x3", "BSRAbulb320x13x46x14x14x4", "BSRAbulb340x14x49x15x15x4", "BSRAbulb370x14x54x16x16x4", "BSRAbulb400x14x58x18x18x4", "BSRAbulb400x16x58x18x18x4", "BSRAbulb430x15x62x20x20x4", "BSRAbulb430x17x62x20x20x4"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}, selected="P325")
longest_list_23 = LongestList(ListListA=unit_y_13, ListListB=line_90, PaddingMode=2)  # -> ListListA, ListListB
截面是否偏移_40 = ValueList({"yes", "no"}, selected="no")
梁类型_40 = ValueList({"straight", "curve"}, selected="straight")

# ---- group: 底层T
negative_45 = Negative(Value=unit_z_55)
panel_104 = Panel("D:\Study\SEASAM\sjy_struct\Ideal_Model\P1_DT.xlsx")
截面名称_40 = ValueList({"B3000_3200", "BSRAbulb200x10x28x8x8x3", "BSRAbulb200x12x28x8x8x3", "BSRAbulb320x13x46x14x14x4", "BSRAbulb340x14x49x15x15x4", "BSRAbulb370x14x54x16x16x4", "BSRAbulb400x14x58x18x18x4", "BSRAbulb400x16x58x18x18x4", "BSRAbulb430x15x62x20x20x4", "BSRAbulb430x17x62x20x20x4"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}, selected="Dum_PT")
longest_list_24 = LongestList(ListListA=negative_45, ListListB=curve_30, PaddingMode=2)  # -> ListListA, ListListB
截面是否偏移_41 = ValueList({"yes", "no"}, selected="yes")
梁类型_41 = ValueList({"straight", "curve"}, selected="straight")

# ---- group: 底层次T
negative_46 = Negative(Value=unit_z_56)
panel_105 = Panel("D:\Study\SEASAM\sjy_struct\Ideal_Model\P1_DCT.xlsx")
截面名称_41 = ValueList({"B3000_3200", "BSRAbulb200x10x28x8x8x3", "BSRAbulb200x12x28x8x8x3", "BSRAbulb320x13x46x14x14x4", "BSRAbulb340x14x49x15x15x4", "BSRAbulb370x14x54x16x16x4", "BSRAbulb400x14x58x18x18x4", "BSRAbulb400x16x58x18x18x4", "BSRAbulb430x15x62x20x20x4", "BSRAbulb430x17x62x20x20x4"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}, selected="BSRAbulb430x20x62x20x20x4")
longest_list_25 = LongestList(ListListA=negative_46, ListListB=curve_32, PaddingMode=2)  # -> ListListA, ListListB
截面是否偏移_42 = ValueList({"yes", "no"}, selected="yes")
梁类型_42 = ValueList({"straight", "curve"}, selected="straight")

# ---- group: 顶层T
panel_106 = Panel("D:\Study\SEASAM\sjy_struct\Ideal_Model\P1_TCT.xlsx")
negative_47 = Negative(Value=unit_z_53)
截面名称_42 = ValueList({"B3000_3200", "BSRAbulb200x10x28x8x8x3", "BSRAbulb200x12x28x8x8x3", "BSRAbulb320x13x46x14x14x4", "BSRAbulb340x14x49x15x15x4", "BSRAbulb370x14x54x16x16x4", "BSRAbulb400x14x58x18x18x4", "BSRAbulb400x16x58x18x18x4", "BSRAbulb430x15x62x20x20x4", "BSRAbulb430x17x62x20x20x4"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}, selected="BSRAbulb430x20x62x20x20x4")
longest_list_26 = LongestList(ListListA=unit_z_53, ListListB=curve_33, PaddingMode=2)  # -> ListListA, ListListB
截面是否偏移_43 = ValueList({"yes", "no"}, selected="yes")
梁类型_43 = ValueList({"straight", "curve"}, selected="straight")

# ----
cluster_37 = Cluster_5(
    file_path=panel_105,
    run=button_40,
    line=curve_32,
    curve=curve_32,
    relay=curve_32,
    bake=boolean_toggle_40,
    d1="P1",
    d2=number_slider_62,
    list_a=panel_60,
    seed=number_slider_62,
    d5=longest_list_25.ListListA,
    list_a_2=截面名称_41,
    A=number_slider_62,
    A_2=number_slider_62,
    list_a_3=number_slider_62,
    list_a_4=梁类型_42,
    list_a_5=截面是否偏移_42)
cluster_38 = Cluster_5(
    file_path=panel_103,
    run=button_34,
    line=line_90,
    curve=line_90,
    relay=line_90,
    bake=boolean_toggle_34,
    d1="P1",
    d2=number_slider_64,
    list_a=panel_54,
    seed=number_slider_64,
    d5=longest_list_23.ListListA,
    list_a_2=截面名称_39,
    A=number_slider_64,
    A_2=number_slider_64,
    list_a_3=number_slider_64,
    list_a_4=梁类型_40,
    list_a_5=截面是否偏移_40)
cluster_39 = Cluster_5(
    file_path=panel_102,
    run=button_36,
    line=curve_31,
    curve=curve_31,
    relay=curve_31,
    bake=boolean_toggle_36,
    d1="P1",
    d2=number_slider_59,
    list_a=panel_56,
    seed=number_slider_59,
    d5=longest_list_22.ListListA,
    list_a_2=截面名称_38,
    A=number_slider_59,
    A_2=number_slider_59,
    list_a_3=number_slider_59,
    list_a_4=梁类型_39,
    list_a_5=截面是否偏移_39)
cluster_40 = Cluster_5(
    file_path=panel_104,
    run=button_37,
    line=curve_30,
    curve=curve_30,
    relay=curve_30,
    bake=boolean_toggle_37,
    d1="P1",
    d2=number_slider_63,
    list_a=panel_57,
    seed=number_slider_63,
    d5=longest_list_24.ListListA,
    list_a_2=截面名称_40,
    A=number_slider_63,
    A_2=number_slider_63,
    list_a_3=number_slider_63,
    list_a_4=梁类型_41,
    list_a_5=截面是否偏移_41)
cluster_41 = Cluster_5(
    file_path=panel_106,
    run=button_38,
    line=curve_33,
    curve=curve_33,
    relay=curve_33,
    bake=boolean_toggle_38,
    d1="P1",
    d2=number_slider_61,
    list_a=panel_58,
    seed=number_slider_61,
    d5=longest_list_26.ListListA,
    list_a_2=截面名称_42,
    A=number_slider_61,
    A_2=number_slider_61,
    list_a_3=number_slider_61,
    list_a_4=梁类型_43,
    list_a_5=截面是否偏移_43)

cluster_42 = Cluster_5(
    file_path=panel_96,
    run=button_18,
    line=merge_5,
    curve=merge_5,
    relay=merge_5,
    bake=boolean_toggle_18,
    d1="C4",
    d2=number_slider_44,
    list_a=panel_37,
    seed=number_slider_44,
    d5=longest_list_16.ListListA,
    list_a_2=截面名称_31,
    A=number_slider_44,
    A_2=number_slider_44,
    list_a_3=number_slider_44,
    list_a_4=梁类型_33,
    list_a_5=截面是否偏移_33)
cluster_43 = Cluster_5(
    file_path=panel_97,
    run=button_19,
    line=merge_10,
    curve=merge_10,
    relay=merge_10,
    bake=boolean_toggle_19,
    d1="C4",
    d2=number_slider_43,
    list_a=panel_38,
    seed=number_slider_43,
    d5=longest_list_17.ListListA,
    list_a_2=截面名称_32,
    A=number_slider_43,
    A_2=number_slider_43,
    list_a_3=number_slider_43,
    list_a_4=梁类型_34,
    list_a_5=截面是否偏移_34)

# ---- group: C1_circle
divide_curve_19 = DivideCurve(Curve=merge_4, Count="2", Kinks=False)  # -> Points, Tangents, Parameters
shatter_7 = Shatter(Curve=graft(merge_4), Parameters=divide_curve_19.Parameters)
area_23 = Area(Geometry=merge_4)  # -> Area, Centroid
value_list_2 = ValueList({"FB300_20", "HPbulb280x12x40x12x12", "HPbulb300x12x43x13x13", "HPbulb340x12x49x15x15", "HPbulb370x13x54x16x16", "T15_800_20_300", "T15_300_20_150"}, selected="T15_800_20_300")
panel_107 = Panel("D:\Study\SEASAM\sjy_struct\Ideal_Model\C4_circle.xlsx")
截面是否偏移_44 = ValueList({"yes", "no"}, selected="yes")
梁类型_44 = ValueList({"straight", "curve"}, selected="curve")
panel_108 = Panel("C4")
panel_109 = Panel("""Set
Location_start
Location_mid
Location_end
Z_vector
Material_name
Section_name
Timestamp
Beam_type
Is_offset""")
panel_110 = Panel("H355")

# ---- group: C1_circle / 下
list_item_123 = ListItem(List=shatter_7, Index=1, Wrap=True)

# ---- group: C1_circle / 上
list_item_124 = ListItem(List=shatter_7, Index=0, Wrap=True)  # -> simplify(Item)

# ---- group: C1_circle (continued)
curve_middle_44 = CurveMiddle(Curve=list_item_123)  # -> flatten(Midpoint)
curve_middle_45 = CurveMiddle(Curve=list_item_124)  # -> flatten(Midpoint)
vector_2pt_28 = Vector2Pt(PointA=area_23.Centroid, PointB=curve_middle_44, Unitize=False)  # -> graft(Vector), Length
vector_2pt_29 = Vector2Pt(PointA=area_23.Centroid, PointB=curve_middle_45, Unitize=False)  # -> graft(Vector), Length

# ----
cluster_44 = Cluster_6(
    file_path=panel_107,
    run=button_41,
    relay_7=panel_109,
    bake=boolean_toggle_41,
    d1=panel_108,
    d2=number_slider_47,
    list_a_2=panel_110,
    d5_2=vector_2pt_29.Vector,
    list_a_3=value_list_2,
    list_a_4=number_slider_47,
    seed=number_slider_47,
    relay_2=list_item_124,
    list_a_5=梁类型_44,
    A=number_slider_47,
    list_a_6=截面是否偏移_44,
    Panel=number_slider_47,
    A_2=number_slider_47,
    relay=panel_108,
    relay_3=list_item_123,
    relay_4=panel_110,
    relay_5=value_list_2,
    d5=vector_2pt_28.Vector,
    list_a=number_slider_47,
    relay_6=梁类型_44)

# ==== cluster Cluster_2
d1 = ClusterInput()
d2 = ClusterInput()
merge = Merge(Data1=d1, Data2=d2)
seed = ClusterInput()
A = ClusterInput()
A_2 = ClusterInput()
text_join = TextJoin(Text=merge)
relay = ClusterInput()
cluster = Cluster(seed=seed, A=A, A_2=A_2)  # -> random_2, random_4, random_6

# ---- group: 随机颜色
colour_rgb = ColourRGB(Alpha=255, Red=cluster.random_2, Green=cluster.random_4, Blue=cluster.random_6)

# ----
curve = ClusterInput()
line = ClusterInput()
end_points = EndPoints(Curve=curve)  # -> Start, End
line_2 = Line(simplify(graft(line)))
list_a = ClusterInput()
list_a_2 = ClusterInput()
list_a_3 = ClusterInput()
list_a_4 = ClusterInput()
list_a_5 = ClusterInput()
longest_list = LongestList(ListListA=list_a, ListListB=relay, PaddingMode=2)  # -> ListListA, ListListB
longest_list_2 = LongestList(ListListA=list_a_2, ListListB=relay, PaddingMode=2)  # -> ListListA, ListListB
longest_list_3 = LongestList(ListListA=list_a_3, ListListB=relay, PaddingMode=2)  # -> ListListA, ListListB
longest_list_4 = LongestList(ListListA=list_a_4, ListListB=relay, PaddingMode=2)  # -> ListListA, ListListB
longest_list_5 = LongestList(ListListA=list_a_5, ListListB=relay, PaddingMode=2)  # -> ListListA, ListListB
longest_list_6 = LongestList(ListListA="null", ListListB=relay, PaddingMode=2)  # -> ListListA, ListListB
longest_list_7 = LongestList(ListListA=text_join, ListListB=relay, PaddingMode=2)  # -> ListListA, ListListB
d5 = ClusterInput()
merge_2 = Merge(
    Data1=simplify(graft(longest_list_7.ListListA)),
    Data2=simplify(graft(end_points.Start)),
    Data3=simplify(graft(longest_list_6.ListListA)),
    Data4=simplify(graft(end_points.End)),
    Data5=simplify(graft(d5)),
    Data6=simplify(graft(longest_list.ListListA)),
    Data7=simplify(graft(longest_list_2.ListListA)),
    Data8=simplify(graft(longest_list_3.ListListA)),
    Data9=simplify(graft(longest_list_4.ListListA)),
    Data10=simplify(graft(longest_list_5.ListListA)))  # -> simplify(Result)
user_keys = ClusterInput()
file_path = ClusterInput()
define_object_attributes = DefineObjectAttributes(UserKeys=user_keys, UserValues=merge_2, Layer=text_join, Color=colour_rgb)
write_options = WriteOptions(
    FilePath=file_path,
    ClearDataOverwrite=True,
    SaveAfterWrite=False,
    CloseAfterWrite=False,
    ColumnStartPosition=1,
    RowStartPosition=1)  # -> UserMessages, WriteOptions
flip_matrix = FlipMatrix(Data=merge_2)
bake = ClusterInput()
bake_objects = BakeObjects(Geometry=line_2, Attributes=define_object_attributes, Bake=bake)
run = ClusterInput()
column_names = ClusterInput()
write_to_excel = WriteToExcel(
    Run=run,
    ExcelWorksheet="1",
    ColumnNames=column_names,
    WriteOptions=write_options.WriteOptions,
    ColumnnsOrRows=Toggle(False),
    DataToWriteIntoColumns=flip_matrix)

# ==== cluster Cluster_3
d1 = ClusterInput()
d2 = ClusterInput()
merge = Merge(Data1=d1, Data2=d2)
seed = ClusterInput()
A = ClusterInput()
A_2 = ClusterInput()
relay = ClusterInput()
cluster = Cluster(seed=seed, A=A, A_2=A_2)  # -> random_2, random_4, random_6
text_join = TextJoin(Text=merge)

# ---- group: 随机颜色
colour_rgb = ColourRGB(Alpha=255, Red=cluster.random_2, Green=cluster.random_4, Blue=cluster.random_6)

# ----
curve = ClusterInput()
line = ClusterInput()
end_points = EndPoints(Curve=curve)  # -> Start, End
line_2 = Line(simplify(graft(line)))
list_a = ClusterInput()
list_a_2 = ClusterInput()
list_a_3 = ClusterInput()
list_a_4 = ClusterInput()
list_a_5 = ClusterInput()
longest_list = LongestList(ListListA=list_a, ListListB=relay, PaddingMode=2)  # -> ListListA, ListListB
longest_list_2 = LongestList(ListListA=list_a_2, ListListB=relay, PaddingMode=2)  # -> ListListA, ListListB
longest_list_3 = LongestList(ListListA=list_a_3, ListListB=relay, PaddingMode=2)  # -> ListListA, ListListB
longest_list_4 = LongestList(ListListA=list_a_4, ListListB=relay, PaddingMode=2)  # -> ListListA, ListListB
longest_list_5 = LongestList(ListListA=list_a_5, ListListB=relay, PaddingMode=2)  # -> ListListA, ListListB
longest_list_6 = LongestList(ListListA="null", ListListB=relay, PaddingMode=2)  # -> ListListA, ListListB
longest_list_7 = LongestList(ListListA=text_join, ListListB=relay, PaddingMode=2)  # -> ListListA, ListListB
d5 = ClusterInput()
merge_2 = Merge(
    Data1=simplify(graft(longest_list_7.ListListA)),
    Data2=simplify(graft(end_points.Start)),
    Data3=simplify(graft(longest_list_6.ListListA)),
    Data4=simplify(graft(end_points.End)),
    Data5=simplify(graft(d5)),
    Data6=simplify(graft(longest_list.ListListA)),
    Data7=simplify(graft(longest_list_2.ListListA)),
    Data8=simplify(graft(longest_list_3.ListListA)),
    Data9=simplify(graft(longest_list_4.ListListA)),
    Data10=simplify(graft(longest_list_5.ListListA)))  # -> simplify(Result)
user_keys = ClusterInput()
file_path = ClusterInput()
define_object_attributes = DefineObjectAttributes(UserKeys=user_keys, UserValues=merge_2, Layer=text_join, Color=colour_rgb)
write_options = WriteOptions(
    FilePath=file_path,
    ClearDataOverwrite=True,
    SaveAfterWrite=False,
    CloseAfterWrite=False,
    ColumnStartPosition=1,
    RowStartPosition=1)  # -> UserMessages, WriteOptions
flip_matrix = FlipMatrix(Data=merge_2)
bake = ClusterInput()
bake_objects = BakeObjects(Geometry=line_2, Attributes=define_object_attributes, Bake=bake)
run = ClusterInput()
column_names = ClusterInput()
write_to_excel = WriteToExcel(
    Run=run,
    ExcelWorksheet="1",
    ColumnNames=column_names,
    WriteOptions=write_options.WriteOptions,
    ColumnnsOrRows=Toggle(False),
    DataToWriteIntoColumns=flip_matrix)

# ==== cluster Cluster_4
d1 = ClusterInput()
d2 = ClusterInput()
merge = Merge(Data1=d1, Data2=d2)
seed = ClusterInput()
A = ClusterInput()
A_2 = ClusterInput()
text_join = TextJoin(Text=merge)
relay = ClusterInput()
cluster = Cluster(seed=seed, A=A, A_2=A_2)  # -> random_2, random_4, random_6

# ---- group: 随机颜色
colour_rgb = ColourRGB(Alpha=255, Red=cluster.random_2, Green=cluster.random_4, Blue=cluster.random_6)

# ----
curve = ClusterInput()
line = ClusterInput()
end_points = EndPoints(Curve=curve)  # -> Start, End
line_2 = Line(simplify(graft(line)))
list_a = ClusterInput()
list_a_2 = ClusterInput()
list_a_3 = ClusterInput()
list_a_4 = ClusterInput()
list_a_5 = ClusterInput()
longest_list = LongestList(ListListA=list_a, ListListB=relay, PaddingMode=2)  # -> ListListA, ListListB
longest_list_2 = LongestList(ListListA=list_a_2, ListListB=relay, PaddingMode=2)  # -> ListListA, ListListB
longest_list_3 = LongestList(ListListA=list_a_3, ListListB=relay, PaddingMode=2)  # -> ListListA, ListListB
longest_list_4 = LongestList(ListListA=list_a_4, ListListB=relay, PaddingMode=2)  # -> ListListA, ListListB
longest_list_5 = LongestList(ListListA=list_a_5, ListListB=relay, PaddingMode=2)  # -> ListListA, ListListB
longest_list_6 = LongestList(ListListA="null", ListListB=relay, PaddingMode=2)  # -> ListListA, ListListB
longest_list_7 = LongestList(ListListA=text_join, ListListB=relay, PaddingMode=2)  # -> ListListA, ListListB
d5 = ClusterInput()
merge_2 = Merge(
    Data1=simplify(graft(longest_list_7.ListListA)),
    Data2=simplify(graft(end_points.Start)),
    Data3=simplify(graft(longest_list_6.ListListA)),
    Data4=simplify(graft(end_points.End)),
    Data5=simplify(graft(d5)),
    Data6=simplify(graft(longest_list.ListListA)),
    Data7=simplify(graft(longest_list_2.ListListA)),
    Data8=simplify(graft(longest_list_3.ListListA)),
    Data9=simplify(graft(longest_list_4.ListListA)),
    Data10=simplify(graft(longest_list_5.ListListA)))  # -> simplify(Result)
user_keys = ClusterInput()
file_path = ClusterInput()
define_object_attributes = DefineObjectAttributes(UserKeys=user_keys, UserValues=merge_2, Layer=text_join, Color=colour_rgb)
flip_matrix = FlipMatrix(Data=merge_2)
bake = ClusterInput()
bake_objects = BakeObjects(Geometry=line_2, Attributes=define_object_attributes, Bake=bake)
run = ClusterInput()
column_names = ClusterInput()
write_options = WriteOptions(
    FilePath=file_path,
    ClearDataOverwrite=True,
    SaveAfterWrite=False,
    CloseAfterWrite=False,
    ColumnStartPosition=1,
    RowStartPosition=1)  # -> UserMessages, WriteOptions
write_to_excel = WriteToExcel(
    Run=run,
    ExcelWorksheet="1",
    ColumnNames=column_names,
    WriteOptions=write_options.WriteOptions,
    ColumnnsOrRows=Toggle(False),
    DataToWriteIntoColumns=flip_matrix)

# ==== cluster Cluster_5
d1 = ClusterInput()
d2 = ClusterInput()
merge = Merge(Data1=d1, Data2=d2)
seed = ClusterInput()
A = ClusterInput()
A_2 = ClusterInput()
text_join = TextJoin(Text=merge)
relay = ClusterInput()
cluster = Cluster(seed=seed, A=A, A_2=A_2)  # -> random_2, random_4, random_6

# ---- group: 随机颜色
colour_rgb = ColourRGB(Alpha=255, Red=cluster.random_2, Green=cluster.random_4, Blue=cluster.random_6)

# ----
curve = ClusterInput()
line = ClusterInput()
end_points = EndPoints(Curve=curve)  # -> Start, End
line_2 = Line(simplify(graft(line)))
panel = Panel("""Set
Location_start
Location_mid
Location_end
Z_vector
Material_name
Section_name
Timestamp
Beam_type
Is_offset""")
list_a = ClusterInput()
list_a_2 = ClusterInput()
list_a_3 = ClusterInput()
list_a_4 = ClusterInput()
list_a_5 = ClusterInput()
longest_list = LongestList(ListListA=list_a, ListListB=relay, PaddingMode=2)  # -> ListListA, ListListB
longest_list_2 = LongestList(ListListA=list_a_2, ListListB=relay, PaddingMode=2)  # -> ListListA, ListListB
longest_list_3 = LongestList(ListListA=list_a_3, ListListB=relay, PaddingMode=2)  # -> ListListA, ListListB
longest_list_4 = LongestList(ListListA=list_a_4, ListListB=relay, PaddingMode=2)  # -> ListListA, ListListB
longest_list_5 = LongestList(ListListA=list_a_5, ListListB=relay, PaddingMode=2)  # -> ListListA, ListListB
longest_list_6 = LongestList(ListListA="null", ListListB=relay, PaddingMode=2)  # -> ListListA, ListListB
longest_list_7 = LongestList(ListListA=text_join, ListListB=relay, PaddingMode=2)  # -> ListListA, ListListB
d5 = ClusterInput()
merge_2 = Merge(
    Data1=simplify(graft(longest_list_7.ListListA)),
    Data2=simplify(graft(end_points.Start)),
    Data3=simplify(graft(longest_list_6.ListListA)),
    Data4=simplify(graft(end_points.End)),
    Data5=simplify(graft(d5)),
    Data6=simplify(graft(longest_list.ListListA)),
    Data7=simplify(graft(longest_list_2.ListListA)),
    Data8=simplify(graft(longest_list_3.ListListA)),
    Data9=simplify(graft(longest_list_4.ListListA)),
    Data10=simplify(graft(longest_list_5.ListListA)))  # -> simplify(Result)
file_path = ClusterInput()
define_object_attributes = DefineObjectAttributes(UserKeys=panel, UserValues=merge_2, Layer=text_join, Color=colour_rgb)
write_options = WriteOptions(
    FilePath=file_path,
    ClearDataOverwrite=True,
    SaveAfterWrite=False,
    CloseAfterWrite=False,
    ColumnStartPosition=1,
    RowStartPosition=1)  # -> UserMessages, WriteOptions
flip_matrix = FlipMatrix(Data=merge_2)
bake = ClusterInput()
bake_objects = BakeObjects(Geometry=line_2, Attributes=define_object_attributes, Bake=bake)
run = ClusterInput()
write_to_excel = WriteToExcel(
    Run=run,
    ExcelWorksheet="1",
    ColumnNames=panel,
    WriteOptions=write_options.WriteOptions,
    ColumnnsOrRows=Toggle(False),
    DataToWriteIntoColumns=flip_matrix)

# ==== cluster Cluster_6
relay = ClusterInput()
relay_2 = ClusterInput()
relay_3 = ClusterInput()
construct_domain = ConstructDomain(DomainStart=Slider(0, range=0..100), DomainEnd=Slider(255, range=0..1000))
seed = ClusterInput()
number_slider = Slider(100, range=0..100)
random = Random(Range=construct_domain, Number=1, Seed=seed)
relay_4 = ClusterInput()
A = ClusterInput()
d1 = ClusterInput()
d2 = ClusterInput()
A_2 = ClusterInput()
relay_5 = ClusterInput()
end_points = EndPoints(Curve=relay_3)  # -> Start, End
relay_6 = ClusterInput()
addition = Addition(A=A, B=number_slider)
random_2 = Random(Range=construct_domain, Number=1, Seed=addition)
merge = Merge(Data1=d1, Data2=d2)
subtraction = Subtraction(A=A_2, B=number_slider)
random_3 = Random(Range=construct_domain, Number=1, Seed=subtraction)
colour_rgb = ColourRGB(Alpha=255, Red=random, Green=random_2, Blue=random_3)
截面是否偏移 = ValueList({"yes", "no"}, selected="yes")
panel = Panel(ClusterInput())
curve = Curve(relay_3)
text_join = TextJoin(Text=merge)
list_a = ClusterInput()
longest_list = LongestList(ListListA=relay_4, ListListB=relay_3, PaddingMode=2)  # -> ListListA, ListListB
end_points_2 = EndPoints(Curve=relay_2)  # -> Start, End
longest_list_2 = LongestList(ListListA=text_join, ListListB=relay_3, PaddingMode=2)  # -> ListListA, ListListB
curve_2 = Curve(relay_2)
list_a_2 = ClusterInput()
longest_list_3 = LongestList(ListListA=relay_5, ListListB=relay_3, PaddingMode=2)  # -> ListListA, ListListB
longest_list_4 = LongestList(ListListA=list_a, ListListB=relay_3, PaddingMode=2)  # -> ListListA, ListListB
curve_middle = CurveMiddle(Curve=relay_3)
longest_list_5 = LongestList(ListListA=relay_6, ListListB=relay_3, PaddingMode=2)  # -> ListListA, ListListB
longest_list_6 = LongestList(ListListA=截面是否偏移, ListListB=relay_2, PaddingMode=2)  # -> ListListA, ListListB
list_a_3 = ClusterInput()
list_a_4 = ClusterInput()
list_a_5 = ClusterInput()
list_a_6 = ClusterInput()
longest_list_7 = LongestList(ListListA=list_a_2, ListListB=relay_2, PaddingMode=2)  # -> ListListA, ListListB
d5 = ClusterInput()
longest_list_8 = LongestList(ListListA=text_join, ListListB=relay_2, PaddingMode=2)  # -> ListListA, ListListB
longest_list_9 = LongestList(ListListA=list_a_3, ListListB=relay_2, PaddingMode=2)  # -> ListListA, ListListB
longest_list_10 = LongestList(ListListA=list_a_4, ListListB=relay_2, PaddingMode=2)  # -> ListListA, ListListB
curve_middle_2 = CurveMiddle(Curve=relay_2)
longest_list_11 = LongestList(ListListA=list_a_5, ListListB=relay_2, PaddingMode=2)  # -> ListListA, ListListB
longest_list_12 = LongestList(ListListA=list_a_6, ListListB=relay_2, PaddingMode=2)  # -> ListListA, ListListB
merge_2 = Merge(
    Data1=simplify(graft(longest_list_2.ListListA)),
    Data2=simplify(graft(end_points.Start)),
    Data3=simplify(graft(curve_middle)),
    Data4=simplify(graft(end_points.End)),
    Data5=simplify(graft(d5)),
    Data6=simplify(graft(longest_list.ListListA)),
    Data7=simplify(graft(longest_list_3.ListListA)),
    Data8=simplify(graft(longest_list_4.ListListA)),
    Data9=simplify(graft(longest_list_5.ListListA)),
    Data10=simplify(graft(longest_list_6.ListListA)))  # -> simplify(Result)
d5_2 = ClusterInput()
merge_3 = Merge(
    Data1=simplify(graft(longest_list_8.ListListA)),
    Data2=simplify(graft(end_points_2.Start)),
    Data3=simplify(graft(curve_middle_2)),
    Data4=simplify(graft(end_points_2.End)),
    Data5=simplify(graft(d5_2)),
    Data6=simplify(graft(longest_list_7.ListListA)),
    Data7=simplify(graft(longest_list_9.ListListA)),
    Data8=simplify(graft(longest_list_10.ListListA)),
    Data9=simplify(graft(longest_list_11.ListListA)),
    Data10=simplify(graft(longest_list_12.ListListA)))  # -> simplify(Result)
flip_matrix = FlipMatrix(Data=merge_2)
relay_7 = ClusterInput()
entwine = Entwine(Branch0X=merge_3, Branch1X=merge_2, FlattenInputs=False)  # -> simplify(Result)
entwine_2 = Entwine(Branch0X=curve_2, Branch1X=curve, FlattenInputs=False)  # -> simplify(Result)
file_path = ClusterInput()
define_object_attributes = DefineObjectAttributes(UserKeys=relay_7, UserValues=entwine, Layer=relay, Color=colour_rgb)
write_options = WriteOptions(
    FilePath=file_path,
    ClearDataOverwrite=True,
    SaveAfterWrite=False,
    CloseAfterWrite=False,
    ColumnStartPosition=1,
    RowStartPosition=1)  # -> UserMessages, WriteOptions
flip_matrix_2 = FlipMatrix(Data=merge_3)
bake = ClusterInput()
bake_objects = BakeObjects(Geometry=entwine_2, Attributes=define_object_attributes, Bake=bake)
merge_4 = Merge(Data1=flip_matrix_2, Data2=flip_matrix)
run = ClusterInput()
write_to_excel = WriteToExcel(
    Run=run,
    ExcelWorksheet="1",
    ColumnNames=relay_7,
    WriteOptions=write_options.WriteOptions,
    ColumnnsOrRows=Toggle(False),
    DataToWriteIntoColumns=merge_4)

# ==== cluster Cluster_7
relay = ClusterInput()
relay_2 = ClusterInput()
construct_domain = ConstructDomain(DomainStart=Slider(0, range=0..100), DomainEnd=Slider(255, range=0..1000))
seed = ClusterInput()
number_slider = Slider(100, range=0..100)
random = Random(Range=construct_domain, Number=1, Seed=seed)
A = ClusterInput()
d1 = ClusterInput()
d2 = ClusterInput()
A_2 = ClusterInput()
relay_3 = ClusterInput()
addition = Addition(A=A, B=number_slider)
random_2 = Random(Range=construct_domain, Number=1, Seed=addition)
merge = Merge(Data1=d1, Data2=d2)
subtraction = Subtraction(A=A_2, B=number_slider)
random_3 = Random(Range=construct_domain, Number=1, Seed=subtraction)
colour_rgb = ColourRGB(Alpha=255, Red=random, Green=random_2, Blue=random_3)
d2_2 = ClusterInput()
relay_4 = ClusterInput()
merge_2 = Merge(Data1=relay_2, Data2=d2_2)
relay_5 = ClusterInput()
end_points = EndPoints(Curve=relay_3)  # -> Start, End
relay_6 = ClusterInput()
text_join = TextJoin(Text=merge_2)
截面是否偏移 = ValueList({"yes", "no"}, selected="yes")
curve = Curve(relay_3)
list_a = ClusterInput()
longest_list = LongestList(ListListA=relay_4, ListListB=relay_3, PaddingMode=2)  # -> ListListA, ListListB
longest_list_2 = LongestList(ListListA=relay_5, ListListB=relay_3, PaddingMode=2)  # -> ListListA, ListListB
longest_list_3 = LongestList(ListListA=list_a, ListListB=relay_3, PaddingMode=2)  # -> ListListA, ListListB
curve_middle = CurveMiddle(Curve=relay_3)
longest_list_4 = LongestList(ListListA=relay_6, ListListB=relay_3, PaddingMode=2)  # -> ListListA, ListListB
longest_list_5 = LongestList(ListListA=截面是否偏移, ListListB=relay, PaddingMode=2)  # -> ListListA, ListListB
d5 = ClusterInput()
panel = Panel(ClusterInput())
text_join_2 = TextJoin(Text=merge)
longest_list_6 = LongestList(ListListA=text_join_2, ListListB=relay_3, PaddingMode=2)  # -> ListListA, ListListB
merge_3 = Merge(
    Data1=simplify(graft(longest_list_6.ListListA)),
    Data2=simplify(graft(end_points.Start)),
    Data3=simplify(graft(curve_middle)),
    Data4=simplify(graft(end_points.End)),
    Data5=simplify(graft(d5)),
    Data6=simplify(graft(longest_list.ListListA)),
    Data7=simplify(graft(longest_list_2.ListListA)),
    Data8=simplify(graft(longest_list_3.ListListA)),
    Data9=simplify(graft(longest_list_4.ListListA)),
    Data10=simplify(graft(longest_list_5.ListListA)))  # -> simplify(Result)
flip_matrix = FlipMatrix(Data=merge_3)
end_points_2 = EndPoints(Curve=relay)  # -> Start, End
curve_2 = Curve(relay)
list_a_2 = ClusterInput()
list_a_3 = ClusterInput()
list_a_4 = ClusterInput()
list_a_5 = ClusterInput()
list_a_6 = ClusterInput()
longest_list_7 = LongestList(ListListA=list_a_2, ListListB=relay, PaddingMode=2)  # -> ListListA, ListListB
longest_list_8 = LongestList(ListListA=text_join_2, ListListB=relay, PaddingMode=2)  # -> ListListA, ListListB
longest_list_9 = LongestList(ListListA=list_a_3, ListListB=relay, PaddingMode=2)  # -> ListListA, ListListB
longest_list_10 = LongestList(ListListA=list_a_4, ListListB=relay, PaddingMode=2)  # -> ListListA, ListListB
curve_middle_2 = CurveMiddle(Curve=relay)
longest_list_11 = LongestList(ListListA=list_a_5, ListListB=relay, PaddingMode=2)  # -> ListListA, ListListB
longest_list_12 = LongestList(ListListA=list_a_6, ListListB=relay, PaddingMode=2)  # -> ListListA, ListListB
d5_2 = ClusterInput()
merge_4 = Merge(
    Data1=simplify(graft(longest_list_8.ListListA)),
    Data2=simplify(graft(end_points_2.Start)),
    Data3=simplify(graft(curve_middle_2)),
    Data4=simplify(graft(end_points_2.End)),
    Data5=simplify(graft(d5_2)),
    Data6=simplify(graft(longest_list_7.ListListA)),
    Data7=simplify(graft(longest_list_9.ListListA)),
    Data8=simplify(graft(longest_list_10.ListListA)),
    Data9=simplify(graft(longest_list_11.ListListA)),
    Data10=simplify(graft(longest_list_12.ListListA)))  # -> simplify(Result)
relay_7 = ClusterInput()
entwine = Entwine(Branch0X=merge_4, Branch1X=merge_3, FlattenInputs=False)  # -> simplify(Result)
entwine_2 = Entwine(Branch0X=curve_2, Branch1X=curve, FlattenInputs=False)  # -> simplify(Result)
file_path = ClusterInput()
define_object_attributes = DefineObjectAttributes(UserKeys=relay_7, UserValues=entwine, Layer=text_join, Color=colour_rgb)
write_options = WriteOptions(
    FilePath=file_path,
    ClearDataOverwrite=True,
    SaveAfterWrite=False,
    CloseAfterWrite=False,
    ColumnStartPosition=1,
    RowStartPosition=1)  # -> UserMessages, WriteOptions
flip_matrix_2 = FlipMatrix(Data=merge_4)
bake = ClusterInput()
bake_objects = BakeObjects(Geometry=entwine_2, Attributes=define_object_attributes, Bake=bake)
merge_5 = Merge(Data1=flip_matrix_2, Data2=flip_matrix)
run = ClusterInput()
write_to_excel = WriteToExcel(
    Run=run,
    ExcelWorksheet="1",
    ColumnNames=relay_7,
    WriteOptions=write_options.WriteOptions,
    ColumnnsOrRows=Toggle(False),
    DataToWriteIntoColumns=merge_5)

# ==== cluster Cluster_8
relay = ClusterInput()
relay_2 = ClusterInput()
curve_middle = CurveMiddle(Curve=relay_2)
ghpython_script = GhPythonScript()  # -> out, a
# ---------- ghpython_script: Python ----------
__author__ = "Shi jiayao"
__version__ = "2024.12.11"

import rhinoscriptsyntax as rs
import time


# 获取当前时间戳，用于生成位移名片
a = int(time.time())
# ---------- end ghpython_script ----------
construct_domain = ConstructDomain(DomainStart=Slider(0, range=0..100), DomainEnd=Slider(255, range=0..1000))
relay_3 = ClusterInput()
seed = ClusterInput()
number_slider = Slider(100, range=0..100)
d2 = ClusterInput()
random = Random(Range=construct_domain, Number=1, Seed=seed)
merge = Merge(Data1=relay_3, Data2=d2)
A = ClusterInput()
d1 = ClusterInput()
d2_2 = ClusterInput()
A_2 = ClusterInput()
text_join = TextJoin(Text=merge)
addition = Addition(A=A, B=number_slider)
random_2 = Random(Range=construct_domain, Number=1, Seed=addition)
merge_2 = Merge(Data1=d1, Data2=d2_2)
subtraction = Subtraction(A=A_2, B=number_slider)
random_3 = Random(Range=construct_domain, Number=1, Seed=subtraction)
colour_rgb = ColourRGB(Alpha=255, Red=random, Green=random_2, Blue=random_3)
panel = Panel(ClusterInput())
text_join_2 = TextJoin(Text=merge_2)
end_points = EndPoints(Curve=relay_2)  # -> Start, End
curve = Curve(relay_2)
list_a = ClusterInput()
list_a_2 = ClusterInput()
list_a_3 = ClusterInput()
list_a_4 = ClusterInput()
longest_list = LongestList(ListListA=list_a, ListListB=relay_2, PaddingMode=2)  # -> ListListA, ListListB
longest_list_2 = LongestList(ListListA=text_join_2, ListListB=relay_2, PaddingMode=2)  # -> ListListA, ListListB
longest_list_3 = LongestList(ListListA=relay, ListListB=relay_2, PaddingMode=2)  # -> ListListA, ListListB
longest_list_4 = LongestList(ListListA=list_a_2, ListListB=relay_2, PaddingMode=2)  # -> ListListA, ListListB
longest_list_5 = LongestList(ListListA=list_a_3, ListListB=relay_2, PaddingMode=2)  # -> ListListA, ListListB
longest_list_6 = LongestList(ListListA=list_a_4, ListListB=relay_2, PaddingMode=2)  # -> ListListA, ListListB
d5 = ClusterInput()
merge_3 = Merge(
    Data1=simplify(graft(longest_list_2.ListListA)),
    Data2=simplify(graft(end_points.Start)),
    Data3=simplify(graft(curve_middle)),
    Data4=simplify(graft(end_points.End)),
    Data5=simplify(graft(d5)),
    Data6=simplify(graft(longest_list.ListListA)),
    Data7=simplify(graft(longest_list_3.ListListA)),
    Data8=simplify(graft(longest_list_4.ListListA)),
    Data9=simplify(graft(longest_list_5.ListListA)),
    Data10=simplify(graft(longest_list_6.ListListA)))  # -> simplify(Result)
relay_4 = ClusterInput()
entwine = Entwine(Branch0X=merge_3, FlattenInputs=False)  # -> simplify(Result)
entwine_2 = Entwine(Branch0X=curve, FlattenInputs=False)  # -> simplify(Result)
file_path = ClusterInput()
define_object_attributes = DefineObjectAttributes(UserKeys=relay_4, UserValues=entwine, Layer=text_join, Color=colour_rgb)
write_options = WriteOptions(
    FilePath=file_path,
    ClearDataOverwrite=True,
    SaveAfterWrite=False,
    CloseAfterWrite=False,
    ColumnStartPosition=1,
    RowStartPosition=1)  # -> UserMessages, WriteOptions
flip_matrix = FlipMatrix(Data=merge_3)
bake = ClusterInput()
bake_objects = BakeObjects(Geometry=entwine_2, Attributes=define_object_attributes, Bake=bake)
merge_4 = Merge(Data1=flip_matrix)
run = ClusterInput()
write_to_excel = WriteToExcel(
    Run=run,
    ExcelWorksheet="1",
    ColumnNames=relay_4,
    WriteOptions=write_options.WriteOptions,
    ColumnnsOrRows=Toggle(False),
    DataToWriteIntoColumns=merge_4)

# ==== cluster Cluster_9
d1 = ClusterInput()
d2 = ClusterInput()
ghpython_script = GhPythonScript()  # -> a; same code as ghpython_script
merge = Merge(Data1=d1, Data2=d2)
seed = ClusterInput()
A = ClusterInput()
A_2 = ClusterInput()
text_join = TextJoin(Text=merge)
relay = ClusterInput()
cluster = Cluster(seed=seed, A=A, A_2=A_2)  # -> random_2, random_4, random_6

# ---- group: 随机颜色
colour_rgb = ColourRGB(Alpha=255, Red=cluster.random_2, Green=cluster.random_4, Blue=cluster.random_6)

# ----
curve = ClusterInput()
line = ClusterInput()
end_points = EndPoints(Curve=curve)  # -> Start, End
line_2 = Line(simplify(graft(line)))
panel = Panel("""Set
Location_start
Location_mid
Location_end
Z_vector
Material_name
Section_name
Timestamp
Beam_type
Is_offset""")
list_a = ClusterInput()
list_a_2 = ClusterInput()
list_a_3 = ClusterInput()
list_a_4 = ClusterInput()
list_a_5 = ClusterInput()
longest_list = LongestList(ListListA=list_a, ListListB=relay, PaddingMode=2)  # -> ListListA, ListListB
longest_list_2 = LongestList(ListListA=list_a_2, ListListB=relay, PaddingMode=2)  # -> ListListA, ListListB
longest_list_3 = LongestList(ListListA=list_a_3, ListListB=relay, PaddingMode=2)  # -> ListListA, ListListB
longest_list_4 = LongestList(ListListA=list_a_4, ListListB=relay, PaddingMode=2)  # -> ListListA, ListListB
longest_list_5 = LongestList(ListListA=list_a_5, ListListB=relay, PaddingMode=2)  # -> ListListA, ListListB
longest_list_6 = LongestList(ListListA="null", ListListB=relay, PaddingMode=2)  # -> ListListA, ListListB
longest_list_7 = LongestList(ListListA=text_join, ListListB=relay, PaddingMode=2)  # -> ListListA, ListListB
d5 = ClusterInput()
merge_2 = Merge(
    Data1=simplify(graft(longest_list_7.ListListA)),
    Data2=simplify(graft(end_points.Start)),
    Data3=simplify(graft(longest_list_6.ListListA)),
    Data4=simplify(graft(end_points.End)),
    Data5=simplify(graft(d5)),
    Data6=simplify(graft(longest_list.ListListA)),
    Data7=simplify(graft(longest_list_2.ListListA)),
    Data8=simplify(graft(longest_list_3.ListListA)),
    Data9=simplify(graft(longest_list_4.ListListA)),
    Data10=simplify(graft(longest_list_5.ListListA)))  # -> simplify(Result)
file_path = ClusterInput()
define_object_attributes = DefineObjectAttributes(UserKeys=panel, UserValues=merge_2, Layer=text_join, Color=colour_rgb)
write_options = WriteOptions(
    FilePath=file_path,
    ClearDataOverwrite=True,
    SaveAfterWrite=False,
    CloseAfterWrite=False,
    ColumnStartPosition=1,
    RowStartPosition=1)  # -> UserMessages, WriteOptions
flip_matrix = FlipMatrix(Data=merge_2)
bake = ClusterInput()
bake_objects = BakeObjects(Geometry=line_2, Attributes=define_object_attributes, Bake=bake)
run = ClusterInput()
write_to_excel = WriteToExcel(
    Run=run,
    ExcelWorksheet="1",
    ColumnNames=panel,
    WriteOptions=write_options.WriteOptions,
    ColumnnsOrRows=Toggle(False),
    DataToWriteIntoColumns=flip_matrix)

# ==== cluster Cluster_10
d1 = ClusterInput()
d2 = ClusterInput()
merge = Merge(Data1=d1, Data2=d2)
seed = ClusterInput()
A = ClusterInput()
A_2 = ClusterInput()
relay = ClusterInput()
cluster = Cluster(seed=seed, A=A, A_2=A_2)  # -> random_2, random_4, random_6
text_join = TextJoin(Text=merge)

# ---- group: 随机颜色
colour_rgb = ColourRGB(Alpha=255, Red=cluster.random_2, Green=cluster.random_4, Blue=cluster.random_6)

# ----
curve = ClusterInput()
line = ClusterInput()
end_points = EndPoints(Curve=curve)  # -> Start, End
line_2 = Line(simplify(graft(line)))
panel = Panel("""Set
Location_start
Location_mid
Location_end
Z_vector
Material_name
Section_name
Timestamp
Beam_type
Is_offset""")
list_a = ClusterInput()
list_a_2 = ClusterInput()
list_a_3 = ClusterInput()
list_a_4 = ClusterInput()
list_a_5 = ClusterInput()
longest_list = LongestList(ListListA=list_a, ListListB=relay, PaddingMode=2)  # -> ListListA, ListListB
longest_list_2 = LongestList(ListListA=list_a_2, ListListB=relay, PaddingMode=2)  # -> ListListA, ListListB
longest_list_3 = LongestList(ListListA=list_a_3, ListListB=relay, PaddingMode=2)  # -> ListListA, ListListB
longest_list_4 = LongestList(ListListA=list_a_4, ListListB=relay, PaddingMode=2)  # -> ListListA, ListListB
longest_list_5 = LongestList(ListListA=list_a_5, ListListB=relay, PaddingMode=2)  # -> ListListA, ListListB
longest_list_6 = LongestList(ListListA="null", ListListB=relay, PaddingMode=2)  # -> ListListA, ListListB
longest_list_7 = LongestList(ListListA=text_join, ListListB=relay, PaddingMode=2)  # -> ListListA, ListListB
d5 = ClusterInput()
merge_2 = Merge(
    Data1=simplify(graft(longest_list_7.ListListA)),
    Data2=simplify(graft(end_points.Start)),
    Data3=simplify(graft(longest_list_6.ListListA)),
    Data4=simplify(graft(end_points.End)),
    Data5=simplify(graft(d5)),
    Data6=simplify(graft(longest_list.ListListA)),
    Data7=simplify(graft(longest_list_2.ListListA)),
    Data8=simplify(graft(longest_list_3.ListListA)),
    Data9=simplify(graft(longest_list_4.ListListA)),
    Data10=simplify(graft(longest_list_5.ListListA)))  # -> simplify(Result)
file_path = ClusterInput()
define_object_attributes = DefineObjectAttributes(UserKeys=panel, UserValues=merge_2, Layer=text_join, Color=colour_rgb)
write_options = WriteOptions(
    FilePath=file_path,
    ClearDataOverwrite=True,
    SaveAfterWrite=False,
    CloseAfterWrite=False,
    ColumnStartPosition=1,
    RowStartPosition=1)  # -> UserMessages, WriteOptions
flip_matrix = FlipMatrix(Data=merge_2)
bake = ClusterInput()
bake_objects = BakeObjects(Geometry=line_2, Attributes=define_object_attributes, Bake=bake)
run = ClusterInput()
write_to_excel = WriteToExcel(
    Run=run,
    ExcelWorksheet="1",
    ColumnNames=panel,
    WriteOptions=write_options.WriteOptions,
    ColumnnsOrRows=Toggle(False),
    DataToWriteIntoColumns=flip_matrix)

# ==== cluster Cluster
construct_domain = ConstructDomain(DomainStart=Slider(0, range=0..100), DomainEnd=Slider(255, range=0..1000))
seed = ClusterInput()
number_slider = Slider(100, range=0..100)
random = Random(Range=construct_domain, Number=1, Seed=seed)
A = ClusterInput()
A_2 = ClusterInput()
random_2 = ClusterOutput(random)
addition = Addition(A=A, B=number_slider)
random_3 = Random(Range=construct_domain, Number=1, Seed=addition)
random_4 = ClusterOutput(random_3)
subtraction = Subtraction(A=A_2, B=number_slider)
random_5 = Random(Range=construct_domain, Number=1, Seed=subtraction)
random_6 = ClusterOutput(random_5)
